# Grasshopper definition 240512_DigitalFUTURES_Cassette_Rhino8.gh (Grasshopper 1.0.7)
# plug-ins: Fab.Grasshopper, Virtual Robot, Pufferfish

table_plates = Brep([<brep referenced from the Rhino model> x4])
table_beams = Brep([<brep referenced from the Rhino model> x32])
cassette_beams = Brep([<brep referenced from the Rhino model> x6])
cassette_plates = Brep([<brep referenced from the Rhino model> x2])
stack = Brep([<brep referenced from the Rhino model> x4])
weird = Brep([<brep referenced from the Rhino model> x3])
reset = ResetFabCollection(Reset=Button())
allids = AllCollectionIDs(Refresh=Button(), FabCollection=reset)  # -> DesignElementNames, DesignPlateNames, DesignBeamNames, DesignComponentNames, FabElementNames, FabPlateNames, FabBeamNames, FabComponentNames, FabTaskNames, FabTaskSequenceSchema
beams = Brep(cassette_beams)
plates = Brep(cassette_plates)
panel = Panel(allids.FabTaskNames)

# ---- group: Cassette Frames
debrep = DeconstructBrep(Brep=beams)  # -> Faces, Edges, Vertices
area = Area(Geometry=debrep.Faces)  # -> Area, Centroid
sort = SortList(Keys=area.Area, ValuesA=debrep.Faces)  # -> Keys, reverse(ValuesA)
item = ListItem(List=sort.ValuesA, Index=0, Wrap=True)
debrep_2 = DeconstructBrep(Brep=item)  # -> Faces, Edges, Vertices
len = Length(Curve=debrep_2.Edges)
sort_2 = SortList(Keys=len, ValuesA=debrep_2.Edges)  # -> Keys, reverse(ValuesA)
item_2 = ListItem(List=sort_2.ValuesA, Index=0, Wrap=True)  # -> flatten(Item)
hframe = HorizontalFrame(Curve=reparameterize(item_2), Parameter="0.3")

# ----
objectsbyname = GetObjects(Name=allids.FabTaskNames)  # -> Name, ObjectType, Objects

# ---- group: Recording Tool for Animations
data = Data(Tree({0;0;0;0}: ["1", "2", "3", "4", "5", "6", "7", "8", "9", "10"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], {0;0;0;1}: ["0", "0", "0", "0", "0", "0", "0", "0", "0", "0"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]))  # disabled
number_slider = Slider(150, range=0..150)  # disabled
panel_2 = Panel("151")  # disabled
split = SplitList(List=data, Index=panel_2)  # -> ListA, ListB; disabled
item_3 = ListItem(List=split.ListA, Index=number_slider, Wrap=True)  # -> simplify(Item); disabled
bang = ExplodeTree(Data=item_3)  # -> Branch0, Branch1; disabled

# ---- group: Recording Tool for Animations / Plug into I/SI for recording
graft = GraftTree(IncludeEmptyLists=True, IncludeNullItems=True)  # disabled
rec = DataRecorder(graft, DataLimit=-10, RecordData=False)  # disabled

# ---- group: Cassette Frames
prot = RotatePlane(Plane=hframe, Angle=degrees("180"))
panel_3 = Panel("""1
5""")
item_4 = ListItem(List=hframe, Index=panel_3, Wrap=True)
panel_4 = Panel("""0
2
3
4""")
item_5 = ListItem(List=prot, Index=panel_4, Wrap=True)
panel_5 = Panel("""0
1
0
0
0
1""")
weave = Weave(Pattern=panel_5, Stream0=item_5, Stream1=item_4, NullGaps=False)

# ----
pt = Point(Point(-1770, -480, 250))
xy = XYPlane(Origin=pt)
prot_2 = RotatePlane(Plane=xy, Angle=degrees("90"))
brep = Brep([<brep referenced from the Rhino model> x8])
staticenv = DefineStaticEnv(Index=0, Name="PlateTable", ReferencePlane=prot_2, AlignPlane=prot_2, Width=1000, Length=500, Height=40, Geometry=brep)

pt_2 = Point(Point(0, 2000, 50))
xy_2 = XYPlane(Origin=pt_2)
brep_2 = Brep(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)
prot_3 = RotatePlane(Plane=xy_2, Angle=degrees("0"))
staticenv_2 = DefineStaticEnv(
    Index="1",
    Name="WorkTable",
    ReferencePlane=prot_3,
    AlignPlane=prot_3,
    Width=1000,
    Length=500,
    Height=40,
    Geometry=brep_2)

pt_3 = Point([Point(1770, 1020, 250), Point(1770, 1220, 250), Point(1770, 1420, 250), Point(1770, 1620, 250), Point(1770, 1820, 250)])
xy_3 = XYPlane(Origin=pt_3)
prot_4 = RotatePlane(Plane=xy_3, Angle=degrees("0"))
brep_3 = Brep([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])
staticenv_3 = DefineStaticEnv(Index=0, Name="BeamTable", ReferencePlane=prot_4, AlignPlane=prot_4, Width=1000, Length=500, Height=40, Geometry=brep_3)

db = DesignBeam(Name="TestBeams", Geometry=beams, Index=-1)
dp = DesignPlate(Name="TestPlate", Geometry=plates, Index=-1)
dc = DesignComponent(Name="Comp_V2", DesignPlates=dp, DesignBeams=db, Index=-1)
fabcomponent = DefineFabComponent(DesignComponent=dc, StaticEnvFab=staticenv_2, StaticEnvPlate=staticenv, StaticEnvBeam=staticenv_3)

action = DefineAction(ActionID="0", Name="Pick", Type="Pick")
action_2 = DefineAction(ActionID="1", Name="Place", Type="Place")
merge = Merge(Data1=action, Data2=action_2)

action_3 = DefineAction(ActionID="2", Name="Pick", Type="Pick")
action_4 = DefineAction(ActionID="3", Name="Place", Type="Place")
merge_2 = Merge(Data1=action_3, Data2=action_4)

pln = Plane(PlaneYZ(694.3991508, -2000, 696.0446791))
pflip = FlipPlane(Plane=pln, ReverseX=False, ReverseY=False, SwapAxes=True)
prot_5 = RotatePlane(Plane=pflip, Angle=degrees("90"))
brep_4 = Brep([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])
pln_2 = Plane(prot_5)
pln_3 = Plane(PlaneYZ(322.3991508, -2000, 696.0446791))
endeffector = DefineEndeffector(
    ToolNum="1",
    ToolName="VacuumGripper",
    Geometry=brep_4,
    TCPFrame=pln_2,
    MountingFrame=pln_3,
    Actions=merge_2,
    FootprintWidth="1650",
    FootprintLength="1250",
    FootprintHeight="300",
    ZOffset=0)

decfe = DeconstructFabElement(FabElements=fabcomponent)  # -> Name, RefPln_Situ, RefPln_SituBox, RefPln_Mag, RefPln_Fab, RefPln_FabOut, GeometryBoxSitu, GeometrySitu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
decfe_2 = DeconstructFabElement(FabElements=decfe.FabPlates)  # -> Name, RefPln_Situ, RefPln_SituBox, RefPln_Mag, RefPln_Fab, RefPln_FabOut, GeometryBoxSitu, GeometrySitu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
decfe_3 = DeconstructFabElement(FabElements=decfe.FabBeams)  # -> Name, RefPln_Situ, RefPln_SituBox, RefPln_Mag, RefPln_Fab, RefPln_FabOut, GeometryBoxSitu, GeometrySitu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

pln_4 = Plane(PlaneXY(0, 3, 174))
prot_6 = RotatePlane(Plane=pln_4, Angle=degrees("180"))
pln_5 = Plane(prot_6)
brep_5 = Brep([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])
pln_6 = Plane(Plane(origin=(-1.34550307e-12, 419.6754097, 386.6754097), x=(1, 0, 0), y=(0, -0.7071067812, 0.7071067812)))
endeffector_2 = DefineEndeffector(
    ToolNum="2",
    ToolName="BeamGripper",
    Geometry=brep_5,
    TCPFrame=pln_5,
    MountingFrame=pln_6,
    Actions=merge,
    FootprintWidth="485",
    FootprintLength="200",
    FootprintHeight="-120",
    ZOffset="0")

item_6 = ListItem(List=decfe_2.Name, Index=0, Wrap=True)  # -> Item, Item1
merge_3 = Merge(Data1=endeffector_2, Data2=endeffector)
xy_4 = XYPlane(Origin=Point(0, 0, 0))
actor = DefineActor(Name="Robot", RefPln=xy_4, Tools=merge_3, MaxWeight=-1)

# ----
# Simulate FabTask
number_slider_2 = Slider(0, range=0..24)
trigger = Trigger(Interval=500, TimerInterval=500, Target=simfabtask)  # disabled
pln_7 = Plane(Plane(origin=(-2375, 558.67, 1992.75), x=(0, -1, 0), y=(1, 0, 0)))
# VirtualRobot Simulation
simfabtask = SimulateFabTaskVirtualRobot(
    FabTasks=objectsbyname.Objects,
    Actor=actor,
    ActorDefaultPlane=pln_7,
    TaskIndex=Slider(0, range=0..100),
    TaskSubIndex=number_slider_2,
    Reset=Button())  # -> TaskIndex, TaskSubIndex, Name, ToolNumber, Geometry, TCP, E1Value, E2Value, E3Value
panel_6 = Panel([simfabtask.E1Value, simfabtask.E2Value, simfabtask.E3Value])
panel_7 = Panel([simfabtask.TaskIndex, simfabtask.TaskSubIndex])
panel_8 = Panel(simfabtask.Name)
geo = Geometry(simfabtask.Geometry)
panel_9 = Panel(simfabtask.ToolNumber)
pln_8 = Plane(simfabtask.TCP)

# ----
# VirtualRobot Setup
python = GhPythonScript(iFabTools=merge_3)  # -> oVR_Tools; inputs iFabTools: list
# ---------- python: Python ----------
import Rhino.Geometry as rg
import ghpythonlib.components as ghc


tool_dict = {}
tool_List = []
toolsData = []
toolsNum = []
for i in range(len(iFabTools)):
    toolName = iFabTools[i].Name
    toolNum = iFabTools[i].ToolNum
    toolGeo = iFabTools[i].Geometry
    toolTcpPln= iFabTools[i].TcpPln
    toolMountPln = iFabTools[i].MountPln
    endeffector = ghc.VirtualRobot.DefineEndEffector(toolGeo, toolTcpPln, toolMountPln)
    tool_dict[toolNum] = endeffector

tool_List.append(tool_dict) # only 'way' to output dictionary

# Output the dictionary
oVR_Tools = tool_List
# ---------- end python ----------
pln_9 = Plane(PlaneXY(-2375, 558.67, -7.25))
kuka_kr_420 = PredefinedKUKAKR420R3080(RobRootFrame=PlaneXY(0, 0, 0))
python_2 = GhPythonScript(iToolNum=simfabtask.ToolNumber, iVR_Tools=python)  # -> oVR_Tool; inputs iToolNum: Int32
# ---------- python_2: Python ----------
oVR_Tool = iVR_Tools.get(iToolNum)
# ---------- end python_2 ----------
data_2 = Data(kuka_kr_420)
set_end_effector = SetEndEffector(IRobot=data_2, IEffector=python_2)
neg = Negative(Value=simfabtask.E1Value)
robot_ik = RobotInverseKinematics(Robot=set_end_effector, TargetTCPFrame=pln_8, AxisToggles=[False, False, False], useColorPreview=True)  # -> PoseGeometry, AxisValues, AxisFrames
item_7 = ListItem(List=robot_ik.AxisFrames, Index=0, Wrap=True)
item_8 = ListItem(List=robot_ik.AxisFrames, Index=5, Wrap=True)
swatch = ColourSwatch(SwatchColor=RGB(255, 0, 255))
roundd = RoundToDecimalPlace(NumberX=simfabtask.E2Value, DecimalPlace=2, RoundType=0)  # -> Rounded, Difference
roundd_2 = RoundToDecimalPlace(NumberX=simfabtask.E1Value, DecimalPlace=2, RoundType=0)  # -> Rounded, Difference
tag = TextTag(Text=roundd.Rounded, Colour=swatch)
tag_2 = TextTag(Location=item_8, Text=simfabtask.Name, Colour=ColourSwatch(SwatchColor=RGB(255, 255, 0)))
tag_3 = TextTag(Location=item_7, Text=roundd_2.Rounded, Colour=swatch)

# ---- group: GhostSolver Check all Frames from Task
simfabtaskall = SimulateFabTaskVirtualRobot()  # -> TaskIndex, TaskSubIndex, Name, ToolNumber, Geometry, TCP, E1Value, E2Value, E3Value; disabled
python_3 = GhPythonScript(
    iIndex=simfabtaskall.TaskIndex,
    iSubIndex=simfabtaskall.TaskSubIndex,
    iTaskName=simfabtaskall.Name,
    iToolNum=simfabtaskall.ToolNumber,
    iGeometry=simfabtaskall.Geometry,
    iTCP=simfabtaskall.TCP,
    iE1=simfabtaskall.E1Value,
    iE2=simfabtaskall.E2Value,
    iRobotPlatform=data_2,
    iVR_Tools=python)  # -> out, failedIndex, failedSubIndex, failedTaskName, failedTCP; inputs iIndex: tree of Int32, iSubIndex: tree of Int32, iTaskName: tree, iToolNum: tree of Int32, iGeometry: tree of Mesh, iTCP: tree of Plane, iE1: tree, iE2: tree; disabled
# ---------- python_3: Python ----------
import ghpythonlib.components as ghc
import math
import Grasshopper.Kernel as gh
from Grasshopper.Kernel import GH_RuntimeMessageLevel as RML

import clr
clr.AddReference("VirtualRobot.Core.dll")
import ICD.VirtualRobot.Core as VR

failedIndex = []
failedSubIndex = []
failedTaskName = []
failedTCP = []

def CheckAxisLimits(aV):
    for i in range(len(aV)):
        if math.isnan(aV[i]):
            errorMessage = "TCP can't be reached."
            return False, errorMessage
    if aV[0] < (-185) or aV[0] > 185:
        errorMessage = "A1 limit reached: " + str(aV[0])
        return False, errorMessage
    if aV[1] < (-130) or aV[1] > 20:
        errorMessage = "A2 limit reached: " + str(aV[1])
        return False, errorMessage
    if aV[2] < (-100) or aV[2] > 144:
        errorMessage = "A3 limit reached: " + str(aV[2])
        return False, errorMessage
    if aV[3] < (-350) or aV[3] > 350:
        errorMessage = "A4 limit reached: " + str(aV[3])
        return False, errorMessage
    if aV[4] < (-120) or aV[4] > 120:
        errorMessage = "A5 limit reached: " + str(aV[4])
        return False, errorMessage
    if aV[5] < (-350) or aV[5] > 350:
        errorMessage = "A6 limit reached: " + str(aV[5])
        return False, errorMessage
    return True, "No Axis limit reached."


for i in range(iTCP.BranchCount):
    tcpBranch = iTCP.Branch(i)
    for j in range(len(tcpBranch)):
        index = iIndex.Branch(i)[j]
        subIndex = iSubIndex.Branch(i)[j]
        taskName = iTaskName.Branch(i)[j]
        taskNameID = "I:" + str(index) + " SI:" + str(subIndex) + " - " + str(taskName)
        
        iRobotPlatform.Robot.EndEffector = iVR_Tools.get(iToolNum.Branch(i)[j])
        robot = iRobotPlatform
        tcp = iTCP.Branch(i)[j]
        axisToggles = [False, False, False]
        linAxisValue = -iE1.Branch(i)[j]
        #if j == 1:
        a = robot
        b = tcp
        c = linAxisValue
        poseGeo, colGeo, axisValues, axisFrames = ghc.VirtualRobot.RoboticPlatformInverseKinematics(robot, tcp, axisToggles, linAxisValue)
        noAxisLimit, errorMessage_Axis =  CheckAxisLimits(axisValues)
        if noAxisLimit == False:
            warning_message = str(taskNameID) + " | " + str(errorMessage_Axis)
            ghenv.Component.AddRuntimeMessage(RML.Warning, warning_message)
            print warning_message
            failedIndex.append(index)
            failedSubIndex.append(subIndex)
            failedTaskName.append(taskName)
            failedTCP.append(tcp)
# ---------- end python_3 ----------
pln_10 = Plane(python_3.failedTCP)
panel_10 = Panel(python_3.out)
eo = DeconstructObject()

# ----
pnp = PickPlace(
    FabComponent=fabcomponent,
    FabElementName=item_6.Item,
    Actor=actor,
    Endeffector=endeffector,
    PickAction=action_3,
    PlaceAction=action_4)  # -> FabComponent, Pick, Place
pnp_2 = PickPlace(
    FabComponent=pnp.FabComponent,
    FabElementName=decfe_3.Name,
    Actor=actor,
    Endeffector=endeffector_2,
    PickAction=action,
    PlaceAction=action_2)  # -> FabComponent, Pick, Place
pnp_3 = PickPlace(
    FabComponent=pnp_2.FabComponent,
    FabElementName=item_6.Item1,
    Actor=actor,
    Endeffector=endeffector,
    PickAction=action_3,
    PlaceAction=action_4)  # -> FabComponent, Pick, Place
