# Grasshopper definition 240512_DigitalFUTURES_TestFile.gh (Grasshopper 1.0.7)
# plug-ins: Fab.Grasshopper, Pufferfish, VirtualRobot.Grasshopper, DesFab.GH

reset = ResetFabCollection(Reset=Button())
allids = AllCollectionIDs(Refresh=Button(), FabCollection=reset)  # -> DesignElementNames, DesignPlateNames, DesignBeamNames, DesignComponentNames, FabElementNames, FabPlateNames, FabBeamNames, FabComponentNames, FabTaskNames, FabTaskSequenceSchema
panel = Panel(allids.DesignElementNames)

bridge = Brep([<brep referenced from the Rhino model> x17])
table_plates = Brep([<brep referenced from the Rhino model> x4])
table_beams = Brep([<brep referenced from the Rhino model> x32])
cassette_beams = Brep([<brep referenced from the Rhino model> x6])
cassette_plates = Brep([<brep referenced from the Rhino model> x2])
volume = Volume(Geometry=bridge)  # -> Volume, Centroid
stack = Brep([<brep referenced from the Rhino model> x4])
weird = Brep([<brep referenced from the Rhino model> x3])
brep = Brep([<brep referenced from the Rhino model> x13])
brep_2 = Brep([<brep referenced from the Rhino model> x124])
pdecon = Deconstruct(Point=volume.Centroid)  # -> XComponent, YComponent, ZComponent
sort = SortList(Keys=pdecon.ZComponent, ValuesA=bridge)  # -> Keys, ValuesA
beams = Brep(brep_2)
plates = Brep(cassette_plates)
brep_3 = Brep(sort.ValuesA)
chair_support = Brep([<brep referenced from the Rhino model> x33])
chair_build = Brep([<brep referenced from the Rhino model> x83])

pt = Point(Point(-654.7380293, 6437.874992, -266.9738741))
xy = XYPlane(Origin=pt)
prot = RotatePlane(Plane=xy, Angle=degrees("0"))
brep_4 = Brep([<brep referenced from the Rhino model> x8])
staticenv = DefineStaticEnv(Index=0, Name="PlateTable", ReferencePlane=prot, AlignPlane=prot, Width=1000, Length=500, Height=40, Geometry=brep_4)

pt_2 = Point(Point(2025.261971, 817.874992, 203.0261259))
xy_2 = XYPlane(Origin=pt_2)
prot_2 = RotatePlane(Plane=xy_2, Angle=degrees("-90"))
brep_5 = Brep(<brep referenced from the Rhino model>)
staticenv_2 = DefineStaticEnv(
    Index="1",
    Name="WorkTable",
    ReferencePlane=prot_2,
    AlignPlane=prot_2,
    Width=1000,
    Length=500,
    Height=40,
    Geometry=brep_5)

pt_3 = Point([Point(805.2619707, -1602.125008, 203.0261259), Point(805.2619707, -1802.125008, 203.0261259), Point(805.2619707, -2002.125008, 203.0261259), Point(805.2619707, -2202.125008, 203.0261259), Point(805.2619707, -2402.125008, 203.0261259)])
xy_3 = XYPlane(Origin=pt_3)
prot_3 = RotatePlane(Plane=xy_3, Angle=degrees("180"))
brep_6 = Brep([<brep referenced from the Rhino model> x10])
staticenv_3 = DefineStaticEnv(Index=0, Name="BeamTable", ReferencePlane=prot_3, AlignPlane=prot_3, Width=1000, Length=500, Height=40, Geometry=brep_6)

db = DesignBeam(Name="DesignBeams", Geometry=chair_build, Index=-1)
dp = DesignPlate(Name="TestPlate", Geometry=plates, Index=-1)
db_2 = DesignBeam(Name="SupportBeams", Geometry=chair_support, Index=-1)
number_slider = Slider(0.05, range=0..0.1)

action = DefineAction(ActionID="2", Name="Pick", Type="Pick")
action_2 = DefineAction(ActionID="3", Name="Place", Type="Place")
merge = Merge(Data1=action, Data2=action_2)

action_3 = DefineAction(ActionID="0", Name="Pick", Type="Pick")
action_4 = DefineAction(ActionID="1", Name="Place", Type="Place")
merge_2 = Merge(Data1=action_3, Data2=action_4)

action_5 = DefineAction(ActionID="10", Name="Dowel", Type="Dowel")
merge_3 = Merge(Data1=action_5)

dc = DesignComponent(Name="GeneratedChair", DesignBeams=[db, db_2], Index=-1)
fabcomponent = DefineFabComponent(DesignComponent=dc, StaticEnvFab=staticenv_2, StaticEnvBeam=staticenv_3)
dict = CreateDictionary()

pln = Plane(PlaneYZ(694.3991508, -2000, 696.0446791))
pflip = FlipPlane(Plane=pln, ReverseX=False, ReverseY=False, SwapAxes=True)
prot_4 = RotatePlane(Plane=pflip, Angle=degrees("90"))
brep_7 = Brep([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])
pln_2 = Plane(prot_4)
pln_3 = Plane(PlaneYZ(322.3991508, -2000, 696.0446791))
endeffector = DefineEndeffector(
    ToolNum="1",
    ToolName="VacuumGripper",
    Geometry=brep_7,
    TCPFrame=pln_2,
    MountingFrame=pln_3,
    Actions=merge,
    FootprintWidth="1650",
    FootprintLength="1250",
    FootprintHeight="300",
    ZOffset=0)

item = ListItem(List=db, Index=0, Wrap=True)
decfe = DeconstructFabElement(FabElements=fabcomponent, PreviewScale=1)  # -> Name, Index, RefPln_Situ, RefPln_SituBox, RefPln_Mag, RefPln_Fab, RefPln_FabOut, GeometryBoxSitu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
decde = DeconstructDesignElement(DesignElements=db_2, PreviewScale=Slider(0.6, range=0..1))  # -> Name, Geometry, FrameBase, FrameLower, FrameUpper, DesignLine, BrepBox, DesignRegion
sortz = SortByZHeight(FabComponent=fabcomponent)

pln_4 = Plane(PlaneXY(0, 3, 174))
prot_5 = RotatePlane(Plane=pln_4, Angle=degrees("180"))
pln_5 = Plane(prot_5)
brep_8 = Brep([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])
pln_6 = Plane(Plane(origin=(-1.34550307e-12, 419.6754097, 386.6754097), x=(1, 0, 0), y=(0, -0.7071067812, 0.7071067812)))
endeffector_2 = DefineEndeffector(
    ToolNum="2",
    ToolName="BeamGripper",
    Geometry=brep_8,
    TCPFrame=pln_5,
    MountingFrame=pln_6,
    Actions=merge_2,
    FootprintWidth="485",
    FootprintLength="200",
    FootprintHeight="-120",
    ZOffset="0")

panel_2 = Panel(decfe.Name)
decfe_2 = DeconstructFabElement(FabElements=decfe.FabBeams, PreviewScale=Slider(0.57, range=0..1))  # -> Name, Index, RefPln_Situ, RefPln_SituBox, RefPln_Mag, RefPln_Fab, RefPln_FabOut, GeometryBoxSitu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
brep_9 = Brep(decde.Geometry)
end = EndPoints(Curve=decde.DesignLine)  # -> Start, End
eo = DeconstructObject(Object=db)  # -> BaseLine, StartPoint, EndPoint, Name, Id, Index, ElementName, Type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

pln_7 = Plane(Plane(origin=(-279.184982, -0.44971, 274.124232), x=(0.00021000003, 0.5129120733, -0.8584411226), y=(-0.0001250000141, 0.8584411483, 0.512912058)))
pln_8 = Plane(PlaneXY(0, 0, 0))
prot_6 = RotatePlane(Plane=pln_8, Angle=degrees("-90"))
mesh = Mesh(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)
endeffector_3 = DefineEndeffector(ToolNum="3", ToolName="DowelPlacer", Geometry=mesh, TCPFrame=prot_6, MountingFrame=pln_7, Actions=merge_3, ZOffset=0)

merge_4 = Merge(Data1=decfe_2.Name)
merge_5 = Merge(Data1=endeffector_2, Data3=endeffector_3)  # -> flatten(Result)
action_6 = DefineAction(ActionID="16", Name="travelTest", Type="travelTest")
xy_4 = XYPlane(Origin=Point(0, 0, 0))
line = Line(Line((0, -1000, 0), (0, 5000, 0)))
actor = DefineActor(Name="Robot", RefPln=xy_4, Tools=merge_5, Actions=action_6, LinearAxis=line, MaxWeight=-1)

# ----
# Sort By Index Value Component missing
decfe_3 = DeconstructFabElement(FabElements=sortz, PreviewScale=1)  # -> Name, Index, RefPln_Situ, RefPln_SituBox, RefPln_Mag, RefPln_Fab, RefPln_FabOut, GeometryBoxSitu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; disabled
filtername = FilterElementsByName(Name="DesignBeams", Element=decfe_3.FabBeams)  # -> FoundElements, Index; disabled
decfe_4 = DeconstructFabElement(FabElements=filtername.FoundElements, PreviewScale=1)  # -> Name, Index, RefPln_Situ, RefPln_SituBox, RefPln_Mag, RefPln_Fab, RefPln_FabOut, GeometryBoxSitu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; disabled
decde_2 = DeconstructDesignElement(DesignElements=decfe_4.DesignElements, PreviewScale=1)  # -> Name, Geometry, FrameBase, FrameLower, FrameUpper, DesignLine, BrepBox, DesignRegion; disabled
orient = Orient(Geometry=decde_2.FrameUpper, Source=decfe_4.RefPln_Situ, Target=decfe_4.RefPln_Mag)  # -> Geometry, Transform; disabled
orient_2 = Orient(Geometry=decde_2.FrameUpper, Source=decfe_4.RefPln_Situ, Target=decfe_4.RefPln_FabOut)  # -> Geometry, Transform; disabled
panel_3 = Panel("PickTest")  # disabled
panel_4 = Panel("PlaceTest")  # disabled
e1 = GetLinearAxisValue(Plane=orient.Geometry, Actor=actor)  # -> MainExtValues, E1; disabled
e1_2 = GetLinearAxisValue(Plane=orient_2.Geometry, Actor=actor)  # -> MainExtValues, E1; disabled
ft = CreateFabTask(
    Name=panel_4,
    Action=action_3,
    Actor=actor,
    Tool=endeffector_2,
    StaticEnvironment=staticenv_3,
    FabElement=filtername.FoundElements)  # disabled
ft_2 = CreateFabTask(
    Name=panel_3,
    Action=action_3,
    Actor=actor,
    Tool=endeffector_2,
    StaticEnvironment=staticenv_3,
    FabElement=filtername.FoundElements)  # disabled
ftf = CreateFabTaskFrame(
    FabTask=simplify(graft(ft)),
    MainFrames=simplify(graft(orient_2.Geometry)),
    MainExtValues=simplify(graft(e1_2.MainExtValues)))  # -> flatten(FabTaskFrame); disabled
ftf_2 = CreateFabTaskFrame(
    FabTask=simplify(graft(ft_2)),
    MainFrames=simplify(graft(orient.Geometry)),
    MainExtValues=simplify(graft(e1.MainExtValues)))  # -> flatten(FabTaskFrame); disabled
weave = Weave(Pattern=[0, 1], Stream0=ftf_2, Stream1=ftf, NullGaps=False)  # disabled

pnp = PickPlace(
    FabComponent=sortz,
    FabElementName=merge_4,
    Actor=actor,
    Endeffector=endeffector_2,
    PickAction=action_3,
    PlaceAction=action_4)  # -> FabComponent, PickPlaceTask; disabled
dnpnp = DowelPickPlace(
    FabComponent=sortz,
    FabElementName=merge_4,
    Actor=actor,
    EndeffectorPnP=endeffector_2,
    PickAction=action_3,
    PlaceAction=action_4,
    RotatePlacePlane="0",
    EndeffectorDowel=endeffector_3,
    DowelAction=action_5,
    RotateDowelPlane="0")  # -> FabComponent, SortedTasks, DowelTask, PickPlaceTask

# ----
# Simulate FabTask
number_slider_2 = Slider(0, range=0..24)
trigger = Trigger(Interval=200, TimerInterval=200, Target=simfabtask)  # disabled
pln_9 = Plane(Plane(origin=(-2375, 558.67, 1992.75), x=(0, -1, 0), y=(1, 0, 0)))
# VirtualRobot Simulation
simfabtask = SimulateFabTaskVirtualRobot(
    FabTasks=dnpnp.SortedTasks,
    Actor=actor,
    ActorDefaultPlane=pln_9,
    TaskIndex=Slider(0, range=0..100),
    TaskSubIndex=number_slider_2,
    Reset=Button())  # -> TaskIndex, TaskSubIndex, Name, ToolNumber, Geometry, TCP, E1Value, E2Value, E3Value
geo = Geometry(simfabtask.Geometry)
panel_5 = Panel([simfabtask.E1Value, simfabtask.E2Value, simfabtask.E3Value])
panel_6 = Panel([simfabtask.TaskIndex, simfabtask.TaskSubIndex])
panel_7 = Panel(simfabtask.Name)
panel_8 = Panel(simfabtask.ToolNumber)
pln_10 = Plane(simfabtask.TCP)

# ---- group: Recording Tool for Animations
data = Data(Tree({0;0;0;0}: ["1", "2", "3", "4", "5", "6", "7", "8", "9", "10"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], {0;0;0;1}: ["0", "0", "0", "0", "0", "0", "0", "0", "0", "0"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]))  # disabled
number_slider_3 = Slider(150, range=0..150)  # disabled
panel_9 = Panel("151")  # disabled
split = SplitList(List=data, Index=panel_9)  # -> ListA, ListB; disabled
item_2 = ListItem(List=split.ListA, Index=number_slider_3, Wrap=True)  # -> simplify(Item); disabled
bang = ExplodeTree(Data=item_2)  # -> Branch0, Branch1; disabled

# ---- group: Recording Tool for Animations / Plug into I/SI for recording
graft = GraftTree(IncludeEmptyLists=True, IncludeNullItems=True)  # disabled
rec = DataRecorder(graft, DataLimit=-10, RecordData=False)  # disabled

# ----
merge_6 = Merge(Data2=dnpnp.SortedTasks)  # -> flatten(Result)
desfabtasks = ConvertoToDesFabTasks(FabTasks=merge_6, JobIndex="0")  # -> DesFabTasks, DesFabActorData
python = GhPythonScript(iTasks=desfabtasks.DesFabTasks)  # -> out, iDesFabTasks; inputs iTasks: list
# ---------- python: Python ----------
import ghpythonlib.components as ghc
import ghpythonlib.treehelpers as th
import Rhino.Geometry as rg

desFabTasks = []

def CheckIfAxisTask(mainExternalAxis):
    isAxisTask = False
    if mainExternalAxis != None:
            for external in mainExternalAxis:
                externalKey = external.Key
                if (externalKey == "A1" or externalKey == "A2" or externalKey == "A3" or externalKey == "A4" or externalKey == "A5" or externalKey == "A6"):
                    isAxisTask = True
    return isAxisTask


def ConvertToKukaAxisValuesFrameTask(externalAxisValues): #error is here
    kukaAxisValues = {}
    externalKeysList = []
    
    if externalAxisValues != None:
        externalValues = []
        for external in externalAxisValues:
            externalKey = external.Key
            externalKeysList.append(externalKey)
            for value in external.Value:
                externalValues.append(value)
    
    externalValuesTree = th.list_to_tree(externalValues)
    
    kukaAxisValues = ghc.Twico.KukaAxisValues(externalKeysList,externalValuesTree)
    
    return kukaAxisValues


def ConvertToKukaAxisValuesAxisTask(externalAxisValues):
    kukaMainAxisValues = {}
    kukaExternalAxisValues = {}
    
    mainKeysList = []
    mainValuesNestedList = []
    
    externalKeysList = []
    externalValuesNestedList = []
    
    if externalAxisValues != None:
        for external in externalAxisValues:
            externalKey = external.Key
            
            mainValues = []
            externalValues = []
            for value in external.Value:
                if (externalKey == "A1" or externalKey == "A2" or externalKey == "A3" or externalKey == "A4" or externalKey == "A5" or externalKey == "A6"):
                    mainKeysList.append(externalKey)
                    mainValues.append(value)
                else:
                    externalKeysList.append(externalKey)
                    externalValues.append(value)
            
            mainValuesNestedList.append(mainValues)
            externalValuesNestedList.append(externalValues)
    
    mainValuesTree = th.list_to_tree(mainValuesNestedList)
    externalValuesTree = th.list_to_tree(externalValuesNestedList)
    
    kukaMainAxisValues = ghc.Twico.KukaAxisValues(mainKeysList, mainValuesTree)
    kukaExternalAxisValues = ghc.Twico.KukaAxisValues(externalKeysList, externalValuesTree)
    
    return kukaMainAxisValues, kukaExternalAxisValues


for i, task in enumerate(iTasks):
    name = "J" + str(task["Job"]) + "L" + str(task["Level"]) + "_"+task["Name"] 
    type = task["Type"]
    
    
    main_actor = task["Main_Actor"]
    description = task["Description"]
    message = task["Message"]
    job = task["Job"]
    level = task["Level"]
    index = task["Index"]
    elements_id = task["Elements_Id"]
    actorsDataDict = task["Actors_Data"]
    
    
    if elements_id == None:
        elements_id = []
    
    
    #ActorData
    actorName = actorsDataDict["ActorName"]
    toolName = actorsDataDict["ToolName"]
    toolNumber = actorsDataDict["ToolNumber"]
    actionID = actorsDataDict["ActionID"]
    mainPlanes = actorsDataDict["MainPlanes"]
    secondaryPlanes = actorsDataDict["SecondaryPlanes"]
    mainExternalAxis = actorsDataDict["MainExternalAxis"]
    secondaryExternalAxis = actorsDataDict["SecondaryExternalAxis"]
    states = actorsDataDict["States"]
    speed = actorsDataDict["Speed"]
    offset = actorsDataDict["Offset"]
    
    
    isAxisTask = CheckIfAxisTask(mainExternalAxis)
    
    print level
    #Not Frame Based (Take, Init, ...)
    if mainPlanes == None and mainExternalAxis == None:
        print "BaseTask: ", name
        actorData = ghc.Twico.KukaKRLBase(actorName, toolName, toolNumber, actionID)
    #Frame Based
    elif mainPlanes != None and isAxisTask == False:
        print "FrameTask: ", name
        frameMainExternalAxisConv = ConvertToKukaAxisValuesFrameTask(mainExternalAxis)
        frameSecondaryExternalAxisConv = ConvertToKukaAxisValuesFrameTask(secondaryExternalAxis)
        
         
        
        if secondaryPlanes != None:
            actorData = ghc.Twico.KukaKRLFrame(actorName, toolName, toolNumber, actionID, 
            mainplanes = mainPlanes,
            secondaryplanes = secondaryPlanes,
            mainexternalaxis = frameMainExternalAxisConv,
            secondaryexternalaxis = frameSecondaryExternalAxisConv,
            states = states,
            speed = speed,
            offset = offset)
        else:
            actorData = ghc.Twico.KukaKRLFrame(actorName, toolName, toolNumber, actionID, 
            mainplanes = mainPlanes,
            mainexternalaxis = frameMainExternalAxisConv,
            states = states,
            speed = speed,
            offset = offset)
    #Axis Based
    elif isAxisTask == True:
        print "AxisTask: ", name
        mainAxisConv, axisMainExternalAxisConv = ConvertToKukaAxisValuesAxisTask(mainExternalAxis)
        actorData = ghc.Twico.KukaKRLAxis(actorName, toolName, toolNumber, actionID,
        mainaxisvalues = mainAxisConv,
        #secondaryaxisValues = ???,
        mainexternalaxis = axisMainExternalAxisConv,
        #secondaryexternalaxis = axisSecondaryExternalAxisConv,
        states = states,
        speed = speed,
        offset = offset)
    else:
        print "THIS TASK CAN NOT BE SEND!"
        raise NameError(str(name) + ": can not be converted to DesFabTask!!")
    
    
    desFabTask = ghc.Twico.TaskBase(
    name, 
    type,
    main_actor,
    description,
    message,
    job,
    level,
    index,
    elements_id = elements_id,
    actors_data = actorData,
    )
    
    desFabTasks.append(desFabTask)

iDesFabTasks = desFabTasks
# ---------- end python ----------
python_2 = GhPythonScript()  # -> out, a
# ---------- python_2: Python ----------
__author__ = "liors"
__version__ = "2024.06.10"

import rhinoscriptsyntax as rs
import ghpythonlib.components as ghc
import ghpythonlib.treehelpers as th
import Rhino.Geometry as rg

iActor_name = "SomeKukaRobot"

ACTION_IDS = {"Take_Tool":12,"Travel_AXIS":16,"Travel_LIN":17,"Travel_PTP":18,"E5_Pick":53,"E5_Place":54}
TOOLS = {"VacuumGripper":5}
JOB=1
Element_ID = "E00_B01"

######## How to generate general tasks ########
#Take_Tool task example
take_tool_ = ghc.Twico.KukaKRLBase(iActor_name,"VacuumGripper_SLAB",TOOLS["VacuumGripper"],ACTION_IDS["Take_Tool"])
take_tool_task = ghc.Twico.TaskBase("Take_Tool-VacuumGripper_SLAB","Take_Tool",iActor_name,"take tool","Taking VacuumGripper_SLAB from tool magazine",JOB,2,0,actors_data=take_tool_)



######## Travel Task Examples ########
#Travel_Axis task example
axis_values = ghc.Twico.KukaAxisValues(["A1","A2","A3","A4","A5","A6"],
                                        th.list_to_tree([[0,0],[0,0],[0,0],[0,0],[0,0],[0,0]]))

external_axis_values = ghc.Twico.KukaAxisValues(["E1"],
                                                 th.list_to_tree([0,0]))

travel_axis_ = ghc.Twico.KukaKRLAxis(iActor_name,"VacuumGripper",TOOLS["VacuumGripper"],ACTION_IDS["Travel_AXIS"],
                                      mainaxisvalues=axis_values,mainexternalaxis=external_axis_values)

travel_axis_task = ghc.Twico.TaskBase("Travel_Axis-VacuumGripper_SLAB","Travel",iActor_name,"travelling to x","Travelling by axis with VacuumGripper_SLAB",JOB,6,0,actors_data=travel_axis_)

#Travel_LIN task example
planes = [rg.Plane.WorldXY,rg.Plane.WorldYZ]
external_axis_values = ghc.Twico.KukaAxisValues(["E1"],
                                                 th.list_to_tree([0,0]))

travel_lin_ = ghc.Twico.KukaKRLFrame(iActor_name,"VacuumGripper",TOOLS["VacuumGripper"],ACTION_IDS["Travel_LIN"],
                                      mainplanes=planes,mainexternalaxis=external_axis_values)

travel_lin_task = ghc.Twico.TaskBase("Travel_LIN-VacuumGripper_SLAB","Travel",iActor_name,"travelling to x","Travelling by lin movement with VacuumGripper_SLAB",JOB,7,0,actors_data=travel_lin_)

#Travel_PTP task example
planes = [rg.Plane.WorldXY,rg.Plane.WorldYZ]
external_axis_values = ghc.Twico.KukaAxisValues(["E1"],
                                                 th.list_to_tree([0,0]))

travel_ptp_ = ghc.Twico.KukaKRLFrame(iActor_name,"VacuumGripper",TOOLS["VacuumGripper"],ACTION_IDS["Travel_PTP"],
                                      mainplanes=planes,mainexternalaxis=external_axis_values)

travel_ptp_task = ghc.Twico.TaskBase("Travel_PTP-VacuumGripper_SLAB","Travel",iActor_name,"travelling to x","Travelling by ptp movement with VacuumGripper_SLAB",JOB,8,0,actors_data=travel_ptp_)


######## Pick Place Task Eaxmple ########
#Pick task example
planes = [rg.Plane.WorldXY]
external_axis_values = ghc.Twico.KukaAxisValues(["E1","E2"],
                                                 th.list_to_tree([[0],[0]]))

pick_ = ghc.Twico.KukaKRLFrame(iActor_name,"VacuumGripper",TOOLS["VacuumGripper"],ACTION_IDS["E5_Pick"],
                                      mainplanes=planes,mainexternalaxis=external_axis_values,offset=[0,0,0])

pick_task = ghc.Twico.TaskBase("Pick_01","Pick",iActor_name,"Picking element","Picking element {} ".format(Element_ID[0]),
                                JOB,2,0,elements_id=Element_ID,actors_data=pick_)

#Place task example
planes = [rg.Plane.WorldXY]
external_axis_values = ghc.Twico.KukaAxisValues(["E1","E2"],
                                                 th.list_to_tree([[0],[0]]))
print external_axis_values
place_ = ghc.Twico.KukaKRLFrame(iActor_name,"VacuumGripper",TOOLS["VacuumGripper"],ACTION_IDS["E5_Place"],
                                      mainplanes=planes,mainexternalaxis=external_axis_values,offset=[0,0,0])

place_task = ghc.Twico.TaskBase("Place_01","Place",iActor_name,"Placing element","Placing element {} ".format(Element_ID[0]),
                                JOB,3,0,elements_id=Element_ID,actors_data=place_)
# ---------- end python_2 ----------
eo_2 = DeconstructObject(Object=python.iDesFabTasks)  # -> Task_id, Name, Type, Main_actor, Description, Message, Job, Level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

end_2 = EndPoints(Curve=line)  # -> Start, End
xy_5 = XYPlane(Origin=end_2.Start)
Y = UnitY(Factor=simfabtask.E1Value)
move = Move(Geometry=xy_5, Motion=Y)  # -> Geometry, Transform

# ----
# VirtualRobot Setup
python_3 = GhPythonScript(iFabTools=merge_5)  # -> oVR_Tools; inputs iFabTools: list
# ---------- python_3: Python ----------
import Rhino.Geometry as rg
import ghpythonlib.components as ghc


tool_dict = {}
tool_List = []
toolsData = []
toolsNum = []
for i in range(len(iFabTools)):
    toolName = iFabTools[i].Name
    toolNum = iFabTools[i].ToolNum
    toolGeo = iFabTools[i].Geometry
    toolTcpPln= iFabTools[i].TcpPln
    toolMountPln = iFabTools[i].MountPln
    endeffector = ghc.VirtualRobot.DefineEndEffector(toolGeo, toolTcpPln, toolMountPln)
    tool_dict[toolNum] = endeffector

tool_List.append(tool_dict) # only 'way' to output dictionary

# Output the dictionary
oVR_Tools = tool_List
# ---------- end python_3 ----------
python_4 = GhPythonScript(iToolNum=simfabtask.ToolNumber, iVR_Tools=python_3)  # -> oVR_Tool; inputs iToolNum: Int32
# ---------- python_4: Python ----------
oVR_Tool = iVR_Tools.get(iToolNum)
# ---------- end python_4 ----------
kuka_kr_120 = PredefinedKUKAKR120Robot(RobRootFrame=move.Geometry, EndEffectorOptional=python_4, variant="R2700")
data_2 = Data(kuka_kr_120)
robot_ik = RobotInverseKinematics(Robot=data_2, TargetTCPFrame=pln_10, AxisToggles=[False, False, False], useColorPreview=True)  # -> PoseGeometry, AxisValues, AxisFrames
item_3 = ListItem(List=robot_ik.AxisFrames, Index=0, Wrap=True)
item_4 = ListItem(List=robot_ik.AxisFrames, Index=5, Wrap=True)
swatch = ColourSwatch(SwatchColor=RGB(255, 0, 255))
roundd = RoundToDecimalPlace(NumberX=simfabtask.E2Value, DecimalPlace=2, RoundType=0)  # -> Rounded, Difference
roundd_2 = RoundToDecimalPlace(NumberX=simfabtask.E1Value, DecimalPlace=2, RoundType=0)  # -> Rounded, Difference
preview = CustomPreview(Geometry=geo, Material=ColourSwatch(SwatchColor=RGB(255, 255, 255)))
tag = TextTag(Text=roundd.Rounded, Colour=swatch)
tag_2 = TextTag(Location=item_4, Text=simfabtask.Name, Colour=ColourSwatch(SwatchColor=RGB(255, 255, 0)))
tag_3 = TextTag(Location=item_3, Text=roundd_2.Rounded, Colour=swatch)

# ---- group: GhostSolver Check all Frames from Task
simfabtaskall = SimulateFabTaskVirtualRobot()  # -> TaskIndex, TaskSubIndex, Name, ToolNumber, Geometry, TCP, E1Value, E2Value, E3Value; disabled
python_5 = GhPythonScript(
    iIndex=simfabtaskall.TaskIndex,
    iSubIndex=simfabtaskall.TaskSubIndex,
    iTaskName=simfabtaskall.Name,
    iToolNum=simfabtaskall.ToolNumber,
    iGeometry=simfabtaskall.Geometry,
    iTCP=simfabtaskall.TCP,
    iE1=simfabtaskall.E1Value,
    iE2=simfabtaskall.E2Value,
    iRobotPlatform=data_2,
    iVR_Tools=python_3)  # -> out, failedIndex, failedSubIndex, failedTaskName, failedTCP; inputs iIndex: tree of Int32, iSubIndex: tree of Int32, iTaskName: tree, iToolNum: tree of Int32, iGeometry: tree of Mesh, iTCP: tree of Plane, iE1: tree, iE2: tree; disabled
# ---------- python_5: Python ----------
import ghpythonlib.components as ghc
import math
import Grasshopper.Kernel as gh
from Grasshopper.Kernel import GH_RuntimeMessageLevel as RML

import clr
clr.AddReference("VirtualRobot.Core.dll")
import ICD.VirtualRobot.Core as VR

failedIndex = []
failedSubIndex = []
failedTaskName = []
failedTCP = []

def CheckAxisLimits(aV):
    for i in range(len(aV)):
        if math.isnan(aV[i]):
            errorMessage = "TCP can't be reached."
            return False, errorMessage
    if aV[0] < (-185) or aV[0] > 185:
        errorMessage = "A1 limit reached: " + str(aV[0])
        return False, errorMessage
    if aV[1] < (-130) or aV[1] > 20:
        errorMessage = "A2 limit reached: " + str(aV[1])
        return False, errorMessage
    if aV[2] < (-100) or aV[2] > 144:
        errorMessage = "A3 limit reached: " + str(aV[2])
        return False, errorMessage
    if aV[3] < (-350) or aV[3] > 350:
        errorMessage = "A4 limit reached: " + str(aV[3])
        return False, errorMessage
    if aV[4] < (-120) or aV[4] > 120:
        errorMessage = "A5 limit reached: " + str(aV[4])
        return False, errorMessage
    if aV[5] < (-350) or aV[5] > 350:
        errorMessage = "A6 limit reached: " + str(aV[5])
        return False, errorMessage
    return True, "No Axis limit reached."


for i in range(iTCP.BranchCount):
    tcpBranch = iTCP.Branch(i)
    for j in range(len(tcpBranch)):
        index = iIndex.Branch(i)[j]
        subIndex = iSubIndex.Branch(i)[j]
        taskName = iTaskName.Branch(i)[j]
        taskNameID = "I:" + str(index) + " SI:" + str(subIndex) + " - " + str(taskName)
        
        iRobotPlatform.Robot.EndEffector = iVR_Tools.get(iToolNum.Branch(i)[j])
        robot = iRobotPlatform
        tcp = iTCP.Branch(i)[j]
        axisToggles = [False, False, False]
        linAxisValue = -iE1.Branch(i)[j]
        #if j == 1:
        a = robot
        b = tcp
        c = linAxisValue
        poseGeo, colGeo, axisValues, axisFrames = ghc.VirtualRobot.RoboticPlatformInverseKinematics(robot, tcp, axisToggles, linAxisValue)
        noAxisLimit, errorMessage_Axis =  CheckAxisLimits(axisValues)
        if noAxisLimit == False:
            warning_message = str(taskNameID) + " | " + str(errorMessage_Axis)
            ghenv.Component.AddRuntimeMessage(RML.Warning, warning_message)
            print warning_message
            failedIndex.append(index)
            failedSubIndex.append(subIndex)
            failedTaskName.append(taskName)
            failedTCP.append(tcp)
# ---------- end python_5 ----------
pln_11 = Plane(python_5.failedTCP)
panel_10 = Panel(python_5.out)
eo_3 = DeconstructObject()

# ----
path = FilePath("C:\Users\opgenorth\OneDrive - bwstaff\ICD_Projects\DigitalFutures\02_Development\02_Twico\output_folder\")
save = SaveToJson(Tasks=python.iDesFabTasks, DIR=path, FileName="MyFirstMesh", Save=Button())

eo_4 = DeconstructObject(Object=eo_2.Actors)  # -> Name, ActionID, ToolName, ToolNum, MovementBaseType, MainActionValues, SecondaryActionValues, MainExtarnalValues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
eo_5 = DeconstructObject(Object=eo_4.MainExtarnalValues)  # -> Key, Value
panel_11 = Panel(eo_2.Element_id)
geo_2 = Geometry(decfe_2.GeometryFabOut)
preview_2 = CustomPreview(Geometry=geo_2, Material=ColourSwatch(SwatchColor=RGBA(161, 161, 161, 25)))
