# Grasshopper definition 240619_DigitalFUTURES_TestFile.gh (Grasshopper 1.0.7)
# plug-ins: Fab.Grasshopper, Pufferfish, VirtualRobot.Grasshopper, DesFab.GH

reset = ResetFabCollection(Reset=Button())
allids = AllCollectionIDs(Refresh=Button(), FabCollection=reset)  # -> DesignElementNames, DesignPlateNames, DesignBeamNames, DesignComponentNames, FabElementNames, FabPlateNames, FabBeamNames, FabComponentNames, FabTaskNames, FabTaskSequenceSchema
panel = Panel(allids.FabTaskNames)

pt = Point(Point(1047.761971, -1175.625008, 217.5261259))
xy = XYPlane(Origin=pt)
prot = RotatePlane(Plane=xy, Angle=degrees("-90"))
series = Series(Start=0, Step=Slider(50, range=0..100), Count="11")
Y = UnitY(Factor=series)
move = Move(Geometry=prot, Motion=Y)  # -> Geometry, Transform
brep = Brep([<brep referenced from the Rhino model> x10])
staticenv = DefineStaticEnv(
    Index=0,
    Name="PaperTable",
    ReferencePlane=move.Geometry,
    AlignPlane=move.Geometry,
    Width=0,
    Length=0,
    Height=0,
    Geometry=brep)

# ---- group: SETUP ACTOR / BeamGripper Actions
panel_2 = Panel("PickBeam")
panel_3 = Panel("PlaceBeam")
panel_4 = Panel("Place")
panel_5 = Panel("DipBeam")
panel_6 = Panel("Dip")
action = DefineAction(ActionID="10", Name=panel_2, Type="Pick")
action_2 = DefineAction(ActionID="11", Name=panel_3, Type=panel_4)
action_3 = DefineAction(ActionID="12", Name=panel_5, Type=panel_6)
merge = Merge(Data1=action, Data2=action_2, Data3=action_3)

# ---- group: SETUP ACTOR / PaperGripper Actions
panel_7 = Panel("PickPaper")
panel_8 = Panel("PlacePaper")
action_4 = DefineAction(ActionID="20", Name=panel_7, Type=panel_4)
action_5 = DefineAction(ActionID="21", Name=panel_8, Type=panel_8)
action_6 = DefineAction(ActionID="22", Name="DipPaper", Type=panel_6)
merge_2 = Merge(Data1=action_4, Data2=action_5, Data3=action_6)

# ---- group: SETUP ACTOR / Robot Actions
action_7 = DefineAction(ActionID="2", Name="TravelLIN", Type="Travel")
action_8 = DefineAction(ActionID="1", Name="TravelPTP", Type="Travel")
merge_3 = Merge(Data1=action_8, Data2=action_7)

# ----
pt_2 = Point(Point(1300.261971, -980.125008, 285.0261259))
xy_2 = XYPlane(Origin=pt_2)
prot_2 = RotatePlane(Plane=xy_2, Angle=degrees("-90"))
brep_2 = Brep([<brep referenced from the Rhino model> x8])
staticenv_2 = DefineStaticEnv(Index=0, Name="WaterStation", ReferencePlane=prot_2, AlignPlane=prot_2, Width=0, Length=0, Height=0, Geometry=brep_2)

pt_3 = Point([Point(805.2619707, -1602.125008, 203.0261259), Point(805.2619707, -1802.125008, 203.0261259), Point(805.2619707, -2002.125008, 203.0261259), Point(805.2619707, -2202.125008, 203.0261259), Point(805.2619707, -2402.125008, 203.0261259)])
xy_3 = XYPlane(Origin=pt_3)
prot_3 = RotatePlane(Plane=xy_3, Angle=degrees("180"))
brep_3 = Brep([<brep referenced from the Rhino model> x10])
staticenv_3 = DefineStaticEnv(Index=0, Name="BeamTable", ReferencePlane=prot_3, AlignPlane=prot_3, Width=0, Length=0, Height=0, Geometry=brep_3)

pt_4 = Point(Point(2025.261971, 817.874992, 203.0261259))
xy_4 = XYPlane(Origin=pt_4)
prot_4 = RotatePlane(Plane=xy_4, Angle=degrees("-90"))
brep_4 = Brep(<brep referenced from the Rhino model>)
staticenv_4 = DefineStaticEnv(Index="1", Name="WorkTable", ReferencePlane=prot_4, AlignPlane=prot_4, Width=0, Length=0, Height=0, Geometry=brep_4)

# ---- group: SETUP ACTOR
brep_5 = Brep([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])
plane = Plane(Plane(origin=(0, -5.918536772e-10, 0), x=(0, 1, 0), y=(1, 0, 0)))

pln = Plane(Plane(origin=(3.552713679e-10, 81.31727984, -94.74873734), x=(1, 0, 0), y=(0, 0.7071067812, 0.7071067812)))
prot_5 = RotatePlane(Plane=pln, Angle=degrees("180"))
endeffector = DefineEndeffector(ToolNum="1", ToolName="BeamGripper", Geometry=brep_5, TCPFrame=prot_5, MountingFrame=plane, Actions=merge, ZOffset=0)

pln_2 = Plane(Plane(origin=(0, -93.63961031, -103.6396103), x=(1, 0, 0), y=(0, 0.7071067812, -0.7071067812)))
prot_6 = RotatePlane(Plane=pln_2, Angle=degrees("0"))
endeffector_2 = DefineEndeffector(ToolNum="2", ToolName="PaperGripper", Geometry=brep_5, TCPFrame=prot_6, MountingFrame=plane, Actions=merge_2, ZOffset=0)

merge_4 = Merge(Data1=endeffector, Data2=endeffector_2)  # -> flatten(Result)

xy_5 = XYPlane(Origin=Point(0, 0, 0))
line = Line(Line((0, -1000, 0), (0, 5000, 0)))
actor = DefineActor(Name="Robot", RefPln=xy_5, Tools=merge_4, Actions=merge_3, LinearAxis=line, MaxWeight=-1)

# ----
chair_support = Brep([<brep referenced from the Rhino model> x33])
chair_build = Brep([<brep referenced from the Rhino model> x83])
panel_9 = Panel("BuildBeams")
db = DesignBeam(Name="SupportBeams", Geometry=chair_support, Index=-1)
db_2 = DesignBeam(Name="BuildBeams", Geometry=chair_build, Index=-1)
merge_5 = Merge(Data1=db_2, Data2=db)
dc = DesignComponent(Name="GeneratedChair", DesignBeams=merge_5, Index=-1)
fabcomponent = DefineFabComponent(DesignComponent=dc, StaticEnvFab=staticenv_4, StaticEnvBeam=staticenv_3)
merge_6 = Merge(Data1="BuildBeams", Data2="SupportBeams")
# add
# magazine
# position component
# Missing:#
# 1. Somehow a logic to fix to ground
# 2. Magazine beams --> this can be prepared to different slots
# 3. Check if the orientation is correct for the dowels
# 4. Logic for which beam to select from magazine
# 
# 
# Other:
# Write KRL subprograms
# create powerpoint introduction
# copy+paste FIT
# send out presentation holzkongress
sortz = SortByZHeight(FabComponent=fabcomponent)
decfe = DeconstructFabElement(FabElements=fabcomponent, PreviewScale=1)  # -> Name, Index, RefPln_Situ, RefPln_SituBox, RefPln_Mag, RefPln_Fab, RefPln_FabOut, GeometryBoxSitu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
decfe_2 = DeconstructFabElement(FabElements=decfe.FabBeams, PreviewScale=1)  # -> Name, Index, RefPln_Situ, RefPln_SituBox, RefPln_Mag, RefPln_Fab, RefPln_FabOut, GeometryBoxSitu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
panel_10 = Panel(merge_6)
pnp = PickPlace(
    FabComponent=sortz,
    FabElementName=panel_10,
    Actor=actor,
    Endeffector=endeffector,
    PickAction=action,
    PlaceAction=action_2,
    OffsetPick=[0, 0, 200],
    OffsetPlace=[0, 0, 200],
    Rotation=Slider(0, range=-180..180))  # -> FabComponent, PickPlaceTask
panel_11 = Panel("BuildBeams")
pnp_paper = PickPlaceForPaperJoint(
    FabComponent=pnp.FabComponent,
    FabElementName=panel_11,
    Actor=actor,
    Endeffector=endeffector_2,
    PickAction=action_4,
    PlaceAction=action_5,
    OffsetPick=[0, 0, 200],
    OffsetPlace=[0, 0, 200],
    Rotation=0,
    StaticEnvPaper=staticenv,
    MultiMag=False)  # -> FabComponent, PickPlaceTask
panel_12 = Panel("BuildBeams")
dipinwater = DipInWater(
    FabComponent=pnp_paper.FabComponent,
    FabElementName=panel_12,
    Actor=actor,
    Endeffector=endeffector,
    DipAction=action_3,
    DependentAction=action,
    StaticEnv=staticenv_2,
    ZDipDepth=Slider(20, range=0..100),
    OffsetDip=[0, 0, 200],
    Rotation=0,
    DipDuration=10)  # -> FabComponent, DipFabTask

# ---- group: Recording Tool for Animations
data = Data(Tree({0;0;0;0}: ["1", "2", "3", "4", "5", "6", "7", "8", "9", "10"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], {0;0;0;1}: ["0", "0", "0", "0", "0", "0", "0", "0", "0", "0"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]))  # disabled
number_slider = Slider(150, range=0..150)  # disabled
panel_13 = Panel("151")  # disabled
split = SplitList(List=data, Index=panel_13)  # -> ListA, ListB; disabled
item = ListItem(List=split.ListA, Index=number_slider, Wrap=True)  # -> simplify(Item); disabled
bang = ExplodeTree(Data=item)  # -> Branch0, Branch1; disabled

# ---- group: Recording Tool for Animations / Plug into I/SI for recording
graft = GraftTree(IncludeEmptyLists=True, IncludeNullItems=True)  # disabled
rec = DataRecorder(graft, DataLimit=-10, RecordData=False)  # disabled

# ----
panel_14 = Panel("BuildBeams")
merge_7 = Merge()  # -> flatten(Result)
eo = DeconstructObject(Object=merge_7)  # -> Main_Frames, Sub_Frames, Main_ExtValues, Sub_ExtValues, State, Offset, Speed, Name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
dipinwater_2 = DipInWater(
    FabComponent=dipinwater.FabComponent,
    FabElementName=panel_14,
    Actor=actor,
    Endeffector=endeffector_2,
    DipAction=action_6,
    DependentAction=action_4,
    StaticEnv=staticenv_2,
    ZDipDepth=Slider(50, range=0..100),
    OffsetDip=[0, 0, 200],
    Rotation=0,
    DipDuration=10)  # -> FabComponent, DipFabTask
desfabtasks = ConvertoToDesFabTasks(FabTasks=merge_7, JobIndex="0")  # -> DesFabTasks, DesFabActorData
python = GhPythonScript(iTasks=desfabtasks.DesFabTasks)  # -> out, iDesFabTasks; inputs iTasks: list
# ---------- python: Python ----------
import ghpythonlib.components as ghc
import ghpythonlib.treehelpers as th
import Rhino.Geometry as rg

desFabTasks = []

def CheckIfAxisTask(mainExternalAxis):
    isAxisTask = False
    if mainExternalAxis != None:
            for external in mainExternalAxis:
                externalKey = external.Key
                if (externalKey == "A1" or externalKey == "A2" or externalKey == "A3" or externalKey == "A4" or externalKey == "A5" or externalKey == "A6"):
                    isAxisTask = True
    return isAxisTask


def ConvertToKukaAxisValuesFrameTask(externalAxisValues): #error is here
    kukaAxisValues = {}
    externalKeysList = []
    
    if externalAxisValues != None:
        externalValues = []
        for external in externalAxisValues:
            externalKey = external.Key
            externalKeysList.append(externalKey)
            for value in external.Value:
                externalValues.append(value)
    
    externalValuesTree = th.list_to_tree(externalValues)
    
    kukaAxisValues = ghc.Twico.KukaAxisValues(externalKeysList,externalValuesTree)
    
    return kukaAxisValues


def ConvertToKukaAxisValuesAxisTask(externalAxisValues):
    kukaMainAxisValues = {}
    kukaExternalAxisValues = {}
    
    mainKeysList = []
    mainValuesNestedList = []
    
    externalKeysList = []
    externalValuesNestedList = []
    
    if externalAxisValues != None:
        for external in externalAxisValues:
            externalKey = external.Key
            
            mainValues = []
            externalValues = []
            for value in external.Value:
                if (externalKey == "A1" or externalKey == "A2" or externalKey == "A3" or externalKey == "A4" or externalKey == "A5" or externalKey == "A6"):
                    mainKeysList.append(externalKey)
                    mainValues.append(value)
                else:
                    externalKeysList.append(externalKey)
                    externalValues.append(value)
            
            mainValuesNestedList.append(mainValues)
            externalValuesNestedList.append(externalValues)
    
    mainValuesTree = th.list_to_tree(mainValuesNestedList)
    externalValuesTree = th.list_to_tree(externalValuesNestedList)
    
    kukaMainAxisValues = ghc.Twico.KukaAxisValues(mainKeysList, mainValuesTree)
    kukaExternalAxisValues = ghc.Twico.KukaAxisValues(externalKeysList, externalValuesTree)
    
    return kukaMainAxisValues, kukaExternalAxisValues


for i, task in enumerate(iTasks):
    name = "J" + str(task["Job"]) + "L" + str(task["Level"]) + "_"+task["Name"] 
    type = task["Type"]
    
    
    main_actor = task["Main_Actor"]
    description = task["Description"]
    message = task["Message"]
    job = task["Job"]
    level = task["Level"]
    index = task["Index"]
    elements_id = task["Elements_Id"] #usually this is the correct one to use
    elements_id = task["Elements_Name"] #this one is only used for the sake of the workshop as elements_id
    actorsDataDict = task["Actors_Data"]
    
    
    if elements_id == None:
        elements_id = []
    
    
    #ActorData
    actorName = actorsDataDict["ActorName"]
    toolName = actorsDataDict["ToolName"]
    toolNumber = actorsDataDict["ToolNumber"]
    actionID = actorsDataDict["ActionID"]
    mainPlanes = actorsDataDict["MainPlanes"]
    secondaryPlanes = actorsDataDict["SecondaryPlanes"]
    mainExternalAxis = actorsDataDict["MainExternalAxis"]
    secondaryExternalAxis = actorsDataDict["SecondaryExternalAxis"]
    states = actorsDataDict["States"]
    speed = actorsDataDict["Speed"]
    offset = actorsDataDict["Offset"]
    
    
    isAxisTask = CheckIfAxisTask(mainExternalAxis)
    
    print level
    #Not Frame Based (Take, Init, ...)
    if mainPlanes == None and mainExternalAxis == None:
        print "BaseTask: ", name
        actorData = ghc.Twico.KukaKRLBase(actorName, toolName, toolNumber, actionID)
    #Frame Based
    elif mainPlanes != None and isAxisTask == False:
        print "FrameTask: ", name
        frameMainExternalAxisConv = ConvertToKukaAxisValuesFrameTask(mainExternalAxis)
        frameSecondaryExternalAxisConv = ConvertToKukaAxisValuesFrameTask(secondaryExternalAxis)
        
         
        
        if secondaryPlanes != None:
            actorData = ghc.Twico.KukaKRLFrame(actorName, toolName, toolNumber, actionID, 
            mainplanes = mainPlanes,
            secondaryplanes = secondaryPlanes,
            mainexternalaxis = frameMainExternalAxisConv,
            secondaryexternalaxis = frameSecondaryExternalAxisConv,
            states = states,
            speed = speed,
            offset = offset)
        else:
            actorData = ghc.Twico.KukaKRLFrame(actorName, toolName, toolNumber, actionID, 
            mainplanes = mainPlanes,
            mainexternalaxis = frameMainExternalAxisConv,
            states = states,
            speed = speed,
            offset = offset)
    #Axis Based
    elif isAxisTask == True:
        print "AxisTask: ", name
        mainAxisConv, axisMainExternalAxisConv = ConvertToKukaAxisValuesAxisTask(mainExternalAxis)
        actorData = ghc.Twico.KukaKRLAxis(actorName, toolName, toolNumber, actionID,
        mainaxisvalues = mainAxisConv,
        #secondaryaxisValues = ???,
        mainexternalaxis = axisMainExternalAxisConv,
        #secondaryexternalaxis = axisSecondaryExternalAxisConv,
        states = states,
        speed = speed,
        offset = offset)
    else:
        print "THIS TASK CAN NOT BE SEND!"
        raise NameError(str(name) + ": can not be converted to DesFabTask!!")
    
    
    desFabTask = ghc.Twico.TaskBase(
    name, 
    type,
    main_actor,
    description,
    message,
    job,
    level,
    index,
    elements_id = elements_id,
    actors_data = actorData,
    )
    
    desFabTasks.append(desFabTask)

iDesFabTasks = desFabTasks
# ---------- end python ----------
python_2 = GhPythonScript()  # -> out, a
# ---------- python_2: Python ----------
__author__ = "liors"
__version__ = "2024.06.10"

import rhinoscriptsyntax as rs
import ghpythonlib.components as ghc
import ghpythonlib.treehelpers as th
import Rhino.Geometry as rg

iActor_name = "SomeKukaRobot"

ACTION_IDS = {"Take_Tool":12,"Travel_AXIS":16,"Travel_LIN":17,"Travel_PTP":18,"E5_Pick":53,"E5_Place":54}
TOOLS = {"VacuumGripper":5}
JOB=1
Element_ID = "E00_B01"

######## How to generate general tasks ########
#Take_Tool task example
take_tool_ = ghc.Twico.KukaKRLBase(iActor_name,"VacuumGripper_SLAB",TOOLS["VacuumGripper"],ACTION_IDS["Take_Tool"])
take_tool_task = ghc.Twico.TaskBase("Take_Tool-VacuumGripper_SLAB","Take_Tool",iActor_name,"take tool","Taking VacuumGripper_SLAB from tool magazine",JOB,2,0,actors_data=take_tool_)



######## Travel Task Examples ########
#Travel_Axis task example
axis_values = ghc.Twico.KukaAxisValues(["A1","A2","A3","A4","A5","A6"],
                                        th.list_to_tree([[0,0],[0,0],[0,0],[0,0],[0,0],[0,0]]))

external_axis_values = ghc.Twico.KukaAxisValues(["E1"],
                                                 th.list_to_tree([0,0]))

travel_axis_ = ghc.Twico.KukaKRLAxis(iActor_name,"VacuumGripper",TOOLS["VacuumGripper"],ACTION_IDS["Travel_AXIS"],
                                      mainaxisvalues=axis_values,mainexternalaxis=external_axis_values)

travel_axis_task = ghc.Twico.TaskBase("Travel_Axis-VacuumGripper_SLAB","Travel",iActor_name,"travelling to x","Travelling by axis with VacuumGripper_SLAB",JOB,6,0,actors_data=travel_axis_)

#Travel_LIN task example
planes = [rg.Plane.WorldXY,rg.Plane.WorldYZ]
external_axis_values = ghc.Twico.KukaAxisValues(["E1"],
                                                 th.list_to_tree([0,0]))

travel_lin_ = ghc.Twico.KukaKRLFrame(iActor_name,"VacuumGripper",TOOLS["VacuumGripper"],ACTION_IDS["Travel_LIN"],
                                      mainplanes=planes,mainexternalaxis=external_axis_values)

travel_lin_task = ghc.Twico.TaskBase("Travel_LIN-VacuumGripper_SLAB","Travel",iActor_name,"travelling to x","Travelling by lin movement with VacuumGripper_SLAB",JOB,7,0,actors_data=travel_lin_)

#Travel_PTP task example
planes = [rg.Plane.WorldXY,rg.Plane.WorldYZ]
external_axis_values = ghc.Twico.KukaAxisValues(["E1"],
                                                 th.list_to_tree([0,0]))

travel_ptp_ = ghc.Twico.KukaKRLFrame(iActor_name,"VacuumGripper",TOOLS["VacuumGripper"],ACTION_IDS["Travel_PTP"],
                                      mainplanes=planes,mainexternalaxis=external_axis_values)

travel_ptp_task = ghc.Twico.TaskBase("Travel_PTP-VacuumGripper_SLAB","Travel",iActor_name,"travelling to x","Travelling by ptp movement with VacuumGripper_SLAB",JOB,8,0,actors_data=travel_ptp_)


######## Pick Place Task Eaxmple ########
#Pick task example
planes = [rg.Plane.WorldXY]
external_axis_values = ghc.Twico.KukaAxisValues(["E1","E2"],
                                                 th.list_to_tree([[0],[0]]))

pick_ = ghc.Twico.KukaKRLFrame(iActor_name,"VacuumGripper",TOOLS["VacuumGripper"],ACTION_IDS["E5_Pick"],
                                      mainplanes=planes,mainexternalaxis=external_axis_values,offset=[0,0,0])

pick_task = ghc.Twico.TaskBase("Pick_01","Pick",iActor_name,"Picking element","Picking element {} ".format(Element_ID[0]),
                                JOB,2,0,elements_id=Element_ID,actors_data=pick_)

#Place task example
planes = [rg.Plane.WorldXY]
external_axis_values = ghc.Twico.KukaAxisValues(["E1","E2"],
                                                 th.list_to_tree([[0],[0]]))
print external_axis_values
place_ = ghc.Twico.KukaKRLFrame(iActor_name,"VacuumGripper",TOOLS["VacuumGripper"],ACTION_IDS["E5_Place"],
                                      mainplanes=planes,mainexternalaxis=external_axis_values,offset=[0,0,0])

place_task = ghc.Twico.TaskBase("Place_01","Place",iActor_name,"Placing element","Placing element {} ".format(Element_ID[0]),
                                JOB,3,0,elements_id=Element_ID,actors_data=place_)
# ---------- end python_2 ----------
panel_15 = Panel(eo.FabElementsName)

merge_8 = Merge(Data1=panel_7, Data2=panel_5, Data3=panel_8)
merge_9 = Merge(Data1=panel_2, Data2=panel_5, Data3=panel_3)
merge_10 = Merge(Data1=panel_2, Data2=panel_3)
txt = Text("BuildBeams")
txt_2 = Text("BuildBeams")
txt_3 = Text("SupportBeams")
panel_16 = Panel(merge_9)
panel_17 = Panel(txt)
panel_18 = Panel(txt_3)
panel_19 = Panel(merge_10)
panel_20 = Panel(txt_2)
panel_21 = Panel(merge_8)
dict = CreateDictionary(Key=panel_20, Values=panel_21)
dict_2 = CreateDictionary(Key=panel_17, Values=panel_16)
dict_3 = CreateDictionary(Key=panel_18, Values=panel_19)
merge_11 = Merge(Data1=dict, Data2=dict_2, Data3=dict_3)

eo_2 = DeconstructObject(Object=python.iDesFabTasks)  # -> Task_id, Name, Type, Main_actor, Description, Message, Job, Level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
path = FilePath("C:\Users\opgenorth\OneDrive - bwstaff\ICD_Projects\DigitalFutures\02_Development\02_Twico\output_folder\")
save = SaveToJson(Tasks=python.iDesFabTasks, DIR=path, FileName="MyFirstMesh", Save=Button())
eo_3 = DeconstructObject(Object=eo_2.Actors)  # -> Name, ActionID, ToolName, ToolNum, MovementBaseType, MainActionValues, SecondaryActionValues, MainExtarnalValues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
eo_4 = DeconstructObject(Object=eo_3.MainExtarnalValues)  # -> Key, Value
panel_22 = Panel("""1
0
0""")
panel_23 = Panel(eo_2.Element_id)
seqtask = SequenceFabTasks(FabComponent=dipinwater_2.FabComponent, TaskSchema=merge_11, IterateTasks=panel_22)  # -> FabComponent, SequencedFabTasks

# ----
# Simulate FabTask
number_slider_2 = Slider(0, range=0..24)
trigger = Trigger(Interval=200, TimerInterval=200, Target=simfabtask)  # disabled
pln_3 = Plane(Plane(origin=(-2375, 558.67, 1992.75), x=(0, -1, 0), y=(1, 0, 0)))
# VirtualRobot Simulation
simfabtask = SimulateFabTaskVirtualRobot(
    FabTasks=seqtask.SequencedFabTasks,
    Actor=actor,
    ActorDefaultPlane=pln_3,
    TaskIndex=Slider(90, range=0..1000),
    TaskSubIndex=number_slider_2,
    Reset=Button())  # -> TaskIndex, TaskSubIndex, Name, ToolNumber, Geometry, TCP, E1Value, E2Value, E3Value
geo = Geometry(simfabtask.Geometry)
panel_24 = Panel([simfabtask.E1Value, simfabtask.E2Value, simfabtask.E3Value])
panel_25 = Panel([simfabtask.TaskIndex, simfabtask.TaskSubIndex])
panel_26 = Panel(simfabtask.Name)
panel_27 = Panel(simfabtask.ToolNumber)
pln_4 = Plane(simfabtask.TCP)

end = EndPoints(Curve=line)  # -> Start, End
xy_6 = XYPlane(Origin=end.Start)
Y_2 = UnitY(Factor=simfabtask.E1Value)
move_2 = Move(Geometry=xy_6, Motion=Y_2)  # -> Geometry, Transform

# ----
# VirtualRobot Setup
python_3 = GhPythonScript(iFabTools=merge_4)  # -> oVR_Tools; inputs iFabTools: list
# ---------- python_3: Python ----------
import Rhino.Geometry as rg
import ghpythonlib.components as ghc


tool_dict = {}
tool_List = []
toolsData = []
toolsNum = []
for i in range(len(iFabTools)):
    toolName = iFabTools[i].Name
    toolNum = iFabTools[i].ToolNum
    toolGeo = iFabTools[i].Geometry
    toolTcpPln= iFabTools[i].TcpPln
    toolMountPln = iFabTools[i].MountPln
    endeffector = ghc.VirtualRobot.DefineEndEffector(toolGeo, toolTcpPln, toolMountPln)
    tool_dict[toolNum] = endeffector

tool_List.append(tool_dict) # only 'way' to output dictionary

# Output the dictionary
oVR_Tools = tool_List
# ---------- end python_3 ----------
python_4 = GhPythonScript(iToolNum=simfabtask.ToolNumber, iVR_Tools=python_3)  # -> oVR_Tool; inputs iToolNum: Int32
# ---------- python_4: Python ----------
oVR_Tool = iVR_Tools.get(iToolNum)
# ---------- end python_4 ----------
kuka_kr_120 = PredefinedKUKAKR120Robot(RobRootFrame=move_2.Geometry, EndEffectorOptional=python_4, variant="R2700")
data_2 = Data(kuka_kr_120)
robot_ik = RobotInverseKinematics(Robot=data_2, TargetTCPFrame=pln_4, AxisToggles=[False, False, False], useColorPreview=True)  # -> PoseGeometry, AxisValues, AxisFrames
item_2 = ListItem(List=robot_ik.AxisFrames, Index=0, Wrap=True)
item_3 = ListItem(List=robot_ik.AxisFrames, Index=5, Wrap=True)
swatch = ColourSwatch(SwatchColor=RGB(255, 0, 255))
roundd = RoundToDecimalPlace(NumberX=simfabtask.E2Value, DecimalPlace=2, RoundType=0)  # -> Rounded, Difference
roundd_2 = RoundToDecimalPlace(NumberX=simfabtask.E1Value, DecimalPlace=2, RoundType=0)  # -> Rounded, Difference
preview = CustomPreview(Geometry=geo, Material=ColourSwatch(SwatchColor=RGB(255, 255, 255)))
tag = TextTag(Text=roundd.Rounded, Colour=swatch)
tag_2 = TextTag(Location=item_3, Text=simfabtask.Name, Colour=ColourSwatch(SwatchColor=RGB(255, 255, 0)))
tag_3 = TextTag(Location=item_2, Text=roundd_2.Rounded, Colour=swatch)

# ---- group: GhostSolver Check all Frames from Task
simfabtaskall = SimulateFabTaskVirtualRobot()  # -> TaskIndex, TaskSubIndex, Name, ToolNumber, Geometry, TCP, E1Value, E2Value, E3Value; disabled
python_5 = GhPythonScript(
    iIndex=simfabtaskall.TaskIndex,
    iSubIndex=simfabtaskall.TaskSubIndex,
    iTaskName=simfabtaskall.Name,
    iToolNum=simfabtaskall.ToolNumber,
    iGeometry=simfabtaskall.Geometry,
    iTCP=simfabtaskall.TCP,
    iE1=simfabtaskall.E1Value,
    iE2=simfabtaskall.E2Value,
    iRobotPlatform=data_2,
    iVR_Tools=python_3)  # -> out, failedIndex, failedSubIndex, failedTaskName, failedTCP; inputs iIndex: tree of Int32, iSubIndex: tree of Int32, iTaskName: tree, iToolNum: tree of Int32, iGeometry: tree of Mesh, iTCP: tree of Plane, iE1: tree, iE2: tree; disabled
# ---------- python_5: Python ----------
import ghpythonlib.components as ghc
import math
import Grasshopper.Kernel as gh
from Grasshopper.Kernel import GH_RuntimeMessageLevel as RML

import clr
clr.AddReference("VirtualRobot.Core.dll")
import ICD.VirtualRobot.Core as VR

failedIndex = []
failedSubIndex = []
failedTaskName = []
failedTCP = []

def CheckAxisLimits(aV):
    for i in range(len(aV)):
        if math.isnan(aV[i]):
            errorMessage = "TCP can't be reached."
            return False, errorMessage
    if aV[0] < (-185) or aV[0] > 185:
        errorMessage = "A1 limit reached: " + str(aV[0])
        return False, errorMessage
    if aV[1] < (-130) or aV[1] > 20:
        errorMessage = "A2 limit reached: " + str(aV[1])
        return False, errorMessage
    if aV[2] < (-100) or aV[2] > 144:
        errorMessage = "A3 limit reached: " + str(aV[2])
        return False, errorMessage
    if aV[3] < (-350) or aV[3] > 350:
        errorMessage = "A4 limit reached: " + str(aV[3])
        return False, errorMessage
    if aV[4] < (-120) or aV[4] > 120:
        errorMessage = "A5 limit reached: " + str(aV[4])
        return False, errorMessage
    if aV[5] < (-350) or aV[5] > 350:
        errorMessage = "A6 limit reached: " + str(aV[5])
        return False, errorMessage
    return True, "No Axis limit reached."


for i in range(iTCP.BranchCount):
    tcpBranch = iTCP.Branch(i)
    for j in range(len(tcpBranch)):
        index = iIndex.Branch(i)[j]
        subIndex = iSubIndex.Branch(i)[j]
        taskName = iTaskName.Branch(i)[j]
        taskNameID = "I:" + str(index) + " SI:" + str(subIndex) + " - " + str(taskName)
        
        iRobotPlatform.Robot.EndEffector = iVR_Tools.get(iToolNum.Branch(i)[j])
        robot = iRobotPlatform
        tcp = iTCP.Branch(i)[j]
        axisToggles = [False, False, False]
        linAxisValue = -iE1.Branch(i)[j]
        #if j == 1:
        a = robot
        b = tcp
        c = linAxisValue
        poseGeo, colGeo, axisValues, axisFrames = ghc.VirtualRobot.RoboticPlatformInverseKinematics(robot, tcp, axisToggles, linAxisValue)
        noAxisLimit, errorMessage_Axis =  CheckAxisLimits(axisValues)
        if noAxisLimit == False:
            warning_message = str(taskNameID) + " | " + str(errorMessage_Axis)
            ghenv.Component.AddRuntimeMessage(RML.Warning, warning_message)
            print warning_message
            failedIndex.append(index)
            failedSubIndex.append(subIndex)
            failedTaskName.append(taskName)
            failedTCP.append(tcp)
# ---------- end python_5 ----------
pln_5 = Plane(python_5.failedTCP)
panel_28 = Panel(python_5.out)
eo_5 = DeconstructObject()

# ----
name = GetName(Object=seqtask.SequencedFabTasks)
panel_29 = Panel(name)
python_6 = GhPythonScript(x=pnp_paper.PickPlaceTask)  # -> out, a
# ---------- python_6: Python ----------
a = x.Geometry
# ---------- end python_6 ----------
geo_2 = Geometry(decfe_2.GeometryFabOut)
preview_2 = CustomPreview(Geometry=python_6.a, Material=ColourSwatch(SwatchColor=RGBA(110, 217, 43, 12)))
preview_3 = CustomPreview(Geometry=geo_2, Material=ColourSwatch(SwatchColor=RGBA(161, 161, 161, 39)))
