# Grasshopper definition DigitalFUTURES_FullFabrication.gh (Grasshopper 1.0.7)
# plug-ins: Fab.Grasshopper, Pufferfish, VirtualRobot.Grasshopper, DesFab.GH

# ---- group: FabCollection displays all generated Elements and Tasks
reset = ResetFabCollection(Reset=Button())
allids = AllCollectionIDs(Refresh=Button(), FabCollection=reset)  # -> DesignElementNames, DesignPlateNames, DesignBeamNames, DesignComponentNames, FabElementNames, FabPlateNames, FabBeamNames, FabComponentNames, FabTaskNames, FabTaskSequenceSchema
panel = Panel(allids.DesignElementNames)
panel_2 = Panel(allids.FabTaskNames)

# ---- group: SETUP ACTOR / BeamGripper Actions
panel_3 = Panel("Place")
# Define your FabEnvironment
panel_4 = Panel("10")
panel_5 = Panel("Pick_Beam")
panel_6 = Panel("Place_Beam")
panel_7 = Panel("Dip_Beam")
panel_8 = Panel("Dip")
action = DefineAction(ActionID=panel_4, Name=panel_5, Type="Pick")
action_2 = DefineAction(ActionID="11", Name=panel_6, Type=panel_3)
action_3 = DefineAction(ActionID="12", Name=panel_7, Type=panel_8)
merge = Merge(Data1=action, Data2=action_2, Data3=action_3)

# ---- group: SETUP ACTOR / Robot Actions
action_4 = DefineAction(ActionID="3", Name="Change_Tool", Type="Travel")
action_5 = DefineAction(ActionID="2", Name="travel_LIN", Type="Travel")
action_6 = DefineAction(ActionID="1", Name="travel_PTP", Type="Travel")
merge_2 = Merge(Data1=action_6, Data2=action_5, Data3=action_4)

# ---- group: SETUP ACTOR / PaperGripper Actions
panel_9 = Panel("Pick_Paper")
panel_10 = Panel("Place_Paper")
panel_11 = Panel("Dip_Paper")
action_7 = DefineAction(ActionID="20", Name=panel_9, Type=panel_3)
action_8 = DefineAction(ActionID="21", Name=panel_10, Type=panel_10)
action_9 = DefineAction(ActionID="22", Name=panel_11, Type=panel_8)
merge_3 = Merge(Data1=action_7, Data2=action_8, Data3=action_9)

# ---- group: Beam Magazine
pt = Point(Point(1650.261971, -684.125008, 203.0261259))
xy = XYPlane(Origin=pt)
series = Series(Start=0, Step=Slider(70, range=0..100), Count="5")
prot = RotatePlane(Plane=xy, Angle=degrees("-90"))
X = UnitX(Factor=series)
number_slider = Slider(400, range=0..1000)
brep = Brep([<brep referenced from the Rhino model> x34])
move = Move(Geometry=prot, Motion=X)  # -> Geometry, Transform
cluster = Cluster(L=move.Geometry, O=brep, F=number_slider)
staticenv = DefineStaticEnv(
    Index=0,
    Name="BeamTableA_460mm",
    ReferencePlane=move.Geometry,
    AlignPlane=move.Geometry,
    SafePosition=cluster,
    Width=0,
    Length="460",
    Height=0,
    Geometry=brep)

pt_2 = Point(Point(1650.261971, -284.8942387, 203.0261259))
xy_2 = XYPlane(Origin=pt_2)
series_2 = Series(Start=0, Step=Slider(70, range=0..100), Count="5")
prot_2 = RotatePlane(Plane=xy_2, Angle=degrees("-90"))
X_2 = UnitX(Factor=series_2)
brep_2 = Brep([<brep referenced from the Rhino model> x34])
move_2 = Move(Geometry=prot_2, Motion=X_2)  # -> Geometry, Transform
cluster_2 = Cluster(L=move_2.Geometry, O=brep_2, F=number_slider)
staticenv_2 = DefineStaticEnv(
    Index=0,
    Name="BeamTableA_300mm",
    ReferencePlane=move_2.Geometry,
    AlignPlane=move_2.Geometry,
    SafePosition=cluster_2,
    Width=0,
    Length="300",
    Height=0,
    Geometry=brep_2)

pt_3 = Point(Point(1650.261971, 23.56729973, 203.0261259))
xy_3 = XYPlane(Origin=pt_3)
series_3 = Series(Start=0, Step=Slider(70, range=0..100), Count="5")
prot_3 = RotatePlane(Plane=xy_3, Angle=degrees("-90"))
X_3 = UnitX(Factor=series_3)
brep_3 = Brep([<brep referenced from the Rhino model> x34])
move_3 = Move(Geometry=prot_3, Motion=X_3)  # -> Geometry, Transform
cluster_3 = Cluster(L=move_3.Geometry, O=brep_3, F=number_slider)
staticenv_3 = DefineStaticEnv(
    Index=0,
    Name="BeamTableA_220mm",
    ReferencePlane=move_3.Geometry,
    AlignPlane=move_3.Geometry,
    SafePosition=cluster_3,
    Width=0,
    Length="220",
    Height=0,
    Geometry=brep_3)

pt_4 = Point(Point(1652.11998, 237.399766, 203.0261259))
xy_4 = XYPlane(Origin=pt_4)
series_4 = Series(Start=0, Step=Slider(70, range=0..100), Count="5")
prot_4 = RotatePlane(Plane=xy_4, Angle=degrees("-90"))
X_4 = UnitX(Factor=series_4)
brep_4 = Brep([<brep referenced from the Rhino model> x34])
move_4 = Move(Geometry=prot_4, Motion=X_4)  # -> Geometry, Transform
cluster_4 = Cluster(L=move_4.Geometry, O=brep_4, F=number_slider)
staticenv_4 = DefineStaticEnv(
    Index=0,
    Name="BeamTableA_140mm",
    ReferencePlane=move_4.Geometry,
    AlignPlane=move_4.Geometry,
    SafePosition=cluster_4,
    Width=0,
    Length="140",
    Height=0,
    Geometry=brep_4)

# ----
pt_5 = Point(Point(1247.761971, -1175.625008, 175.5261259))
xy_5 = XYPlane(Origin=pt_5)
prot_5 = RotatePlane(Plane=xy_5, Angle=degrees("-90"))
series_5 = Series(Start=0, Step=Slider(50, range=0..100), Count="11")
Y = UnitY(Factor=series_5)
move_5 = Move(Geometry=prot_5, Motion=Y)  # -> Geometry, Transform
brep_5 = Brep([<brep referenced from the Rhino model> x9])
cluster_5 = Cluster(L=move_5.Geometry, O=brep_5, F=Slider(300, range=0..1000))
staticenv_5 = DefineStaticEnv(
    Index=0,
    Name="PaperTable",
    ReferencePlane=move_5.Geometry,
    AlignPlane=move_5.Geometry,
    SafePosition=cluster_5,
    Width=0,
    Length=0,
    Height=0,
    Geometry=brep_5)

brep_6 = Brep(<brep referenced from the Rhino model>)
pt_6 = Point(Point(1748.334371, 2155.939188, 273.0261259))
xy_6 = XYPlane(Origin=pt_6)
prot_6 = RotatePlane(Plane=xy_6, Angle=degrees("-90"))
number_slider_2 = Slider(400, range=0..1000)
Z = UnitZ(Factor="-60")
series_6 = Series(Start=number_slider_2, Step=number_slider_2, Count=Slider(4, range=0..10))
move_6 = Move(Geometry=prot_6, Motion=Z)  # -> Geometry, Transform
Z_2 = UnitZ(Factor=series_6)
move_7 = Move(Geometry=move_6.Geometry, Motion=Z_2)  # -> Geometry, Transform
staticenv_6 = DefineStaticEnv(
    Index="1",
    Name="WorkTable",
    ReferencePlane=move_6.Geometry,
    AlignPlane=move_6.Geometry,
    SafePosition=move_7.Geometry,
    Width=0,
    Length=0,
    Height=0,
    Geometry=brep_6)

pt_7 = Point(Point(1300.261971, -280.125008, 253.0261259))
xy_7 = XYPlane(Origin=pt_7)
prot_7 = RotatePlane(Plane=xy_7, Angle=degrees("-90"))
brep_7 = Brep([<brep referenced from the Rhino model> x8])
cluster_6 = Cluster_2(O=brep_7, B=prot_7, F=Slider(300, range=0..1000))
staticenv_7 = DefineStaticEnv(
    Index=0,
    Name="WaterStation",
    ReferencePlane=prot_7,
    AlignPlane=prot_7,
    SafePosition=cluster_6,
    Width=0,
    Length=0,
    Height=0,
    Geometry=brep_7)

# ---- group: SETUP ACTOR
brep_8 = Brep([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])
plane = Plane(Plane(origin=(0, -5.918536772e-10, 0), x=(0, 1, 0), y=(1, 0, 0)))

pln = Plane(Plane(origin=(3.552713679e-10, 81.31727984, -94.74873734), x=(1, 0, 0), y=(0, 0.7071067812, 0.7071067812)))
prot_8 = RotatePlane(Plane=pln, Angle=degrees("180"))
endeffector = DefineEndeffector(ToolNum="1", ToolName="BeamGripper", Geometry=brep_8, TCPFrame=prot_8, MountingFrame=plane, Actions=merge, ZOffset=0)

pln_2 = Plane(Plane(origin=(0, -93.63961031, -103.6396103), x=(1, 0, 0), y=(0, 0.7071067812, -0.7071067812)))
prot_9 = RotatePlane(Plane=pln_2, Angle=degrees("0"))
endeffector_2 = DefineEndeffector(ToolNum="2", ToolName="PaperGripper", Geometry=brep_8, TCPFrame=prot_9, MountingFrame=plane, Actions=merge_3, ZOffset=0)

# ---- group: Beam Magazine
merge_4 = Merge(Data1=staticenv, Data2=staticenv_2, Data3=staticenv_3, Data4=staticenv_4)

# ---- group: SETUP ACTOR
merge_5 = Merge(Data1=endeffector, Data2=endeffector_2)  # -> flatten(Result)

# ---- group: Beam Magazine
pt_8 = Point(Point(2070.261971, -684.125008, 203.0261259))
xy_8 = XYPlane(Origin=pt_8)
series_7 = Series(Start=0, Step=Slider(70, range=0..100), Count="5")
prot_10 = RotatePlane(Plane=xy_8, Angle=degrees("-90"))
X_5 = UnitX(Factor=series_7)
number_slider_3 = Slider(400, range=0..1000)
brep_9 = Brep([<brep referenced from the Rhino model> x34])
move_8 = Move(Geometry=prot_10, Motion=X_5)  # -> Geometry, Transform
cluster_7 = Cluster(L=move_8.Geometry, O=brep_9, F=number_slider_3)
staticenv_8 = DefineStaticEnv(
    Index=0,
    Name="BeamTableB_460mm",
    ReferencePlane=move_8.Geometry,
    AlignPlane=move_8.Geometry,
    SafePosition=cluster_7,
    Width=0,
    Length="460",
    Height=0,
    Geometry=brep_9)

pt_9 = Point(Point(2070.261971, -284.8942387, 203.0261259))
xy_9 = XYPlane(Origin=pt_9)
series_8 = Series(Start=0, Step=Slider(70, range=0..100), Count="5")
prot_11 = RotatePlane(Plane=xy_9, Angle=degrees("-90"))
X_6 = UnitX(Factor=series_8)
brep_10 = Brep([<brep referenced from the Rhino model> x34])
move_9 = Move(Geometry=prot_11, Motion=X_6)  # -> Geometry, Transform
cluster_8 = Cluster(L=move_9.Geometry, O=brep_10, F=number_slider_3)
staticenv_9 = DefineStaticEnv(
    Index=0,
    Name="BeamTableB_300mm",
    ReferencePlane=move_9.Geometry,
    AlignPlane=move_9.Geometry,
    SafePosition=cluster_8,
    Width=0,
    Length="300",
    Height=0,
    Geometry=brep_10)

pt_10 = Point(Point(2070.261971, 23.56729973, 203.0261259))
xy_10 = XYPlane(Origin=pt_10)
series_9 = Series(Start=0, Step=Slider(70, range=0..100), Count="5")
prot_12 = RotatePlane(Plane=xy_10, Angle=degrees("-90"))
X_7 = UnitX(Factor=series_9)
brep_11 = Brep([<brep referenced from the Rhino model> x34])
move_10 = Move(Geometry=prot_12, Motion=X_7)  # -> Geometry, Transform
cluster_9 = Cluster(L=move_10.Geometry, O=brep_11, F=number_slider_3)
staticenv_10 = DefineStaticEnv(
    Index=0,
    Name="BeamTableB_220mm",
    ReferencePlane=move_10.Geometry,
    AlignPlane=move_10.Geometry,
    SafePosition=cluster_9,
    Width=0,
    Length="220",
    Height=0,
    Geometry=brep_11)

pt_11 = Point(Point(2072.041867, 240.946874, 203.0261259))
xy_11 = XYPlane(Origin=pt_11)
series_10 = Series(Start=0, Step=Slider(70, range=0..100), Count="5")
prot_13 = RotatePlane(Plane=xy_11, Angle=degrees("-90"))
X_8 = UnitX(Factor=series_10)
brep_12 = Brep([<brep referenced from the Rhino model> x34])
move_11 = Move(Geometry=prot_13, Motion=X_8)  # -> Geometry, Transform
cluster_10 = Cluster(L=move_11.Geometry, O=brep_12, F=number_slider_3)
staticenv_11 = DefineStaticEnv(
    Index=0,
    Name="BeamTableB_140mm",
    ReferencePlane=move_11.Geometry,
    AlignPlane=move_11.Geometry,
    SafePosition=cluster_10,
    Width=0,
    Length="140",
    Height=0,
    Geometry=brep_12)

# ---- group: SETUP ACTOR
xy_12 = XYPlane(Origin=Point(0, 0, 0))
line = Line(Line((0, -600, 0), (0, 4700, 0)))
actor = DefineActor(Name="Robot", RefPln=xy_12, Tools=merge_5, Actions=merge_2, LinearAxis=line, MaxWeight=-1)

# ---- group: Beam Magazine
merge_6 = Merge(Data1=staticenv_8, Data2=staticenv_9, Data3=staticenv_10, Data4=staticenv_11)

# ----
floorbeams = Brep([<brep referenced from the Rhino model> x15])
db = DesignBeam(Name="FloorBeam", Geometry=floorbeams, Index=-1)

# ----
# Define all your DesignElements
# - Build
# - Support
# - ...
chair_build_a = Brep([<brep referenced from the Rhino model> x66])
chair_build_b = Brep([<brep referenced from the Rhino model> x72])
db_2 = DesignBeam(Name="BuildBeamsA", Geometry=chair_build_a, Index=-1)
db_3 = DesignBeam(Name="BuildBeamsB", Geometry=chair_build_b, Index=-1)

chair_support_a = Brep([<brep referenced from the Rhino model> x9])
chair_support_b = Brep([<brep referenced from the Rhino model> x11])
db_4 = DesignBeam(Name="SupportBeamsA", Geometry=chair_support_a, Index=-1)
db_5 = DesignBeam(Name="SupportBeamsB", Geometry=chair_support_b, Index=-1)

# ----
# Generate your DesignComponent
panel_12 = Panel("GeneratedChair")
merge_7 = Merge(Data1=db_2, Data2=db_3, Data3=db_4, Data4=db_5, Data5=db)
dc = DesignComponent(Name=panel_12, DesignBeams=merge_7, Index=-1)

# ---- group: Sorted Names of FabElements
support_beam_names = Merge(Data1="SupportBeamsA", Data2="SupportBeamsB")
build_beam_names = Merge(Data1="BuildBeamsA", Data2="BuildBeamsB")
beam_a_names = Merge(Data1="BuildBeamsA", Data2="SupportBeamsA")
beam_b_names = Merge(Data1="BuildBeamsB", Data2="SupportBeamsB")
support_floor_beam_names = Merge(Data1="SupportBeamsA", Data2="SupportBeamsB", Data3="FloorBeam")
panel_13 = Panel(beam_a_names)
panel_14 = Panel(support_beam_names)
panel_15 = Panel(support_floor_beam_names)
panel_16 = Panel(build_beam_names)
panel_17 = Panel(beam_b_names)
build_support_beam_names = Merge(Data1=panel_16, Data2=panel_14)
panel_18 = Panel(build_support_beam_names)

# ----
# Generate FabComponent
fabcomponent = DefineFabComponent(DesignComponent=dc, StaticEnvFab=staticenv_6, StaticEnvBeam=staticenv)

# ---- group: Visualize Fab and DesignElements
decfe = DeconstructFabElement(FabElements=fabcomponent, PreviewScale=1)  # -> Name, Index, RefPln_Situ, RefPln_SituBox, RefPln_Mag, RefPln_Fab, RefPln_FabOut, GeometryBoxSitu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
decfe_2 = DeconstructFabElement(FabElements=decfe.FabBeams, PreviewScale="0.3")  # -> Name, Index, RefPln_Situ, RefPln_SituBox, RefPln_Mag, RefPln_Fab, RefPln_FabOut, GeometryBoxSitu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
deconstruct_designelement = DeconstructDesignElement(DesignElements=decfe.DesignElements, PreviewScale="0.3")  # -> Name, Geometry, FrameBase, FrameLower, FrameUpper, DesignLine, BrepBox, DesignRegion
deconstruct_designelement_2 = DeconstructDesignElement(DesignElements=decfe_2.DesignElements, PreviewScale="0.3")  # -> Name, Geometry, FrameBase, FrameLower, FrameUpper, DesignLine, BrepBox, DesignRegion

# ---- group: Sort all FabElements.Index by Z-Height
sortz = SortByZHeight(FabComponent=fabcomponent)

# ---- group: Update Magazine Position
panel_19 = Panel(panel_13)
panel_20 = Panel(panel_17)
updmag = UpdateMagazine(FabComponent=sortz, FabElementName=panel_19, StaticEnv=merge_4)
updmag_2 = UpdateMagazine(FabComponent=updmag, FabElementName=panel_20, StaticEnv=merge_6)

# ---- group: Generate Pick and Place Tasks
panel_21 = Panel(panel_18)
pnp = PickPlace(
    FabComponent=updmag_2,
    FabElementName=panel_21,
    Actor=actor,
    Endeffector=endeffector,
    PickAction=action,
    PlaceAction=action_2,
    OffsetPick=[0, 0, 200],
    OffsetPlace=[0, 0, 200],
    Rotation=Slider(0, range=-180..180))  # -> FabComponent, PickPlaceTask

# ---- group: Gnerate PaperJoint Tasks
panel_22 = Panel(panel_16)
panel_23 = Panel("BuildBeamsA")
pnp_paper = PickPlaceForPaperJoint(
    FabComponent=pnp.FabComponent,
    SourceElementName=panel_23,
    TargetElementName=panel_22,
    Actor=actor,
    Endeffector=endeffector_2,
    PickAction=action_7,
    PlaceAction=action_8,
    OffsetPick=[0, 0, 200],
    OffsetPlace=[0, 0, 200],
    Rotation="0",
    StaticEnvPaper=staticenv_5,
    MultiMag=False)  # -> FabComponent, PickPlaceTask
panel_24 = Panel("BuildBeamsB")
panel_25 = Panel(panel_16)
pnp_paper_2 = PickPlaceForPaperJoint(
    FabComponent=pnp_paper.FabComponent,
    SourceElementName=panel_24,
    TargetElementName=panel_25,
    Actor=actor,
    Endeffector=endeffector_2,
    PickAction=action_7,
    PlaceAction=action_8,
    OffsetPick=[0, 0, 200],
    OffsetPlace=[0, 0, 200],
    Rotation="-90",
    StaticEnvPaper=staticenv_5,
    MultiMag=False)  # -> FabComponent, PickPlaceTask
panel_26 = Panel("SupportBeamsA")
panel_27 = Panel(panel_15)
pnp_paper_3 = PickPlaceForPaperJoint(
    FabComponent=pnp_paper_2.FabComponent,
    SourceElementName=panel_26,
    TargetElementName=panel_27,
    Actor=actor,
    Endeffector=endeffector_2,
    PickAction=action_7,
    PlaceAction=action_8,
    OffsetPick=[0, 0, 200],
    OffsetPlace=[0, 0, 200],
    Rotation="0",
    StaticEnvPaper=staticenv_5,
    MultiMag=False)  # -> FabComponent, PickPlaceTask
panel_28 = Panel(panel_15)
panel_29 = Panel("SupportBeamsB")
pnp_paper_4 = PickPlaceForPaperJoint(
    FabComponent=pnp_paper_3.FabComponent,
    SourceElementName=panel_29,
    TargetElementName=panel_28,
    Actor=actor,
    Endeffector=endeffector_2,
    PickAction=action_7,
    PlaceAction=action_8,
    OffsetPick=[0, 0, 200],
    OffsetPlace=[0, 0, 200],
    Rotation="-90",
    StaticEnvPaper=staticenv_5,
    MultiMag=False)  # -> FabComponent, PickPlaceTask

# ----
number_slider_4 = Slider(2, range=0..10)

# ---- group: Generate DipWater Tasks / Dip Paper
panel_30 = Panel(panel_16)
toggle = BooleanToggle(True)
dippaperwater = DipPaperWater(
    FabComponent=pnp_paper_4.FabComponent,
    FabElementName=panel_30,
    Actor=actor,
    Endeffector=endeffector_2,
    DipAction=action_9,
    DependentAction=action_7,
    StaticEnv=staticenv_7,
    ZDipDepth=Slider(20, range=0..100),
    OffsetDip=[0, 0, 200],
    Rotation=0,
    DipDuration=number_slider_4)  # -> FabComponent, DipFabTask

# ---- group: Generate DipWater Tasks
panel_31 = Panel(panel_16)

# ---- group: Generate DipWater Tasks / Dip Beam
dipbeamwater = DipBeamWater(
    FabComponent=dippaperwater.FabComponent,
    FabElementName=panel_31,
    Actor=actor,
    Endeffector=endeffector,
    DipAction=action_3,
    DependentAction=action_7,
    StaticEnv=staticenv_7,
    ZDipDepth=Slider(50, range=0..100),
    OffsetDip=[0, 0, 200],
    Rotation=0,
    DipDuration=number_slider_4)  # -> FabComponent, DipFabTask

# ---- group: Sort all FabTasks for fabrication
merge_8 = Merge(Data1=panel_9, Data2=panel_11, Data3=panel_10)
merge_9 = Merge(Data1=panel_5, Data2=panel_7, Data3=panel_6)
merge_10 = Merge(Data1=panel_5, Data2=panel_6)
txt = Text(panel_16)
txt_2 = Text(panel_16)
txt_3 = Text(panel_14)
panel_32 = Panel(merge_9)
panel_33 = Panel(merge_8)
panel_34 = Panel(merge_10)
panel_35 = Panel(txt_2)
panel_36 = Panel(txt_3)
panel_37 = Panel(txt)
dict = CreateDictionary(Key=panel_35, Values=panel_33)
dict_2 = CreateDictionary(Key=panel_37, Values=panel_32)
dict_3 = CreateDictionary(Key=panel_36, Values=panel_34)
panel_38 = Panel("""0
0""")
panel_39 = Panel("""1
1""")
panel_40 = Panel("""0
0""")
merge_11 = Merge(Data1=dict, Data2=dict_2, Data3=dict_3)
merge_12 = Merge(Data1=panel_39, Data2=panel_40, Data3=panel_38)
panel_41 = Panel(merge_12)
seqtask = SequenceFabTasks(FabComponent=dipbeamwater.FabComponent, TaskSchema=merge_11, IterateTasks=panel_41)  # -> FabComponent, SequencedFabTasks

# ---- group: Generate travel Tasks for fabrication
travel = TravelGenerator(
    FabComponent=seqtask.FabComponent,
    FabTasks=seqtask.SequencedFabTasks,
    TravelAction=action_6,
    PickOptimalZ=Toggle(True),
    OptimalZ="500")  # -> FabComponent, SequencedFabTasks

# ---- group: Generate all tool change tasks during fabrication
changetool = ChangeToolGenerator(FabComponent=travel.FabComponent, FabTasks=travel.SequencedFabTasks, ChangeToolAction=action_4)  # -> FabComponent, SequencedFabTasks

# ----
list_item = ListItem(List=changetool.SequencedFabTasks, Index=0, Wrap=True)
deconstruct_object = DeconstructObject(Object=list_item)  # -> Geometry, Main_Frames, Sub_Frames, Main_ExtValues, Sub_ExtValues, State, Offset, Speed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
get_objects = GetObjects(Name=deconstruct_object.FabElementsName)  # -> Name, ObjectType, Objects
deconstruct_object_2 = DeconstructObject(Object=get_objects.Objects)  # -> Name, DesignBeamName, Id, Index, ElementName, ParentComponentName, DesignElementName, Geometry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
panel_42 = Panel(deconstruct_object_2.FabTasksName)
panel_43 = Panel(deconstruct_object_2.DesignBeamName)
list_item_2 = ListItem(List=panel_42, Index=0, Wrap=True)
panel_44 = Panel(list_item_2)
get_objects_2 = GetObjects(Name=list_item_2)  # -> Name, ObjectType, Objects
deconstruct_object_3 = DeconstructObject(Object=get_objects_2.Objects)  # -> Geometry, Main_Frames, Sub_Frames, Main_ExtValues, Sub_ExtValues, State, Offset, Speed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
panel_45 = Panel(deconstruct_object_3.Name)
panel_46 = Panel(deconstruct_object_3.FabElementsName)
number_slider_5 = Slider(10, range=0..10)
panel_47 = Panel(deconstruct_object.Name)
panel_48 = Panel(deconstruct_object.FabElementsName)
split_list = SplitList(List=changetool.SequencedFabTasks, Index=Slider(710, range=0..1000))  # -> ListA, ListB
split_list_2 = SplitList(List=split_list.ListB, Index=Slider(16, range=0..100))  # -> ListA, ListB
getname = GetName(Object=split_list_2.ListA)
panel_49 = Panel(getname)
deconstruct_object_4 = DeconstructObject(Object=split_list_2.ListA)  # -> Geometry, Main_Frames, Sub_Frames, Main_ExtValues, Sub_ExtValues, State, Offset, Speed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
number_slider_6 = Slider(2200, range=2200..2300)

# ----
# Simulate FabTask
number_slider_7 = Slider(0, range=0..24)
trigger = Trigger(Interval=200, TimerInterval=200, Target=simfabtask)  # disabled
pln_3 = Plane(PlaneXY(1700, 360, 1020))
# VirtualRobot Simulation
simfabtask = SimulateFabTaskVirtualRobot(
    FabTasks=split_list_2.ListA,
    Actor=actor,
    ActorDefaultPlane=pln_3,
    TaskIndex=Slider(0, range=0..1000),
    TaskSubIndex=number_slider_7,
    Reset=Button())  # -> TaskIndex, TaskSubIndex, Name, ToolNumber, Geometry, TCP, E1Value, E2Value, E3Value
geo = Geometry(simfabtask.Geometry)
pln_4 = Plane(simfabtask.TCP)
panel_50 = Panel([simfabtask.E1Value, simfabtask.E2Value, simfabtask.E3Value])
panel_51 = Panel([simfabtask.TaskIndex, simfabtask.TaskSubIndex])
panel_52 = Panel(simfabtask.Name)
panel_53 = Panel(simfabtask.ToolNumber)

# ---- group: Recording Tool for Animations
data = Data(Tree({0;0;0;0}: ["1", "2", "3", "4", "5", "6", "7", "8", "9", "10"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], {0;0;0;1}: ["0", "0", "0", "0", "0", "0", "0", "0", "0", "0"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]))  # disabled
number_slider_8 = Slider(150, range=0..150)  # disabled
panel_54 = Panel("151")  # disabled
split = SplitList(List=data, Index=panel_54)  # -> ListA, ListB; disabled
item = ListItem(List=split.ListA, Index=number_slider_8, Wrap=True)  # -> simplify(Item); disabled
bang = ExplodeTree(Data=item)  # -> Branch0, Branch1; disabled

# ---- group: Recording Tool for Animations / Plug into I/SI for recording
graft = GraftTree(IncludeEmptyLists=True, IncludeNullItems=True)  # disabled
rec = DataRecorder(graft, DataLimit=-10, RecordData=False)  # disabled

# ----
panel_55 = Panel(""";Beam Endeffector
   EXT Pick_Beam(FRAME: IN, REAL: IN, REAL[]: OUT) ;ID: 10
   EXT Place_Beam(FRAME: IN, REAL: IN, REAL[]: OUT) ;ID: 11
   EXT Dip_Beam(FRAME: IN, REAL: IN, REAL[]: OUT, REAL: IN) ;ID: 12
  
   ;Paper Endeffector:
   EXT Pick_Paper(FRAME: IN, REAL: IN, REAL[]: OUT) ;ID: 20
   EXT Place_Paper(FRAME: IN, REAL: IN, REAL[]: OUT) ;ID: 21
   EXT Dip_Paper(FRAME: IN, REAL: IN, REAL[]: OUT, REAL: IN) ;ID:22
 
   EXT Change_Tool(INT:IN)
   
   ;EXT travel_AXIS(REAL[,]: OUT, REAL[]: OUT, INT: IN, INT: IN)
   EXT travel_LIN(FRAME[]:OUT, REAL[]:OUT, INT:IN, INT:IN)
   EXT travel_PTP(FRAME[]:OUT, REAL[]:OUT, INT:IN, INT:IN)""")

# ---- group: Export .json for fabrication/simulate in VirtualRobot first
# Change JobIndex for each new
#  .json output of your project,
# to keep track of fabrication iterations
jobindex = Panel("0")
desfabtasks = ConvertoToDesFabTasks(FabTasks=split_list_2.ListA, JobIndex=jobindex)  # -> DesFabTasks, DesFabActorData
python = GhPythonScript(iTasks=desfabtasks.DesFabTasks)  # -> out, iDesFabTasks; inputs iTasks: list
# ---------- python: Python ----------
import ghpythonlib.components as ghc
import ghpythonlib.treehelpers as th
import Rhino.Geometry as rg

desFabTasks = []

def CheckIfAxisTask(mainExternalAxis):
    isAxisTask = False
    if mainExternalAxis != None:
            for external in mainExternalAxis:
                externalKey = external.Key
                if (externalKey == "A1" or externalKey == "A2" or externalKey == "A3" or externalKey == "A4" or externalKey == "A5" or externalKey == "A6"):
                    isAxisTask = True
    return isAxisTask


def ConvertToKukaAxisValuesFrameTask(externalAxisValues): #error is here
    kukaAxisValues = {}
    externalKeysList = []
    
    if externalAxisValues != None:
        externalValues = []
        for external in externalAxisValues:
            externalKey = external.Key
            externalKeysList.append(externalKey)
            for value in external.Value:
                externalValues.append(value)
    
    externalValuesTree = th.list_to_tree(externalValues)
    
    kukaAxisValues = ghc.Twico.KukaAxisValues(externalKeysList,externalValuesTree)
    
    return kukaAxisValues


def ConvertToKukaAxisValuesAxisTask(externalAxisValues):
    kukaMainAxisValues = {}
    kukaExternalAxisValues = {}
    
    mainKeysList = []
    mainValuesNestedList = []
    
    externalKeysList = []
    externalValuesNestedList = []
    
    if externalAxisValues != None:
        for external in externalAxisValues:
            externalKey = external.Key
            
            mainValues = []
            externalValues = []
            for value in external.Value:
                if (externalKey == "A1" or externalKey == "A2" or externalKey == "A3" or externalKey == "A4" or externalKey == "A5" or externalKey == "A6"):
                    mainKeysList.append(externalKey)
                    mainValues.append(value)
                else:
                    externalKeysList.append(externalKey)
                    externalValues.append(value)
            
            mainValuesNestedList.append(mainValues)
            externalValuesNestedList.append(externalValues)
    
    mainValuesTree = th.list_to_tree(mainValuesNestedList)
    externalValuesTree = th.list_to_tree(externalValuesNestedList)
    
    kukaMainAxisValues = ghc.Twico.KukaAxisValues(mainKeysList, mainValuesTree)
    kukaExternalAxisValues = ghc.Twico.KukaAxisValues(externalKeysList, externalValuesTree)
    
    return kukaMainAxisValues, kukaExternalAxisValues


for i, task in enumerate(iTasks):
    name = "J" + str(task["Job"]) + "L" + str(task["Level"]) + "_"+task["Name"] 
    type = task["Type"]
    
    
    main_actor = task["Main_Actor"]
    description = task["Description"]
    message = task["Message"]
    job = task["Job"]
    level = task["Level"]
    index = task["Index"]
    elements_id = task["Elements_Id"] #usually this is the correct one to use
    elements_id = task["Elements_Name"] #this one is only used for the sake of the workshop as elements_id
    actorsDataDict = task["Actors_Data"]
    
    
    if elements_id == None:
        elements_id = []
    
    
    #ActorData
    actorName = actorsDataDict["ActorName"]
    toolName = actorsDataDict["ToolName"]
    toolNumber = actorsDataDict["ToolNumber"]
    actionID = actorsDataDict["ActionID"]
    mainPlanes = actorsDataDict["MainPlanes"]
    secondaryPlanes = actorsDataDict["SecondaryPlanes"]
    mainExternalAxis = actorsDataDict["MainExternalAxis"]
    secondaryExternalAxis = actorsDataDict["SecondaryExternalAxis"]
    states = actorsDataDict["States"]
    speed = actorsDataDict["Speed"]
    offset = actorsDataDict["Offset"]
    
    
    isAxisTask = CheckIfAxisTask(mainExternalAxis)
    
    print level
    #Not Frame Based (Take, Init, ...)
    if mainPlanes == None and mainExternalAxis == None:
        print "BaseTask: ", name
        actorData = ghc.Twico.KukaKRLBase(actorName, toolName, toolNumber, actionID)
    #Frame Based
    elif mainPlanes != None and isAxisTask == False:
        print "FrameTask: ", name
        frameMainExternalAxisConv = ConvertToKukaAxisValuesFrameTask(mainExternalAxis)
        frameSecondaryExternalAxisConv = ConvertToKukaAxisValuesFrameTask(secondaryExternalAxis)
        
         
        
        if secondaryPlanes != None:
            actorData = ghc.Twico.KukaKRLFrame(actorName, toolName, toolNumber, actionID, 
            mainplanes = mainPlanes,
            secondaryplanes = secondaryPlanes,
            mainexternalaxis = frameMainExternalAxisConv,
            secondaryexternalaxis = frameSecondaryExternalAxisConv,
            states = states,
            speed = speed,
            offset = offset)
        else:
            actorData = ghc.Twico.KukaKRLFrame(actorName, toolName, toolNumber, actionID, 
            mainplanes = mainPlanes,
            mainexternalaxis = frameMainExternalAxisConv,
            states = states,
            speed = speed,
            offset = offset)
    #Axis Based
    elif isAxisTask == True:
        print "AxisTask: ", name
        mainAxisConv, axisMainExternalAxisConv = ConvertToKukaAxisValuesAxisTask(mainExternalAxis)
        actorData = ghc.Twico.KukaKRLAxis(actorName, toolName, toolNumber, actionID,
        mainaxisvalues = mainAxisConv,
        #secondaryaxisValues = ???,
        mainexternalaxis = axisMainExternalAxisConv,
        #secondaryexternalaxis = axisSecondaryExternalAxisConv,
        states = states,
        speed = speed,
        offset = offset)
    else:
        print "THIS TASK CAN NOT BE SEND!"
        raise NameError(str(name) + ": can not be converted to DesFabTask!!")
    
    
    desFabTask = ghc.Twico.TaskBase(
    name, 
    type,
    main_actor,
    description,
    message,
    job,
    level,
    index,
    elements_id = elements_id,
    actors_data = actorData,
    )
    
    desFabTasks.append(desFabTask)

iDesFabTasks = desFabTasks
# ---------- end python ----------
# same button should
# ride in other json file
panel_56 = Panel("TravelTestTask")
path = FilePath("C:\Users\opgenorth\OneDrive - bwstaff\ICD_Projects\DigitalFutures\02_Development\02_Twico\output_folder\")
save = SaveToJson(Tasks=python.iDesFabTasks, DIR=path, FileName=panel_56, Save=Button())

# ----
merge_13 = Merge(Data1=merge, Data2=merge_3, Data3=merge_2)
python_2 = GhPythonScript(iTasks=desfabtasks.DesFabTasks, iFileName="TestKRL", iSubPrograms=panel_55, iActions=merge_13)  # -> out, flatten(oKRL); inputs iTasks: list, iSubPrograms: list, iActions: list
# ---------- python_2: Python ----------
import ghpythonlib.treehelpers as th
import Rhino.Geometry as rg
import math

space = "   "
desFabTasks = []

KRL = []
declVar = []
initVar = []
krlTasks = []


MainFrameStr = "MainFrame"
E1_ValueStr = "E1_Value"
OffsetsStr = "Offsets"
OffsetsListStr = "Offsets[3]"
ToolNumStr =  "ToolNum"
DurationStr = "Duration"
FrameListStr = "FrameList"
E1_ListStr = "E1List"
listLength = 10


ACTIONS_IDS = {}

for a, action in enumerate(iActions):
    ACTIONS_IDS[action.ActionID] = action.Name


def AddKRL_Base(action_id, toolNum):
    name =  str(ACTIONS_IDS[action_id])
    
    krlTasks.append(ToolNumStr + " = " + str(toolNum))
    krlTasks.append(str(ACTIONS_IDS[action_id]) + "(" + ToolNumStr + ")")

def ComputeXYZABC(frame, roundDigitCount):
    q = rg.Quaternion.Rotation(rg.Plane.WorldXY, frame)
    
    toDegree = 180.0 / math.pi;
    a = toDegree * math.atan2(q.B * q.C + q.A * q.D, 0.5 - q.C * q.C - q.D * q.D);
    b = toDegree * math.asin(2.0 * (q.A * q.C - q.B * q.D));
    c = toDegree * math.atan2(q.C * q.D + q.A * q.B, 0.5 - q.B * q.B - q.C * q.C);
    
    X = str(round(frame.OriginX,roundDigitCount))
    Y = str(round(frame.OriginY,roundDigitCount))
    Z = str(round(frame.OriginZ,roundDigitCount))
    A = str(round(a,roundDigitCount))
    B = str(round(b,roundDigitCount))
    C = str(round(c,roundDigitCount))
    
    XYZABC = a = "{X " + X + ",Y " + Y + ",Z " + Z + ",A " + A + ",B " + B + ",C " + C + "}" 
    
    return XYZABC

def AddKRL_Frame(action_id, toolNum, frame, e1, offset = None, duration = None):
    
    name =  str(ACTIONS_IDS[action_id])
    
    print name
    if "Dip" in name:
        if duration != None:
            abcxyz = ComputeXYZABC(frame[0], 2)
            krlTasks.append(MainFrameStr + " = " + abcxyz)
            krlTasks.append(E1_ValueStr + " = " + str(e1))
            
            for i in range(len(offset)):
                krlTasks.append(OffsetsStr + "[" + str(i+1) + "]" + " = " + str(offset[i]))
            
            krlTasks.append(DurationStr + " = " + str(duration[0]))
            krlTasks.append(str(ACTIONS_IDS[action_id]) + "(" + MainFrameStr + ", " + E1_ValueStr + ", " + OffsetsStr + "[]" + ", " + DurationStr + ")")
    
    elif "travel" in name:
        for i in range(len(frame)):
            abcxyz = ComputeXYZABC(frame[i], 2)
            krlTasks.append(FrameListStr + "[" + str(i+1) + "]" + " = " + abcxyz)
            krlTasks.append(E1_ListStr + "[" + str(i+1) + "]"+ " = " + str(e1))
        krlTasks.append(str(ACTIONS_IDS[action_id]) + "(" + FrameListStr + "[]" + ", " + E1_ListStr + "[]" + ", " + str(len(frame)) + ", " + str(toolNum) + ")")
     
    elif "Pick" in name or "Place" in name:
        if offset != None:
            abcxyz = ComputeXYZABC(frame[0], 2)
            krlTasks.append(MainFrameStr + " = " + abcxyz)
            krlTasks.append(E1_ValueStr + " = " + str(e1))
            
            for i in range(len(offset)):
                krlTasks.append(OffsetsStr + "[" + str(i+1) + "]" + " = " + str(offset[i]))
            krlTasks.append(str(ACTIONS_IDS[action_id]) + "(" + MainFrameStr + ", " + E1_ValueStr + ", " + OffsetsStr + "[]" + ")")
    else:
        print("Task can not be generated!")
        raise NameError(str(name) + ": can not be converted!!")


def CheckIfAxisTask(mainExternalAxis):
    isAxisTask = False
    if mainExternalAxis != None:
            for external in mainExternalAxis:
                externalKey = external.Key
                if (externalKey == "A1" or externalKey == "A2" or externalKey == "A3" or externalKey == "A4" or externalKey == "A5" or externalKey == "A6"):
                    isAxisTask = True
    return isAxisTask


def ConvertToKukaAxisValuesFrameTask(externalAxisValues): #error is here
    kukaAxisValues = {}
    externalKeysList = []
    
    if externalAxisValues != None:
        externalValues = []
        for external in externalAxisValues:
            externalKey = external.Key
            externalKeysList.append(externalKey)
            for value in external.Value:
                externalValues.append(value)
    
    externalValuesTree = th.list_to_tree(externalValues)
    
    kukaAxisValues = ghc.Twico.KukaAxisValues(externalKeysList,externalValuesTree)
    
    return kukaAxisValues

def GetE1Values(externalAxisValues):
    kukaAxisValues = {}
    externalKeysList = []
    
    if externalAxisValues != None:
        externalValues = []
        for external in externalAxisValues:
            externalKey = external.Key
            externalKeysList.append(externalKey)
            for value in external.Value:
                e1 = value
                externalValues.append(value)
    
    externalValuesTree = th.list_to_tree(externalValues)
    
    return externalValues


def ConvertToKukaAxisValuesAxisTask(externalAxisValues):
    kukaMainAxisValues = {}
    kukaExternalAxisValues = {}
    
    mainKeysList = []
    mainValuesNestedList = []
    
    externalKeysList = []
    externalValuesNestedList = []
    
    if externalAxisValues != None:
        for external in externalAxisValues:
            externalKey = external.Key
            
            mainValues = []
            externalValues = []
            for value in external.Value:
                if (externalKey == "A1" or externalKey == "A2" or externalKey == "A3" or externalKey == "A4" or externalKey == "A5" or externalKey == "A6"):
                    mainKeysList.append(externalKey)
                    mainValues.append(value)
                else:
                    externalKeysList.append(externalKey)
                    externalValues.append(value)
            
            mainValuesNestedList.append(mainValues)
            externalValuesNestedList.append(externalValues)
    
    mainValuesTree = th.list_to_tree(mainValuesNestedList)
    externalValuesTree = th.list_to_tree(externalValuesNestedList)
    
    kukaMainAxisValues = ghc.Twico.KukaAxisValues(mainKeysList, mainValuesTree)
    kukaExternalAxisValues = ghc.Twico.KukaAxisValues(externalKeysList, externalValuesTree)
    
    return kukaMainAxisValues, kukaExternalAxisValues


for i, task in enumerate(iTasks):
    name = "J" + str(task["Job"]) + "L" + str(task["Level"]) + "_"+task["Name"] 
    type = task["Type"]
    
    
    main_actor = task["Main_Actor"]
    description = task["Description"]
    message = task["Message"]
    job = task["Job"]
    level = task["Level"]
    index = task["Index"]
    elements_id = task["Elements_Id"] #usually this is the correct one to use
    elements_id = task["Elements_Name"] #this one is only used for the sake of the workshop as elements_id
    actorsDataDict = task["Actors_Data"]
    
    
    if elements_id == None:
        elements_id = []
    
    
    #ActorData
    actorName = actorsDataDict["ActorName"]
    toolName = actorsDataDict["ToolName"]
    toolNumber = actorsDataDict["ToolNumber"]
    actionID = actorsDataDict["ActionID"]
    mainPlanes = actorsDataDict["MainPlanes"]
    secondaryPlanes = actorsDataDict["SecondaryPlanes"]
    mainExternalAxis = actorsDataDict["MainExternalAxis"]
    secondaryExternalAxis = actorsDataDict["SecondaryExternalAxis"]
    states = actorsDataDict["States"]
    speed = actorsDataDict["Speed"]
    offset = actorsDataDict["Offset"]
    
    
    isAxisTask = CheckIfAxisTask(mainExternalAxis)
    
    print level
    
    krlTasks.append(";FOLD " + name)
    
    #Not Frame Based (Take, Init, ...)
    if mainPlanes == None and mainExternalAxis == None:
        print "BaseTask: ", name
        AddKRL_Base(actionID, toolNumber)
    #Frame Based
    elif mainPlanes != None and isAxisTask == False:
        print "FrameTask: ", name
        
        if secondaryPlanes != None:
            #logic missing
            raise ValueError("Unexpected secondaryPlanes value: should be None.")
        else:
            #single Frame
            if len(mainPlanes) > 0:
                e1Values = GetE1Values(mainExternalAxis)
                AddKRL_Frame(actionID, toolNumber, mainPlanes, e1Values[0], offset = offset, duration = speed)
    else:
        print "THIS TASK CAN NOT BE SEND!"
        raise NameError(str(name) + ": can not be converted to DesFabTask!!")
    
    
    krlTasks.append("  ;ENDFOLD " +  name)
    krlTasks.append(space)

#Append everything to KRL


KRL.append("DEF " + iFileName + "( )")
KRL.extend(iSubPrograms)
KRL.append(";------------------------------")
KRL.append(";FOLD DECLARE VARIABLES")

#Declare variables
#KRL.extend(declVar)
KRL.append("DECL FRAME " + MainFrameStr)
KRL.append("DECL REAL " + E1_ValueStr)
KRL.append("DECL REAL " + OffsetsListStr)
KRL.append("DECL INT " + ToolNumStr)
KRL.append("DECL REAL " + DurationStr)
KRL.append("DECL FRAME " + FrameListStr + "[" + str(listLength) + "]")
KRL.append("DECL REAL " + E1_ListStr + "[" + str(listLength) + "]")


#END

KRL.append("DECL BOOL HALTS_ON")
KRL.append(";ENDFOLD DECLARE VARIABLES")
KRL.append(";------------------------------")
KRL.append(";FOLD INI;")
KRL.append("  ;FOLD BASISTECH INI")
KRL.append("    GLOBAL INTERRUPT DECL 3 WHEN $STOPMESS==TRUE DO IR_STOPM ( )")
KRL.append("    INTERRUPT ON 3 ")
KRL.append("    BAS (#INITMOV,0 )")
KRL.append("  ;ENDFOLD (BASISTECH INI)")
KRL.append("  ;FOLD INITIALIZE VARIABLES")

#Initialize variables
#KRL.extend(initVar)
KRL.append(MainFrameStr + " = " "{X 0.0,Y 0.0,Z 0.0,A 0.0,B 0.0,C 0.0}")
KRL.append(E1_ValueStr + " = " + "0.0")

for i in range(3):
    KRL.append(OffsetsStr + "[" + str(i+1) + "]" + " = "  + "0")
    
KRL.append(ToolNumStr + " = " + "1")
KRL.append(DurationStr +  " = " + "0")

for i in range(listLength):
    KRL.append(FrameListStr + "[" + str(i+1) + "]" + " = " "{X 0.0,Y 0.0,Z 0.0,A 0.0,B 0.0,C 0.0}")
    KRL.append(E1_ListStr + "[" + str(i+1) + "]" + " = "  + "0")

KRL.append(";ENDFOLD INITIALIZE VARIABLES")
KRL.append(";ENDFOLD (INI)")
KRL.append(";------------------------------")
KRL.append("HALTS_ON = TRUE")
KRL.append(";------------------------------")
KRL.append(";FOLD PTP HOME  ")
KRL.append("$BWDSTART = FALSE")
KRL.append("PDAT_ACT=PDEFAULT")
KRL.append("FDAT_ACT=FHOME")
KRL.append("BAS (#PTP_PARAMS,100 )")
KRL.append("$H_POS=XHOME")
KRL.append("PTP  XHOME")
KRL.append(";ENDFOLD")

KRL.append(";------------------------------")
KRL.append(";FOLD SET BASE AND TOOL")
KRL.append("BAS(#BASE, 0)")
KRL.append("BAS(#TOOl, 1)") #could add here to use tool from first task
KRL.append(";ENDFOLD SET BASE AND TOOL")
KRL.append(";----------MOVE FROM START ---------")

#Add tasks
KRL.extend(krlTasks)

KRL.append("END")

oKRL = KRL

iDesFabTasks = desFabTasks
# ---------- end python_2 ----------

end = EndPoints(Curve=line)  # -> Start, End
xy_13 = XYPlane(Origin=end.Start)
Y_2 = UnitY(Factor=simfabtask.E1Value)
move_12 = Move(Geometry=xy_13, Motion=Y_2)  # -> Geometry, Transform

# ----
# VirtualRobot Setup
python_3 = GhPythonScript(iFabTools=merge_5)  # -> oVR_Tools; inputs iFabTools: list
# ---------- python_3: Python ----------
import Rhino.Geometry as rg
import ghpythonlib.components as ghc


tool_dict = {}
tool_List = []
toolsData = []
toolsNum = []
for i in range(len(iFabTools)):
    toolName = iFabTools[i].Name
    toolNum = iFabTools[i].ToolNum
    toolGeo = iFabTools[i].Geometry
    toolTcpPln= iFabTools[i].TcpPln
    toolMountPln = iFabTools[i].MountPln
    endeffector = ghc.VirtualRobot.DefineEndEffector(toolGeo, toolTcpPln, toolMountPln)
    tool_dict[toolNum] = endeffector

tool_List.append(tool_dict) # only 'way' to output dictionary

# Output the dictionary
oVR_Tools = tool_List
# ---------- end python_3 ----------
python_4 = GhPythonScript(iToolNum=simfabtask.ToolNumber, iVR_Tools=python_3)  # -> oVR_Tool; inputs iToolNum: Int32
# ---------- python_4: Python ----------
oVR_Tool = iVR_Tools.get(iToolNum)
# ---------- end python_4 ----------
kuka_kr_120 = PredefinedKUKAKR120Robot(RobRootFrame=move_12.Geometry, EndEffectorOptional=python_4, variant="R2700")
data_2 = Data(kuka_kr_120)
robot_ik = RobotInverseKinematics(Robot=data_2, TargetTCPFrame=pln_4, AxisToggles=[False, False, False], useColorPreview=True)  # -> PoseGeometry, AxisValues, AxisFrames
item_2 = ListItem(List=robot_ik.AxisFrames, Index=0, Wrap=True)
item_3 = ListItem(List=robot_ik.AxisFrames, Index=5, Wrap=True)
swatch = ColourSwatch(SwatchColor=RGB(255, 0, 255))
roundd = RoundToDecimalPlace(NumberX=simfabtask.E2Value, DecimalPlace=2, RoundType=0)  # -> Rounded, Difference
roundd_2 = RoundToDecimalPlace(NumberX=simfabtask.E1Value, DecimalPlace=2, RoundType=0)  # -> Rounded, Difference
swatch_2 = ColourSwatch(SwatchColor=RGB(99, 99, 99))
preview = CustomPreview(Geometry=geo, Material=swatch)
tag = TextTag(Text=roundd.Rounded, Colour=swatch)
tag_2 = TextTag(Location=item_3, Text=simfabtask.Name, Colour=ColourSwatch(SwatchColor=RGB(255, 255, 0)))
tag_3 = TextTag(Location=item_2, Text=roundd_2.Rounded, Colour=swatch)

# ---- group: GhostSolver Check all Frames from Task
simfabtaskall = SimulateFabTaskVirtualRobot(FabTasks=changetool.SequencedFabTasks, Actor=actor)  # -> TaskIndex, TaskSubIndex, Name, ToolNumber, Geometry, TCP, E1Value, E2Value, E3Value
kuka_kr_120_2 = PredefinedKUKAKR120Robot(RobRootFrame=xy_13, EndEffectorOptional=python_4, variant="R2700")  # disabled
python_5 = GhPythonScript(
    iIndex=simfabtaskall.TaskIndex,
    iSubIndex=simfabtaskall.TaskSubIndex,
    iTaskName=simfabtaskall.Name,
    iToolNum=simfabtaskall.ToolNumber,
    iGeometry=simfabtaskall.Geometry,
    iTCP=simfabtaskall.TCP,
    iE1=simfabtaskall.E1Value,
    iE2=simfabtaskall.E2Value,
    iRobotPlatform=kuka_kr_120_2,
    iVR_Tools=python_3,
    iLinAxisStartPlane=xy_13)  # -> out, failedIndex, failedSubIndex, failedTaskName, failedTCP; inputs iIndex: tree of Int32, iSubIndex: tree of Int32, iTaskName: tree, iToolNum: tree of Int32, iGeometry: tree of Mesh, iTCP: tree of Plane, iE1: tree, iE2: tree, iLinAxisStartPlane: Plane; disabled
# ---------- python_5: Python ----------
import ghpythonlib.components as ghc
import math
import Grasshopper.Kernel as gh
from Grasshopper.Kernel import GH_RuntimeMessageLevel as RML
import Rhino.Geometry as rg

import clr
clr.AddReference("VirtualRobot.Core.dll")
import ICD.VirtualRobot.Core as VR

failedIndex = []
failedSubIndex = []
failedTaskName = []
failedTCP = []

def CheckAxisLimits(aV):
    for i in range(len(aV)):
        if math.isnan(aV[i]):
            errorMessage = "TCP can't be reached."
            return False, errorMessage
    if aV[0] < (-185) or aV[0] > 185:
        errorMessage = "A1 limit reached: " + str(aV[0])
        return False, errorMessage
    if aV[1] < (-130) or aV[1] > 20:
        errorMessage = "A2 limit reached: " + str(aV[1])
        return False, errorMessage
    if aV[2] < (-100) or aV[2] > 144:
        errorMessage = "A3 limit reached: " + str(aV[2])
        return False, errorMessage
    if aV[3] < (-350) or aV[3] > 350:
        errorMessage = "A4 limit reached: " + str(aV[3])
        return False, errorMessage
    if aV[4] < (-120) or aV[4] > 120:
        errorMessage = "A5 limit reached: " + str(aV[4])
        return False, errorMessage
    if aV[5] < (-350) or aV[5] > 350:
        errorMessage = "A6 limit reached: " + str(aV[5])
        return False, errorMessage
    return True, "No Axis limit reached."


for i in range(iTCP.BranchCount):
    tcpBranch = iTCP.Branch(i)
    for j in range(len(tcpBranch)):
        index = iIndex.Branch(i)[j]
        subIndex = iSubIndex.Branch(i)[j]
        taskName = iTaskName.Branch(i)[j]
        taskNameID = "I:" + str(index) + " SI:" + str(subIndex) + " - " + str(taskName)
        
        iRobotPlatform.EndEffector = iVR_Tools.get(iToolNum.Branch(i)[j])
        robot = iRobotPlatform
        tcp = iTCP.Branch(i)[j]
        axisToggles = [False, False, False]
        linAxisValue = -iE1.Branch(i)[j]
        #if j == 1:
        a = robot
        b = tcp
        c = linAxisValue
        
        #update linear axis value
        robRootFrame = iLinAxisStartPlane.Clone()
        linAxis_vector = rg.Vector3d(0, -linAxisValue, 0)
        robRootFrame.Translate(linAxis_vector)
        robot.RobRootFrame = robRootFrame
        
        poseGeo, axisValues, axisFrames = ghc.VirtualRobot.RobotInverseKinematics(robot, tcp, axisToggles)
        noAxisLimit, errorMessage_Axis =  CheckAxisLimits(axisValues)
        if noAxisLimit == False:
            warning_message = str(taskNameID) + " | " + str(errorMessage_Axis)
            ghenv.Component.AddRuntimeMessage(RML.Warning, warning_message)
            print warning_message
            failedIndex.append(index)
            failedSubIndex.append(subIndex)
            failedTaskName.append(taskName)
            failedTCP.append(tcp)
# ---------- end python_5 ----------
pln_5 = Plane(python_5.failedTCP)  # disabled
panel_57 = Panel(python_5.out)

# ----
construct_point = ConstructPoint(XCoordinate=0, YCoordinate=simfabtaskall.E1Value, ZCoordinate=0)
bounds = Bounds(Numbers=flatten(simfabtaskall.E1Value))
panel_58 = Panel(bounds)
panel_59 = Panel(python_2.oKRL)

# ---- group: Display Geometries
python_6 = GhPythonScript(x=[pnp_paper.PickPlaceTask, pnp_paper_2.PickPlaceTask])  # -> out, a
# ---------- python_6: Python ----------
a = x.Geometry
# ---------- end python_6 ----------
python_7 = GhPythonScript(x=[pnp_paper_3.PickPlaceTask, pnp_paper_4.PickPlaceTask])  # -> out, a; same code as python_6
geo_2 = Geometry(decfe_2.GeometryFabOut)
preview_2 = CustomPreview(Geometry=python_6.a, Material=ColourSwatch(SwatchColor=RGBA(110, 217, 43, 12)))
preview_3 = CustomPreview(Geometry=geo_2, Material=ColourSwatch(SwatchColor=RGBA(242, 242, 242, 24)))
preview_4 = CustomPreview(Geometry=python_7.a, Material=ColourSwatch(SwatchColor=RGBA(43, 69, 217, 12)))

# ----
swatch_3 = ColourSwatch(SwatchColor=RGBA(105, 105, 105, 56))
preview_5 = CustomPreview(Geometry=robot_ik.PoseGeometry, Material=swatch_3)
brep_13 = Brep([<brep referenced from the Rhino model> x140])
brep_14 = Brep([<brep referenced from the Rhino model> x7])
mesh = Mesh(<mesh referenced from the Rhino model>)
custom_preview = CustomPreview(Geometry=[brep_13, brep_14], Material=ColourSwatch(SwatchColor=RGB(54, 54, 54)))
preview_6 = CustomPreview(Geometry=mesh, Material=swatch_3)

# ==== cluster Cluster
O = ClusterInput()
group = Group(Objects=O)
bbox = BoundingBox(Content=group, Plane=PlaneXY(0, 0, 0))  # -> Box, Box_2
F = ClusterInput()
volume = Volume(Geometry=bbox.Box)  # -> Volume, Centroid
L = ClusterInput()
Z = UnitZ(Factor=F)
item = ListItem(List=L, Index=0, Wrap=True)
move = Move(Geometry=volume.Centroid, Motion=Z)  # -> Geometry, Transform
pl_origin = PlaneOrigin(Base=item, Origin=move.Geometry)
pl = ClusterOutput(pl_origin)

# ==== cluster Cluster_2
O = ClusterInput()
group = Group(Objects=O)
bbox = BoundingBox(Content=group, Plane=PlaneXY(0, 0, 0))  # -> Box, Box_2
volume = Volume(Geometry=bbox.Box)  # -> Volume, Centroid
F = ClusterInput()
Z = UnitZ(Factor=F)
B = ClusterInput()
move = Move(Geometry=volume.Centroid, Motion=Z)  # -> Geometry, Transform
pl_origin = PlaneOrigin(Base=B, Origin=move.Geometry)
pl = ClusterOutput(pl_origin)
