# Grasshopper definition DigitalFUTURES_SetupRobot_0701.gh (Grasshopper 1.0.8)
# plug-ins: DesFab.GH, Pufferfish, Fab.Grasshopper, VirtualRobot.Grasshopper

# ---- group: FabCollection displays all generated Elements and Tasks
reset = ResetFabCollection(Reset=Button())
allids = AllCollectionIDs(Refresh=Button(), FabCollection=reset)  # -> DesignElementNames, DesignPlateNames, DesignBeamNames, DesignComponentNames, FabElementNames, FabPlateNames, FabBeamNames, FabComponentNames, FabTaskNames, FabTaskSequenceSchema
panel = Panel(allids.FabTaskNames)

# ---- group: SETUP ACTOR / BeamGripper Actions
# Define your FabEnvironment
panel_2 = Panel("10")
panel_3 = Panel("Place")
panel_4 = Panel("Pick_Beam")
panel_5 = Panel("Place_Beam")
panel_6 = Panel("Dip_Beam")
panel_7 = Panel("Dip")
action = DefineAction(ActionID=panel_2, Name=panel_4, Type="Pick")
action_2 = DefineAction(ActionID="11", Name=panel_5, Type=panel_3)
action_3 = DefineAction(ActionID="12", Name=panel_6, Type=panel_7)
merge = Merge(Data1=action, Data2=action_2, Data3=action_3)

# ---- group: SETUP ACTOR / PaperGripper Actions
panel_8 = Panel("Dip_Paper")
panel_9 = Panel("Pick_Paper")
panel_10 = Panel("Place_Paper")
action_4 = DefineAction(ActionID="20", Name=panel_9, Type=panel_3)
action_5 = DefineAction(ActionID="21", Name=panel_10, Type=panel_10)
action_6 = DefineAction(ActionID="22", Name=panel_8, Type=panel_7)
merge_2 = Merge(Data1=action_4, Data2=action_5, Data3=action_6)

# ---- group: SETUP ACTOR / Robot Actions
action_7 = DefineAction(ActionID="3", Name="Change_Tool", Type="Travel")
action_8 = DefineAction(ActionID="2", Name="travel_LIN", Type="Travel")
action_9 = DefineAction(ActionID="1", Name="travel_PTP", Type="Travel")
merge_3 = Merge(Data1=action_9, Data2=action_8, Data3=action_7)

# ---- group: Beam Magazine
touchup_beamtablea_460mm_origin_x_y = Panel("""1466.35,-827.55,301.62
2230.86,-826.62,307.03
1466.30,-1295.12,298.58""")
cluster = CreateTouchUpPlane(ipts=touchup_beamtablea_460mm_origin_x_y, izoffset=Slider(-20, range=-50..50), iflip=Toggle(True))
series = Series(Start=0, Step=Slider(70, range=0..100), Count="5")
prot = RotatePlane(Plane=cluster, Angle=degrees("-90"))
X = UnitX(Factor=series)
number_slider = Slider(400, range=0..1000)
move = Move(Geometry=prot, Motion=X)  # -> Geometry, Transform
brep = Brep([<brep referenced from the Rhino model> x34])
cluster_2 = Cluster(L=move.Geometry, O=brep, F=number_slider)
staticenv = DefineStaticEnv(
    Index=0,
    Name="BeamTableA_460mm",
    ReferencePlane=move.Geometry,
    AlignPlane=move.Geometry,
    SafePosition=cluster_2,
    Width=0,
    Length="460",
    Height=0,
    Geometry=brep)

touchup_beamtablea_140mm_origin_x_y = Panel("""1468.22,147.68,301.71
2237.23,145.88,305.99
1467.62,1.22,300.35""")
cluster_3 = CreateTouchUpPlane(ipts=touchup_beamtablea_140mm_origin_x_y, izoffset=Slider(-20, range=-50..50), iflip=Toggle(True))
series_2 = Series(Start=0, Step=Slider(70, range=0..100), Count="5")
prot_2 = RotatePlane(Plane=cluster_3, Angle=degrees("-90"))
X_2 = UnitX(Factor=series_2)
move_2 = Move(Geometry=prot_2, Motion=X_2)  # -> Geometry, Transform
brep_2 = Brep([<brep referenced from the Rhino model> x34])
cluster_4 = Cluster(L=move_2.Geometry, O=brep_2, F=number_slider)
staticenv_2 = DefineStaticEnv(
    Index=0,
    Name="BeamTableA_140mm",
    ReferencePlane=move_2.Geometry,
    AlignPlane=move_2.Geometry,
    SafePosition=cluster_4,
    Width=0,
    Length="140",
    Height=0,
    Geometry=brep_2)

touchup_beamtablea_300mm_origin_x_y = Panel("""1467.20,-423.81,301.74
2237.36,-422.24,305.37
1466.32,-723.81,302.06""")
cluster_5 = CreateTouchUpPlane(ipts=touchup_beamtablea_300mm_origin_x_y, izoffset=Slider(-20, range=-50..50), iflip=Toggle(True))
series_3 = Series(Start=0, Step=Slider(70, range=0..100), Count="5")
prot_3 = RotatePlane(Plane=cluster_5, Angle=degrees("-90"))
X_3 = UnitX(Factor=series_3)
move_3 = Move(Geometry=prot_3, Motion=X_3)  # -> Geometry, Transform
brep_3 = Brep([<brep referenced from the Rhino model> x34])
cluster_6 = Cluster(L=move_3.Geometry, O=brep_3, F=number_slider)
staticenv_3 = DefineStaticEnv(
    Index=0,
    Name="BeamTableA_300mm",
    ReferencePlane=move_3.Geometry,
    AlignPlane=move_3.Geometry,
    SafePosition=cluster_6,
    Width=0,
    Length="300",
    Height=0,
    Geometry=brep_3)

touchup_beamtablea_220mm_origin_x_y = Panel("""1465.29,-99.47,302.28
2233.18,-99.83,305.81
1465.88,-323.39,301.39""")
cluster_7 = CreateTouchUpPlane(ipts=touchup_beamtablea_220mm_origin_x_y, izoffset=Slider(-20, range=-50..50), iflip=Toggle(True))
series_4 = Series(Start=0, Step=Slider(70, range=0..100), Count="5")
prot_4 = RotatePlane(Plane=cluster_7, Angle=degrees("-90"))
X_4 = UnitX(Factor=series_4)
move_4 = Move(Geometry=prot_4, Motion=X_4)  # -> Geometry, Transform
brep_4 = Brep([<brep referenced from the Rhino model> x34])
cluster_8 = Cluster(L=move_4.Geometry, O=brep_4, F=number_slider)
staticenv_4 = DefineStaticEnv(
    Index=0,
    Name="BeamTableA_220mm",
    ReferencePlane=move_4.Geometry,
    AlignPlane=move_4.Geometry,
    SafePosition=cluster_8,
    Width=0,
    Length="220",
    Height=0,
    Geometry=brep_4)

# ----
touchup_waterstation_origin_x_y = Panel("""1153.22,-421.12,299.02
1226.72,-421.19,299.54
1153.47,-127.12,299.43""")
cluster_9 = CreateTouchUpPlane(ipts=touchup_waterstation_origin_x_y, izoffset=Slider(0, range=-50..50), iflip=Toggle(False))
prot_5 = RotatePlane(Plane=cluster_9, Angle=degrees("-90"))
brep_5 = Brep([<brep referenced from the Rhino model> x2])
cluster_10 = Cluster_2(O=brep_5, B=prot_5, F=Slider(300, range=0..1000))
staticenv_5 = DefineStaticEnv(
    Index=0,
    Name="WaterStation",
    ReferencePlane=prot_5,
    AlignPlane=prot_5,
    SafePosition=cluster_10,
    Width=0,
    Length=0,
    Height=0,
    Geometry=brep_5)

touchup_worktable_origin_x_y = Panel("""1771.21,1599.19,263.7
1871.20,1599.57,264.52
1771.44,1699.19,263.82""")
cluster_11 = CreateTouchUpPlane(ipts=touchup_worktable_origin_x_y, izoffset=Slider(0, range=-50..50), iflip=Toggle(False))
prot_6 = RotatePlane(Plane=cluster_11, Angle=degrees("-90"))
number_slider_2 = Slider(400, range=0..1000)
Z = UnitZ(Factor="-60")
series_5 = Series(Start=number_slider_2, Step=number_slider_2, Count=Slider(4, range=0..10))
move_5 = Move(Geometry=prot_6, Motion=Z)  # -> Geometry, Transform
Z_2 = UnitZ(Factor=series_5)
move_6 = Move(Geometry=move_5.Geometry, Motion=Z_2)  # -> Geometry, Transform
brep_6 = Brep(<brep referenced from the Rhino model>)
staticenv_6 = DefineStaticEnv(
    Index="1",
    Name="WorkTable",
    ReferencePlane=move_5.Geometry,
    AlignPlane=move_5.Geometry,
    SafePosition=move_6.Geometry,
    Width=0,
    Length=0,
    Height=0,
    Geometry=brep_6)

# ---- group: SETUP ACTOR
brep_7 = Brep([<brep referenced from the Rhino model> x27])
plane = Plane(PlaneXY(0, 0, 0))

plane_2 = Plane(Plane(origin=(-30.86194844, 55.01791889, 344.7416526), x=(0.8723857188, 0.4887795155, 0.006143520321), y=(0.3355989679, -0.6080287234, 0.7194959376)))
prot_7 = RotatePlane(Plane=plane_2, Angle=degrees("0"))
endeffector = DefineEndeffector(ToolNum="1", ToolName="BeamGripper", Geometry=brep_7, TCPFrame=prot_7, MountingFrame=plane, Actions=merge, ZOffset=0)

plane_3 = Plane(Plane(origin=(64.508, -115.045, 404.815), x=(-0.8672418467, -0.4978808595, -0.002495818239), y=(-0.3557576565, 0.6161597016, 0.702697454)))
prot_8 = RotatePlane(Plane=plane_3, Angle=degrees("0"))
endeffector_2 = DefineEndeffector(ToolNum="2", ToolName="PaperGripper", Geometry=brep_7, TCPFrame=prot_8, MountingFrame=plane, Actions=merge_2, ZOffset=0)

merge_4 = Merge(Data1=endeffector, Data2=endeffector_2)  # -> flatten(Result)

# ---- group: Beam Magazine
merge_5 = Merge(Data1=staticenv, Data2=staticenv_3, Data3=staticenv_4, Data4=staticenv_2)

# ---- group: SETUP ACTOR
xy = XYPlane(Origin=Point(0, 0, 0))
line = Line(Line((0, -600, 0), (0, 4700, 0)))
actor = DefineActor(Name="Robot", RefPln=xy, Tools=merge_4, Actions=merge_3, LinearAxis=line, MaxWeight=-1)

# ---- group: Beam Magazine
offset = Slider(420, range=-700..700)
moveplane = MovePlane(iplane=cluster, ioffset=offset)
series_6 = Series(Start=0, Step=Slider(70, range=0..100), Count="5")
prot_9 = RotatePlane(Plane=moveplane, Angle=degrees("-90"))
X_5 = UnitX(Factor=series_6)
number_slider_3 = Slider(400, range=0..1000)
brep_8 = Brep([<brep referenced from the Rhino model> x34])
move_7 = Move(Geometry=prot_9, Motion=X_5)  # -> Geometry, Transform
cluster_12 = Cluster(L=move_7.Geometry, O=brep_8, F=number_slider_3)
staticenv_7 = DefineStaticEnv(
    Index=0,
    Name="BeamTableB_460mm",
    ReferencePlane=move_7.Geometry,
    AlignPlane=move_7.Geometry,
    SafePosition=cluster_12,
    Width=0,
    Length="460",
    Height=0,
    Geometry=brep_8)

offset_2 = Slider(420, range=-700..700)
moveplane_2 = MovePlane(iplane=cluster_5, ioffset=offset_2)
series_7 = Series(Start=0, Step=Slider(70, range=0..100), Count="5")
prot_10 = RotatePlane(Plane=moveplane_2, Angle=degrees("-90"))
X_6 = UnitX(Factor=series_7)
brep_9 = Brep([<brep referenced from the Rhino model> x34])
move_8 = Move(Geometry=prot_10, Motion=X_6)  # -> Geometry, Transform
cluster_13 = Cluster(L=move_8.Geometry, O=brep_9, F=number_slider_3)
staticenv_8 = DefineStaticEnv(
    Index=0,
    Name="BeamTableB_300mm",
    ReferencePlane=move_8.Geometry,
    AlignPlane=move_8.Geometry,
    SafePosition=cluster_13,
    Width=0,
    Length="300",
    Height=0,
    Geometry=brep_9)

offset_3 = Slider(420, range=-700..700)
moveplane_3 = MovePlane(iplane=cluster_7, ioffset=offset_3)
series_8 = Series(Start=0, Step=Slider(70, range=0..100), Count="5")
prot_11 = RotatePlane(Plane=moveplane_3, Angle=degrees("-90"))
X_7 = UnitX(Factor=series_8)
brep_10 = Brep([<brep referenced from the Rhino model> x34])
move_9 = Move(Geometry=prot_11, Motion=X_7)  # -> Geometry, Transform
cluster_14 = Cluster(L=move_9.Geometry, O=brep_10, F=number_slider_3)
staticenv_9 = DefineStaticEnv(
    Index=0,
    Name="BeamTableB_220mm",
    ReferencePlane=move_9.Geometry,
    AlignPlane=move_9.Geometry,
    SafePosition=cluster_14,
    Width=0,
    Length="220",
    Height=0,
    Geometry=brep_10)

offset_4 = Slider(420, range=-700..700)
moveplane_4 = MovePlane(iplane=cluster_3, ioffset=offset_4)
series_9 = Series(Start=0, Step=Slider(70, range=0..100), Count="5")
prot_12 = RotatePlane(Plane=moveplane_4, Angle=degrees("-90"))
X_8 = UnitX(Factor=series_9)
brep_11 = Brep([<brep referenced from the Rhino model> x34])
move_10 = Move(Geometry=prot_12, Motion=X_8)  # -> Geometry, Transform
cluster_15 = Cluster(L=move_10.Geometry, O=brep_11, F=number_slider_3)
staticenv_10 = DefineStaticEnv(
    Index=0,
    Name="BeamTableB_140mm",
    ReferencePlane=move_10.Geometry,
    AlignPlane=move_10.Geometry,
    SafePosition=cluster_15,
    Width=0,
    Length="140",
    Height=0,
    Geometry=brep_11)

merge_6 = Merge(Data1=staticenv_7, Data2=staticenv_8, Data3=staticenv_9, Data4=staticenv_10)

# ----
# Define all your DesignElements
# - Build
# - Support
# - ...
chair_build_a = Brep([<brep referenced from the Rhino model> x66])
chair_build_b = Brep([<brep referenced from the Rhino model> x72])
db = DesignBeam(Name="BuildBeamsA", Geometry=chair_build_a, Index=-1)
db_2 = DesignBeam(Name="BuildBeamsB", Geometry=chair_build_b, Index=-1)

chair_support_a = Brep([<brep referenced from the Rhino model> x9])
chair_support_b = Brep([<brep referenced from the Rhino model> x11])
db_3 = DesignBeam(Name="SupportBeamsA", Geometry=chair_support_a, Index=-1)
db_4 = DesignBeam(Name="SupportBeamsB", Geometry=chair_support_b, Index=-1)

floorbeams = Brep([<brep referenced from the Rhino model> x15])
db_5 = DesignBeam(Name="FloorBeam", Geometry=floorbeams, Index=-1)

# ----
# Generate your DesignComponent
panel_11 = Panel("GeneratedChair")
merge_7 = Merge(Data1=db, Data2=db_2, Data3=db_3, Data4=db_4, Data5=db_5)
dc = DesignComponent(Name=panel_11, DesignBeams=merge_7, Index=-1)

# ---- group: Sorted Names of FabElements
support_beam_names = Merge(Data1="SupportBeamsA", Data2="SupportBeamsB")
build_beam_names = Merge(Data1="BuildBeamsA", Data2="BuildBeamsB")
beam_a_names = Merge(Data1="BuildBeamsA", Data2="SupportBeamsA")
beam_b_names = Merge(Data1="BuildBeamsB", Data2="SupportBeamsB")
support_floor_beam_names = Merge(Data1="SupportBeamsA", Data2="SupportBeamsB", Data3="FloorBeam")
panel_12 = Panel(beam_a_names)
panel_13 = Panel(support_beam_names)
panel_14 = Panel(support_floor_beam_names)
panel_15 = Panel(build_beam_names)
panel_16 = Panel(beam_b_names)
build_support_beam_names = Merge(Data1=panel_15, Data2=panel_13)
panel_17 = Panel(build_support_beam_names)

# ----
# Generate FabComponent
fabcomponent = DefineFabComponent(DesignComponent=dc, StaticEnvFab=staticenv_6, StaticEnvBeam=staticenv)

# ---- group: Visualize Fab and DesignElements
decfe = DeconstructFabElement(FabElements=fabcomponent, PreviewScale=1)  # -> Name, Index, RefPln_Situ, RefPln_SituBox, RefPln_Mag, RefPln_Fab, RefPln_FabOut, GeometryBoxSitu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
decfe_2 = DeconstructFabElement(FabElements=decfe.FabBeams, PreviewScale="0.5")  # -> Name, Index, RefPln_Situ, RefPln_SituBox, RefPln_Mag, RefPln_Fab, RefPln_FabOut, GeometryBoxSitu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
deconstruct_designelement = DeconstructDesignElement(DesignElements=decfe.DesignElements, PreviewScale="0.3")  # -> Name, Geometry, FrameBase, FrameLower, FrameUpper, DesignLine, BrepBox, DesignRegion
deconstruct_designelement_2 = DeconstructDesignElement(DesignElements=decfe_2.DesignElements, PreviewScale="0.3")  # -> Name, Geometry, FrameBase, FrameLower, FrameUpper, DesignLine, BrepBox, DesignRegion

# ---- group: Sort all FabElements.Index by Z-Height
sortz = SortByZHeight(FabComponent=fabcomponent)

# ---- group: Update Magazine Position
panel_18 = Panel(panel_12)
panel_19 = Panel(panel_16)
updmag = UpdateMagazine(FabComponent=sortz, FabElementName=panel_18, StaticEnv=merge_5)
updmag_2 = UpdateMagazine(FabComponent=updmag, FabElementName=panel_19, StaticEnv=merge_6)

# ---- group: Generate Pick and Place Tasks
panel_20 = Panel(panel_17)
pnp = PickPlace(
    FabComponent=updmag_2,
    FabElementName=panel_20,
    Actor=actor,
    Endeffector=endeffector,
    PickAction=action,
    PlaceAction=action_2,
    OffsetPick=[0, 0, 200],
    OffsetPlace=[0, 0, 200],
    Rotation=Slider(0, range=-180..180))  # -> FabComponent, PickPlaceTask

# ----
number_slider_4 = Slider(2, range=0..10)

# ---- group: Generate DipWater Tasks
panel_21 = Panel(panel_15)

# ---- group: Recording Tool for Animations
data = Data(Tree({0;0;0;0}: ["1", "2", "3", "4", "5", "6", "7", "8", "9", "10"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], {0;0;0;1}: ["0", "0", "0", "0", "0", "0", "0", "0", "0", "0"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]))  # disabled
number_slider_5 = Slider(150, range=0..150)  # disabled
panel_22 = Panel("151")  # disabled
split = SplitList(List=data, Index=panel_22)  # -> ListA, ListB; disabled
item = ListItem(List=split.ListA, Index=number_slider_5, Wrap=True)  # -> simplify(Item); disabled
bang = ExplodeTree(Data=item)  # -> Branch0, Branch1; disabled

# ---- group: Recording Tool for Animations / Plug into I/SI for recording
graft = GraftTree(IncludeEmptyLists=True, IncludeNullItems=True)  # disabled
rec = DataRecorder(graft, DataLimit=-10, RecordData=False)  # disabled

# ----
number_slider_6 = Slider(2, range=-50..50)
touchup_papertable_origin_x_y = Panel("""1151.50,-1319.31,241.62
1199.92,-1319.35,242.03
1149.54,-1073.76,243.16""")
cluster_16 = CreateTouchUpPlane(ipts=touchup_papertable_origin_x_y, izoffset=number_slider_6, iflip=Toggle(False))
prot_13 = RotatePlane(Plane=cluster_16, Angle=degrees("-90"))
series_10 = Series(Start="48", Step=Slider(48, range=0..100), Count="9")
deconstruct_plane = DeconstructPlane(Plane=prot_13)  # -> Origin, XAxis, YAxis, ZAxis
amplitude = Amplitude(Vector=deconstruct_plane.XAxis, Amplitude=expr("-x", series_10))
amplitude_2 = Amplitude(Vector=deconstruct_plane.YAxis, Amplitude="25")
amplitude_3 = Amplitude(Vector=deconstruct_plane.ZAxis, Amplitude="8")
addition = Addition(A=amplitude, B=amplitude_2, C=amplitude_3)
move_11 = Move(Geometry=prot_13, Motion=addition)  # -> Geometry, Transform
brep_12 = Brep([<brep referenced from the Rhino model> x10])
cluster_17 = Cluster(L=move_11.Geometry, O=brep_12, F=Slider(300, range=0..1000))

touchup_papertable_origin_x_y_2 = Panel("""1245.41,-1318.25,241.97
1294.63,-1318.19,242.23
1245.21,-1076.87,244.32""")
cluster_18 = CreateTouchUpPlane(ipts=touchup_papertable_origin_x_y_2, izoffset=number_slider_6, iflip=Toggle(False))
prot_14 = RotatePlane(Plane=cluster_18, Angle=degrees("-90"))
series_11 = Series(Start="48", Step=Slider(48, range=0..100), Count="9")
deconstruct_plane_2 = DeconstructPlane(Plane=prot_14)  # -> Origin, XAxis, YAxis, ZAxis
amplitude_4 = Amplitude(Vector=deconstruct_plane_2.XAxis, Amplitude=expr("-x", series_11))
amplitude_5 = Amplitude(Vector=deconstruct_plane_2.YAxis, Amplitude="25")
amplitude_6 = Amplitude(Vector=deconstruct_plane_2.ZAxis, Amplitude="8")
addition_2 = Addition(A=amplitude_4, B=amplitude_5, C=amplitude_6)
move_12 = Move(Geometry=prot_14, Motion=addition_2)  # -> Geometry, Transform

touchup_papertable_origin_x_y_3 = Panel("""1342.15,-1318.73,243.24
1391.63,-1318.32,243.50
1339.89,-1081.64,245.49""")
cluster_19 = CreateTouchUpPlane(ipts=touchup_papertable_origin_x_y_3, izoffset=number_slider_6, iflip=Toggle(False))
prot_15 = RotatePlane(Plane=cluster_19, Angle=degrees("-90"))
series_12 = Series(Start="48", Step=Slider(48, range=0..100), Count="9")
deconstruct_plane_3 = DeconstructPlane(Plane=prot_15)  # -> Origin, XAxis, YAxis, ZAxis
amplitude_7 = Amplitude(Vector=deconstruct_plane_3.XAxis, Amplitude=expr("-x", series_12))
amplitude_8 = Amplitude(Vector=deconstruct_plane_3.YAxis, Amplitude="25")
amplitude_9 = Amplitude(Vector=deconstruct_plane_3.ZAxis, Amplitude="8")
addition_3 = Addition(A=amplitude_7, B=amplitude_8, C=amplitude_9)
move_13 = Move(Geometry=prot_15, Motion=addition_3)  # -> Geometry, Transform

merge_8 = Merge(Data1=move_11.Geometry, Data2=move_12.Geometry, Data3=move_13.Geometry)
staticenv_11 = DefineStaticEnv(
    Index=0,
    Name="PaperTray1",
    ReferencePlane=merge_8,
    AlignPlane=merge_8,
    SafePosition=cluster_17,
    Width=0,
    Length=0,
    Height=0,
    Geometry=brep_12)

# ---- group: Gnerate PaperJoint Tasks
panel_23 = Panel(panel_15)
panel_24 = Panel("BuildBeamsA")
pnp_paper = PickPlaceForPaperJoint(
    FabComponent=pnp.FabComponent,
    SourceElementName=panel_24,
    TargetElementName=panel_23,
    Actor=actor,
    Endeffector=endeffector_2,
    PickAction=action_4,
    PlaceAction=action_5,
    OffsetPick=[0, 0, 200],
    OffsetPlace=[0, 0, 200],
    Rotation="0",
    StaticEnvPaper=staticenv_11,
    MultiMag=False)  # -> FabComponent, PickPlaceTask
panel_25 = Panel("BuildBeamsB")
panel_26 = Panel(panel_15)
pnp_paper_2 = PickPlaceForPaperJoint(
    FabComponent=pnp_paper.FabComponent,
    SourceElementName=panel_25,
    TargetElementName=panel_26,
    Actor=actor,
    Endeffector=endeffector_2,
    PickAction=action_4,
    PlaceAction=action_5,
    OffsetPick=[0, 0, 200],
    OffsetPlace=[0, 0, 200],
    Rotation="-90",
    StaticEnvPaper=staticenv_11,
    MultiMag=False)  # -> FabComponent, PickPlaceTask
panel_27 = Panel("SupportBeamsA")
panel_28 = Panel(panel_14)
pnp_paper_3 = PickPlaceForPaperJoint(
    FabComponent=pnp_paper_2.FabComponent,
    SourceElementName=panel_27,
    TargetElementName=panel_28,
    Actor=actor,
    Endeffector=endeffector_2,
    PickAction=action_4,
    PlaceAction=action_5,
    OffsetPick=[0, 0, 200],
    OffsetPlace=[0, 0, 200],
    Rotation="0",
    StaticEnvPaper=staticenv_11,
    MultiMag=False)  # -> FabComponent, PickPlaceTask
panel_29 = Panel(panel_14)
panel_30 = Panel("SupportBeamsB")
pnp_paper_4 = PickPlaceForPaperJoint(
    FabComponent=pnp_paper_3.FabComponent,
    SourceElementName=panel_30,
    TargetElementName=panel_29,
    Actor=actor,
    Endeffector=endeffector_2,
    PickAction=action_4,
    PlaceAction=action_5,
    OffsetPick=[0, 0, 200],
    OffsetPlace=[0, 0, 200],
    Rotation="-90",
    StaticEnvPaper=staticenv_11,
    MultiMag=False)  # -> FabComponent, PickPlaceTask

# ---- group: Generate DipWater Tasks / Dip Paper
panel_31 = Panel(panel_15)
dippaperwater = DipPaperWater(
    FabComponent=pnp_paper_4.FabComponent,
    FabElementName=panel_31,
    Actor=actor,
    Endeffector=endeffector_2,
    DipAction=action_6,
    DependentAction=action_4,
    StaticEnv=staticenv_5,
    ZDipDepth=Slider(20, range=0..100),
    OffsetDip=[0, 0, 200],
    Rotation=0,
    DipDuration=number_slider_4)  # -> FabComponent, DipFabTask

# ---- group: Generate DipWater Tasks / Dip Beam
dipbeamwater = DipBeamWater(
    FabComponent=dippaperwater.FabComponent,
    FabElementName=panel_21,
    Actor=actor,
    Endeffector=endeffector,
    DipAction=action_3,
    DependentAction=action_4,
    StaticEnv=staticenv_5,
    ZDipDepth=Slider(50, range=0..100),
    OffsetDip=[0, 0, 200],
    Rotation=0,
    DipDuration=number_slider_4)  # -> FabComponent, DipFabTask

# ---- group: Sort all FabTasks for fabrication
merge_9 = Merge(Data1=panel_9, Data2=panel_8, Data3=panel_10)
merge_10 = Merge(Data1=panel_4, Data2=panel_6, Data3=panel_5)
merge_11 = Merge(Data1=panel_4, Data2=panel_5)
txt = Text(panel_15)
txt_2 = Text(panel_15)
txt_3 = Text(panel_13)
panel_32 = Panel(merge_10)
panel_33 = Panel(merge_9)
panel_34 = Panel(merge_11)
panel_35 = Panel(txt_2)
panel_36 = Panel(txt_3)
panel_37 = Panel(txt)
dict = CreateDictionary(Key=panel_35, Values=panel_33)
dict_2 = CreateDictionary(Key=panel_37, Values=panel_32)
dict_3 = CreateDictionary(Key=panel_36, Values=panel_34)
panel_38 = Panel("""0
0""")
panel_39 = Panel("""1
1""")
panel_40 = Panel("""0
0""")
merge_12 = Merge(Data1=dict, Data2=dict_2, Data3=dict_3)
merge_13 = Merge(Data1=panel_39, Data2=panel_40, Data3=panel_38)
panel_41 = Panel(merge_13)
seqtask = SequenceFabTasks(FabComponent=dipbeamwater.FabComponent, TaskSchema=merge_12, IterateTasks=panel_41)  # -> FabComponent, SequencedFabTasks

# ---- group: Generate travel Tasks for fabrication
travel = TravelGenerator(
    FabComponent=seqtask.FabComponent,
    FabTasks=seqtask.SequencedFabTasks,
    TravelAction=action_9,
    PickOptimalZ=Toggle(True),
    OptimalZ="500")  # -> FabComponent, SequencedFabTasks

# ---- group: Generate all tool change tasks during fabrication
changetool = ChangeToolGenerator(FabComponent=travel.FabComponent, FabTasks=travel.SequencedFabTasks, ChangeToolAction=action_7)  # -> FabComponent, SequencedFabTasks

# ----
# Simulate FabTask
number_slider_7 = Slider(0, range=0..24)
trigger = Trigger(Interval=200, TimerInterval=200, Target=simfabtask)  # disabled
pln = Plane(PlaneXY(1700, 360, 1020))
# VirtualRobot Simulation
simfabtask = SimulateFabTaskVirtualRobot(
    FabTasks=changetool.SequencedFabTasks,
    Actor=actor,
    ActorDefaultPlane=pln,
    TaskIndex=Slider(303, range=0..1000),
    TaskSubIndex=number_slider_7,
    Reset=Button())  # -> TaskIndex, TaskSubIndex, Name, ToolNumber, Geometry, TCP, E1Value, E2Value, E3Value
geo = Geometry(simfabtask.Geometry)
pln_2 = Plane(simfabtask.TCP)
panel_42 = Panel([simfabtask.E1Value, simfabtask.E2Value, simfabtask.E3Value])
panel_43 = Panel([simfabtask.TaskIndex, simfabtask.TaskSubIndex])
panel_44 = Panel(simfabtask.Name)
panel_45 = Panel(simfabtask.ToolNumber)

end = EndPoints(Curve=line)  # -> Start, End
xy_2 = XYPlane(Origin=end.Start)
Y = UnitY(Factor=simfabtask.E1Value)
move_14 = Move(Geometry=xy_2, Motion=Y)  # -> Geometry, Transform

# ----
# VirtualRobot Setup
python = GhPythonScript(iFabTools=merge_4)  # -> oVR_Tools; inputs iFabTools: list
# ---------- python: Python ----------
import Rhino.Geometry as rg
import ghpythonlib.components as ghc


tool_dict = {}
tool_List = []
toolsData = []
toolsNum = []
for i in range(len(iFabTools)):
    toolName = iFabTools[i].Name
    toolNum = iFabTools[i].ToolNum
    toolGeo = iFabTools[i].Geometry
    toolTcpPln= iFabTools[i].TcpPln
    toolMountPln = iFabTools[i].MountPln
    endeffector = ghc.VirtualRobot.DefineEndEffector(toolGeo, toolTcpPln, toolMountPln)
    tool_dict[toolNum] = endeffector

tool_List.append(tool_dict) # only 'way' to output dictionary

# Output the dictionary
oVR_Tools = tool_List
# ---------- end python ----------
python_2 = GhPythonScript(iToolNum=simfabtask.ToolNumber, iVR_Tools=python)  # -> oVR_Tool; inputs iToolNum: Int32
# ---------- python_2: Python ----------
oVR_Tool = iVR_Tools.get(iToolNum)
# ---------- end python_2 ----------
kuka_kr_120 = PredefinedKUKAKR120Robot(RobRootFrame=move_14.Geometry, EndEffectorOptional=python_2, variant="R2700")
data_2 = Data(kuka_kr_120)
robot_ik = RobotInverseKinematics(Robot=data_2, TargetTCPFrame=pln_2, AxisToggles=[False, False, False], useColorPreview=True)  # -> PoseGeometry, AxisValues, AxisFrames
item_2 = ListItem(List=robot_ik.AxisFrames, Index=0, Wrap=True)
item_3 = ListItem(List=robot_ik.AxisFrames, Index=5, Wrap=True)
swatch = ColourSwatch(SwatchColor=RGB(255, 0, 255))
roundd = RoundToDecimalPlace(NumberX=simfabtask.E2Value, DecimalPlace=2, RoundType=0)  # -> Rounded, Difference
roundd_2 = RoundToDecimalPlace(NumberX=simfabtask.E1Value, DecimalPlace=2, RoundType=0)  # -> Rounded, Difference
swatch_2 = ColourSwatch(SwatchColor=RGB(99, 99, 99))
preview = CustomPreview(Geometry=geo, Material=swatch)
tag = TextTag(Text=roundd.Rounded, Colour=swatch)
tag_2 = TextTag(Location=item_3, Text=simfabtask.Name, Colour=ColourSwatch(SwatchColor=RGB(255, 255, 0)))
tag_3 = TextTag(Location=item_2, Text=roundd_2.Rounded, Colour=swatch)

# ---- group: GhostSolver Check all Frames from Task
simfabtaskall = SimulateFabTaskVirtualRobot(FabTasks=changetool.SequencedFabTasks, Actor=actor)  # -> TaskIndex, TaskSubIndex, Name, ToolNumber, Geometry, TCP, E1Value, E2Value, E3Value
kuka_kr_120_2 = PredefinedKUKAKR120Robot(RobRootFrame=xy_2, EndEffectorOptional=python_2, variant="R2700")  # disabled
python_3 = GhPythonScript(
    iIndex=simfabtaskall.TaskIndex,
    iSubIndex=simfabtaskall.TaskSubIndex,
    iTaskName=simfabtaskall.Name,
    iToolNum=simfabtaskall.ToolNumber,
    iGeometry=simfabtaskall.Geometry,
    iTCP=simfabtaskall.TCP,
    iE1=simfabtaskall.E1Value,
    iE2=simfabtaskall.E2Value,
    iRobotPlatform=kuka_kr_120_2,
    iVR_Tools=python,
    iLinAxisStartPlane=xy_2)  # -> out, failedIndex, failedSubIndex, failedTaskName, failedTCP; inputs iIndex: tree of Int32, iSubIndex: tree of Int32, iTaskName: tree, iToolNum: tree of Int32, iGeometry: tree of Mesh, iTCP: tree of Plane, iE1: tree, iE2: tree, iLinAxisStartPlane: Plane; disabled
# ---------- python_3: Python ----------
import ghpythonlib.components as ghc
import math
import Grasshopper.Kernel as gh
from Grasshopper.Kernel import GH_RuntimeMessageLevel as RML
import Rhino.Geometry as rg

import clr
clr.AddReference("VirtualRobot.Core.dll")
import ICD.VirtualRobot.Core as VR

failedIndex = []
failedSubIndex = []
failedTaskName = []
failedTCP = []

def CheckAxisLimits(aV):
    for i in range(len(aV)):
        if math.isnan(aV[i]):
            errorMessage = "TCP can't be reached."
            return False, errorMessage
    if aV[0] < (-185) or aV[0] > 185:
        errorMessage = "A1 limit reached: " + str(aV[0])
        return False, errorMessage
    if aV[1] < (-130) or aV[1] > 20:
        errorMessage = "A2 limit reached: " + str(aV[1])
        return False, errorMessage
    if aV[2] < (-100) or aV[2] > 144:
        errorMessage = "A3 limit reached: " + str(aV[2])
        return False, errorMessage
    if aV[3] < (-350) or aV[3] > 350:
        errorMessage = "A4 limit reached: " + str(aV[3])
        return False, errorMessage
    if aV[4] < (-120) or aV[4] > 120:
        errorMessage = "A5 limit reached: " + str(aV[4])
        return False, errorMessage
    if aV[5] < (-350) or aV[5] > 350:
        errorMessage = "A6 limit reached: " + str(aV[5])
        return False, errorMessage
    return True, "No Axis limit reached."


for i in range(iTCP.BranchCount):
    tcpBranch = iTCP.Branch(i)
    for j in range(len(tcpBranch)):
        index = iIndex.Branch(i)[j]
        subIndex = iSubIndex.Branch(i)[j]
        taskName = iTaskName.Branch(i)[j]
        taskNameID = "I:" + str(index) + " SI:" + str(subIndex) + " - " + str(taskName)
        
        iRobotPlatform.EndEffector = iVR_Tools.get(iToolNum.Branch(i)[j])
        robot = iRobotPlatform
        tcp = iTCP.Branch(i)[j]
        axisToggles = [False, False, False]
        linAxisValue = -iE1.Branch(i)[j]
        #if j == 1:
        a = robot
        b = tcp
        c = linAxisValue
        
        #update linear axis value
        robRootFrame = iLinAxisStartPlane.Clone()
        linAxis_vector = rg.Vector3d(0, -linAxisValue, 0)
        robRootFrame.Translate(linAxis_vector)
        robot.RobRootFrame = robRootFrame
        
        poseGeo, axisValues, axisFrames = ghc.VirtualRobot.RobotInverseKinematics(robot, tcp, axisToggles)
        noAxisLimit, errorMessage_Axis =  CheckAxisLimits(axisValues)
        if noAxisLimit == False:
            warning_message = str(taskNameID) + " | " + str(errorMessage_Axis)
            ghenv.Component.AddRuntimeMessage(RML.Warning, warning_message)
            print warning_message
            failedIndex.append(index)
            failedSubIndex.append(subIndex)
            failedTaskName.append(taskName)
            failedTCP.append(tcp)
# ---------- end python_3 ----------
pln_3 = Plane(python_3.failedTCP)  # disabled
panel_46 = Panel(python_3.out)

# ---- group: Export .json for fabrication/simulate in VirtualRobot first
# TaskOutput
# Change JobIndex for each new
#  .json output of your project,
# to keep track of fabrication iterations
jobindex = Panel("0")  # disabled
desfabtasks = ConvertoToDesFabTasks(FabTasks=changetool.SequencedFabTasks, JobIndex=jobindex)  # -> DesFabTasks, DesFabActorData; disabled
python_4 = GhPythonScript(iTasks=desfabtasks.DesFabTasks)  # -> out, iDesFabTasks; inputs iTasks: list; disabled
# ---------- python_4: Python ----------
import ghpythonlib.components as ghc
import ghpythonlib.treehelpers as th
import Rhino.Geometry as rg

desFabTasks = []

def CheckIfAxisTask(mainExternalAxis):
    isAxisTask = False
    if mainExternalAxis != None:
            for external in mainExternalAxis:
                externalKey = external.Key
                if (externalKey == "A1" or externalKey == "A2" or externalKey == "A3" or externalKey == "A4" or externalKey == "A5" or externalKey == "A6"):
                    isAxisTask = True
    return isAxisTask


def ConvertToKukaAxisValuesFrameTask(externalAxisValues): #error is here
    kukaAxisValues = {}
    externalKeysList = []
    
    if externalAxisValues != None:
        externalValues = []
        for external in externalAxisValues:
            externalKey = external.Key
            externalKeysList.append(externalKey)
            for value in external.Value:
                externalValues.append(value)
    
    externalValuesTree = th.list_to_tree(externalValues)
    
    kukaAxisValues = ghc.Twico.KukaAxisValues(externalKeysList,externalValuesTree)
    
    return kukaAxisValues


def ConvertToKukaAxisValuesAxisTask(externalAxisValues):
    kukaMainAxisValues = {}
    kukaExternalAxisValues = {}
    
    mainKeysList = []
    mainValuesNestedList = []
    
    externalKeysList = []
    externalValuesNestedList = []
    
    if externalAxisValues != None:
        for external in externalAxisValues:
            externalKey = external.Key
            
            mainValues = []
            externalValues = []
            for value in external.Value:
                if (externalKey == "A1" or externalKey == "A2" or externalKey == "A3" or externalKey == "A4" or externalKey == "A5" or externalKey == "A6"):
                    mainKeysList.append(externalKey)
                    mainValues.append(value)
                else:
                    externalKeysList.append(externalKey)
                    externalValues.append(value)
            
            mainValuesNestedList.append(mainValues)
            externalValuesNestedList.append(externalValues)
    
    mainValuesTree = th.list_to_tree(mainValuesNestedList)
    externalValuesTree = th.list_to_tree(externalValuesNestedList)
    
    kukaMainAxisValues = ghc.Twico.KukaAxisValues(mainKeysList, mainValuesTree)
    kukaExternalAxisValues = ghc.Twico.KukaAxisValues(externalKeysList, externalValuesTree)
    
    return kukaMainAxisValues, kukaExternalAxisValues


for i, task in enumerate(iTasks):
    name = "J" + str(task["Job"]) + "L" + str(task["Level"]) + "_"+task["Name"] 
    type = task["Type"]
    
    
    main_actor = task["Main_Actor"]
    description = task["Description"]
    message = task["Message"]
    job = task["Job"]
    level = task["Level"]
    index = task["Index"]
    elements_id = task["Elements_Id"] #usually this is the correct one to use
    elements_id = task["Elements_Name"] #this one is only used for the sake of the workshop as elements_id
    actorsDataDict = task["Actors_Data"]
    
    
    if elements_id == None:
        elements_id = []
    
    
    #ActorData
    actorName = actorsDataDict["ActorName"]
    toolName = actorsDataDict["ToolName"]
    toolNumber = actorsDataDict["ToolNumber"]
    actionID = actorsDataDict["ActionID"]
    mainPlanes = actorsDataDict["MainPlanes"]
    secondaryPlanes = actorsDataDict["SecondaryPlanes"]
    mainExternalAxis = actorsDataDict["MainExternalAxis"]
    secondaryExternalAxis = actorsDataDict["SecondaryExternalAxis"]
    states = actorsDataDict["States"]
    speed = actorsDataDict["Speed"]
    offset = actorsDataDict["Offset"]
    
    
    isAxisTask = CheckIfAxisTask(mainExternalAxis)
    
    print level
    #Not Frame Based (Take, Init, ...)
    if mainPlanes == None and mainExternalAxis == None:
        print "BaseTask: ", name
        actorData = ghc.Twico.KukaKRLBase(actorName, toolName, toolNumber, actionID)
    #Frame Based
    elif mainPlanes != None and isAxisTask == False:
        print "FrameTask: ", name
        frameMainExternalAxisConv = ConvertToKukaAxisValuesFrameTask(mainExternalAxis)
        frameSecondaryExternalAxisConv = ConvertToKukaAxisValuesFrameTask(secondaryExternalAxis)
        
         
        
        if secondaryPlanes != None:
            actorData = ghc.Twico.KukaKRLFrame(actorName, toolName, toolNumber, actionID, 
            mainplanes = mainPlanes,
            secondaryplanes = secondaryPlanes,
            mainexternalaxis = frameMainExternalAxisConv,
            secondaryexternalaxis = frameSecondaryExternalAxisConv,
            states = states,
            speed = speed,
            offset = offset)
        else:
            actorData = ghc.Twico.KukaKRLFrame(actorName, toolName, toolNumber, actionID, 
            mainplanes = mainPlanes,
            mainexternalaxis = frameMainExternalAxisConv,
            states = states,
            speed = speed,
            offset = offset)
    #Axis Based
    elif isAxisTask == True:
        print "AxisTask: ", name
        mainAxisConv, axisMainExternalAxisConv = ConvertToKukaAxisValuesAxisTask(mainExternalAxis)
        actorData = ghc.Twico.KukaKRLAxis(actorName, toolName, toolNumber, actionID,
        mainaxisvalues = mainAxisConv,
        #secondaryaxisValues = ???,
        mainexternalaxis = axisMainExternalAxisConv,
        #secondaryexternalaxis = axisSecondaryExternalAxisConv,
        states = states,
        speed = speed,
        offset = offset)
    else:
        print "THIS TASK CAN NOT BE SEND!"
        raise NameError(str(name) + ": can not be converted to DesFabTask!!")
    
    
    desFabTask = ghc.Twico.TaskBase(
    name, 
    type,
    main_actor,
    description,
    message,
    job,
    level,
    index,
    elements_id = elements_id,
    actors_data = actorData,
    )
    
    desFabTasks.append(desFabTask)

iDesFabTasks = desFabTasks
# ---------- end python_4 ----------
panel_47 = Panel("TravelTestTask")  # disabled
button = Button()  # disabled
path = FilePath("C:\Users\opgenorth\OneDrive - bwstaff\ICD_Projects\DigitalFutures\02_Development\02_Twico\output_folder\")  # disabled
save = SaveToJson(Tasks=python_4.iDesFabTasks, DIR=path, FileName=panel_47, Save=button)  # disabled

# ---- group: KRL Generator
panel_48 = Panel(""";Beam Endeffector
   EXT Pick_Beam(FRAME: IN, REAL: IN, REAL[]: OUT) ;ID: 10
   EXT Place_Beam(FRAME: IN, REAL: IN, REAL[]: OUT) ;ID: 11
   EXT Dip_Beam(FRAME: IN, REAL: IN, REAL[]: OUT, REAL: IN) ;ID: 12
  
   ;Paper Endeffector:
   EXT Pick_Paper(FRAME: IN, REAL: IN, REAL[]: OUT) ;ID: 20
   EXT Place_Paper(FRAME: IN, REAL: IN, REAL[]: OUT) ;ID: 21
   EXT Dip_Paper(FRAME: IN, REAL: IN, REAL[]: OUT, REAL: IN) ;ID:22
 
   EXT Change_Tool(INT:IN)
   
   ;EXT travel_AXIS(REAL[,]: OUT, REAL[]: OUT, INT: IN, INT: IN)
   EXT travel_LIN(FRAME[]:OUT, REAL[]:OUT, INT:IN, INT:IN)
   EXT travel_PTP(FRAME[]:OUT, REAL[]:OUT, INT:IN, INT:IN)""")  # disabled
merge_14 = Merge(Data1=merge, Data2=merge_2, Data3=merge_3)  # disabled
panel_49 = Panel("TestKRL")  # disabled
python_5 = GhPythonScript(iTasks=desfabtasks.DesFabTasks, iFileName=panel_49, iSubPrograms=panel_48, iActions=merge_14)  # -> out, flatten(oKRL); inputs iTasks: list, iSubPrograms: list, iActions: list; disabled
# ---------- python_5: Python ----------
import ghpythonlib.treehelpers as th
import Rhino.Geometry as rg
import math

space = "   "
desFabTasks = []

KRL = []
declVar = []
initVar = []
krlTasks = []


MainFrameStr = "MainFrame"
E1_ValueStr = "E1_Value"
OffsetsStr = "Offsets"
OffsetsListStr = "Offsets[3]"
ToolNumStr =  "ToolNum"
DurationStr = "Duration"
FrameListStr = "FrameList"
E1_ListStr = "E1List"
listLength = 10


ACTIONS_IDS = {}

for a, action in enumerate(iActions):
    ACTIONS_IDS[action.ActionID] = action.Name


def AddKRL_Base(action_id, toolNum):
    name =  str(ACTIONS_IDS[action_id])
    
    krlTasks.append(ToolNumStr + " = " + str(toolNum))
    krlTasks.append(str(ACTIONS_IDS[action_id]) + "(" + ToolNumStr + ")")

def ComputeXYZABC(frame, roundDigitCount):
    q = rg.Quaternion.Rotation(rg.Plane.WorldXY, frame)
    
    toDegree = 180.0 / math.pi;
    a = toDegree * math.atan2(q.B * q.C + q.A * q.D, 0.5 - q.C * q.C - q.D * q.D);
    b = toDegree * math.asin(2.0 * (q.A * q.C - q.B * q.D));
    c = toDegree * math.atan2(q.C * q.D + q.A * q.B, 0.5 - q.B * q.B - q.C * q.C);
    
    X = str(round(frame.OriginX,roundDigitCount))
    Y = str(round(frame.OriginY,roundDigitCount))
    Z = str(round(frame.OriginZ,roundDigitCount))
    A = str(round(a,roundDigitCount))
    B = str(round(b,roundDigitCount))
    C = str(round(c,roundDigitCount))
    
    XYZABC = a = "{X " + X + ",Y " + Y + ",Z " + Z + ",A " + A + ",B " + B + ",C " + C + "}" 
    
    return XYZABC

def AddKRL_Frame(action_id, toolNum, frame, e1, offset = None, duration = None):
    
    name =  str(ACTIONS_IDS[action_id])
    
    print name
    if "Dip" in name:
        if duration != None:
            abcxyz = ComputeXYZABC(frame[0], 2)
            krlTasks.append(MainFrameStr + " = " + abcxyz)
            krlTasks.append(E1_ValueStr + " = " + str(e1))
            
            krlTasks.append(DurationStr + " = " + str(duration[0]))
            krlTasks.append(str(ACTIONS_IDS[action_id]) + "(" + MainFrameStr + ", " + E1_ValueStr + ", " + DurationStr + ")")
    
    elif "travel" in name:
        for i in range(len(frame)):
            abcxyz = ComputeXYZABC(frame[i], 2)
            krlTasks.append(FrameListStr + "[" + str(i+1) + "]" + " = " + abcxyz)
            krlTasks.append(E1_ValueStr + "[" + str(i+1) + "]"+ " = " + str(e1))
        krlTasks.append(str(ACTIONS_IDS[action_id]) + "(" + FrameListStr + "[]" + ", " + E1_ValueStr + "[]" + ", " + str(len(frame)) +")")
     
    elif "Pick" in name or "Place" in name:
        if offset != None:
            abcxyz = ComputeXYZABC(frame[0], 2)
            krlTasks.append(MainFrameStr + " = " + abcxyz)
            krlTasks.append(E1_ValueStr + " = " + str(e1))
            
            for i in range(len(offset)):
                krlTasks.append(OffsetsStr + "[" + str(i+1) + "]" + " = " + str(offset[i]))
            krlTasks.append(str(ACTIONS_IDS[action_id]) + "(" + MainFrameStr + ", " + E1_ValueStr + ", " + OffsetsStr + "[]" + ")")
    else:
        print("Task can not be generated!")
        raise NameError(str(name) + ": can not be converted!!")


def CheckIfAxisTask(mainExternalAxis):
    isAxisTask = False
    if mainExternalAxis != None:
            for external in mainExternalAxis:
                externalKey = external.Key
                if (externalKey == "A1" or externalKey == "A2" or externalKey == "A3" or externalKey == "A4" or externalKey == "A5" or externalKey == "A6"):
                    isAxisTask = True
    return isAxisTask


def ConvertToKukaAxisValuesFrameTask(externalAxisValues): #error is here
    kukaAxisValues = {}
    externalKeysList = []
    
    if externalAxisValues != None:
        externalValues = []
        for external in externalAxisValues:
            externalKey = external.Key
            externalKeysList.append(externalKey)
            for value in external.Value:
                externalValues.append(value)
    
    externalValuesTree = th.list_to_tree(externalValues)
    
    kukaAxisValues = ghc.Twico.KukaAxisValues(externalKeysList,externalValuesTree)
    
    return kukaAxisValues

def GetE1Values(externalAxisValues):
    kukaAxisValues = {}
    externalKeysList = []
    
    if externalAxisValues != None:
        externalValues = []
        for external in externalAxisValues:
            externalKey = external.Key
            externalKeysList.append(externalKey)
            for value in external.Value:
                e1 = value
                externalValues.append(value)
    
    externalValuesTree = th.list_to_tree(externalValues)
    
    return externalValues


def ConvertToKukaAxisValuesAxisTask(externalAxisValues):
    kukaMainAxisValues = {}
    kukaExternalAxisValues = {}
    
    mainKeysList = []
    mainValuesNestedList = []
    
    externalKeysList = []
    externalValuesNestedList = []
    
    if externalAxisValues != None:
        for external in externalAxisValues:
            externalKey = external.Key
            
            mainValues = []
            externalValues = []
            for value in external.Value:
                if (externalKey == "A1" or externalKey == "A2" or externalKey == "A3" or externalKey == "A4" or externalKey == "A5" or externalKey == "A6"):
                    mainKeysList.append(externalKey)
                    mainValues.append(value)
                else:
                    externalKeysList.append(externalKey)
                    externalValues.append(value)
            
            mainValuesNestedList.append(mainValues)
            externalValuesNestedList.append(externalValues)
    
    mainValuesTree = th.list_to_tree(mainValuesNestedList)
    externalValuesTree = th.list_to_tree(externalValuesNestedList)
    
    kukaMainAxisValues = ghc.Twico.KukaAxisValues(mainKeysList, mainValuesTree)
    kukaExternalAxisValues = ghc.Twico.KukaAxisValues(externalKeysList, externalValuesTree)
    
    return kukaMainAxisValues, kukaExternalAxisValues


for i, task in enumerate(iTasks):
    name = "J" + str(task["Job"]) + "L" + str(task["Level"]) + "_"+task["Name"] 
    type = task["Type"]
    
    
    main_actor = task["Main_Actor"]
    description = task["Description"]
    message = task["Message"]
    job = task["Job"]
    level = task["Level"]
    index = task["Index"]
    elements_id = task["Elements_Id"] #usually this is the correct one to use
    elements_id = task["Elements_Name"] #this one is only used for the sake of the workshop as elements_id
    actorsDataDict = task["Actors_Data"]
    
    
    if elements_id == None:
        elements_id = []
    
    
    #ActorData
    actorName = actorsDataDict["ActorName"]
    toolName = actorsDataDict["ToolName"]
    toolNumber = actorsDataDict["ToolNumber"]
    actionID = actorsDataDict["ActionID"]
    mainPlanes = actorsDataDict["MainPlanes"]
    secondaryPlanes = actorsDataDict["SecondaryPlanes"]
    mainExternalAxis = actorsDataDict["MainExternalAxis"]
    secondaryExternalAxis = actorsDataDict["SecondaryExternalAxis"]
    states = actorsDataDict["States"]
    speed = actorsDataDict["Speed"]
    offset = actorsDataDict["Offset"]
    
    
    isAxisTask = CheckIfAxisTask(mainExternalAxis)
    
    print level
    
    krlTasks.append(";FOLD " + name)
    
    #Not Frame Based (Take, Init, ...)
    if mainPlanes == None and mainExternalAxis == None:
        print "BaseTask: ", name
        AddKRL_Base(actionID, toolNumber)
    #Frame Based
    elif mainPlanes != None and isAxisTask == False:
        print "FrameTask: ", name
        
        if secondaryPlanes != None:
            #logic missing
            raise ValueError("Unexpected secondaryPlanes value: should be None.")
        else:
            #single Frame
            if len(mainPlanes) > 0:
                e1Values = GetE1Values(mainExternalAxis)
                AddKRL_Frame(actionID, toolNumber, mainPlanes, e1Values[0], offset = offset, duration = speed)
    else:
        print "THIS TASK CAN NOT BE SEND!"
        raise NameError(str(name) + ": can not be converted to DesFabTask!!")
    
    
    krlTasks.append("  ;ENDFOLD " +  name)
    krlTasks.append(space)

#Append everything to KRL


KRL.append("DEF " + iFileName + "( )")
KRL.extend(iSubPrograms)
KRL.append(";------------------------------")
KRL.append(";FOLD DECLARE VARIABLES")

#Declare variables
#KRL.extend(declVar)
KRL.append("DECL FRAME " + MainFrameStr)
KRL.append("REAL REAL " + E1_ValueStr)
KRL.append("DECL REAL " + OffsetsListStr)
KRL.append("DECL INT " + ToolNumStr)
KRL.append("DECL REAL " + DurationStr)
KRL.append("DECL FRAME " + FrameListStr + "[]")
KRL.append("DECL REAL " + E1_ListStr + "[]")


#END

KRL.append(";ENDFOLD DECLARE VARIABLES")
KRL.append(";------------------------------")
KRL.append(";FOLD INI;")
KRL.append("  ;FOLD BASISTECH INI")
KRL.append("    GLOBAL INTERRUPT DECL 3 WHEN $STOPMESS==TRUE DO IR_STOPM ( )")
KRL.append("    INTERRUPT ON 3 ")
KRL.append("    BAS (#INITMOV,0 )")
KRL.append("  ;ENDFOLD (BASISTECH INI)")
KRL.append("  ;FOLD INITIALIZE VARIABLES")

#Initialize variables
#KRL.extend(initVar)
KRL.append(MainFrameStr + " = " "{X 0.0,Y 0.0,Z 0.0,A 0.0,B 0.0,C 0.0}")
KRL.append(E1_ValueStr + " = " + "0.0")

for i in range(3):
    KRL.append(OffsetsStr + "[" + str(i+1) + "]" + " = "  + "0")
    
KRL.append(ToolNumStr + " = " + "1")
KRL.append(DurationStr +  " = " + "0")

for i in range(listLength):
    KRL.append(FrameListStr + "[" + str(i+1) + "]" + " = " "{X 0.0,Y 0.0,Z 0.0,A 0.0,B 0.0,C 0.0}")
    KRL.append(E1_ListStr + "[" + str(i+1) + "]" + " = "  + "0")

KRL.append(";ENDFOLD INITIALIZE VARIABLES")
KRL.append(";ENDFOLD (INI)")
KRL.append(";------------------------------")
KRL.append("HALTS_ON = TRUE")
KRL.append(";------------------------------")
KRL.append(";FOLD PTP HOME  ")
KRL.append("$BWDSTART = FALSE")
KRL.append("PDAT_ACT=PDEFAULT")
KRL.append("FDAT_ACT=FHOME")
KRL.append("BAS (#PTP_PARAMS,100 )")
KRL.append("$H_POS=XHOME")
KRL.append("PTP  XHOME")
KRL.append(";ENDFOLD")

KRL.append(";------------------------------")
KRL.append(";FOLD SET BASE AND TOOL")
KRL.append("BAS(#BASE, 0)")
KRL.append("BAS(#TOOl, 1)") #could add here to use tool from first task
KRL.append(";ENDFOLD SET BASE AND TOOL")
KRL.append(";----------MOVE FROM START ---------")

#Add tasks
KRL.extend(krlTasks)

KRL.append("END")

oKRL = KRL

iDesFabTasks = desFabTasks
# ---------- end python_5 ----------
panel_50 = Panel(python_5.oKRL)

# ---- group: Display Geometries
python_6 = GhPythonScript(x=[pnp_paper.PickPlaceTask, pnp_paper_2.PickPlaceTask])  # -> out, a
# ---------- python_6: Python ----------
a = x.Geometry
# ---------- end python_6 ----------
python_7 = GhPythonScript(x=[pnp_paper_3.PickPlaceTask, pnp_paper_4.PickPlaceTask])  # -> out, a; same code as python_6
geo_2 = Geometry(decfe_2.GeometryFabOut)
preview_2 = CustomPreview(Geometry=python_6.a, Material=ColourSwatch(SwatchColor=RGBA(110, 217, 43, 12)))
preview_3 = CustomPreview(Geometry=geo_2, Material=ColourSwatch(SwatchColor=RGBA(242, 242, 242, 24)))
preview_4 = CustomPreview(Geometry=python_7.a, Material=ColourSwatch(SwatchColor=RGBA(43, 69, 217, 12)))

# ----
preview_5 = CustomPreview(Geometry=robot_ik.PoseGeometry, Material=ColourSwatch(SwatchColor=RGBA(105, 105, 105, 120)))

# ==== cluster Cluster
O = ClusterInput()
group = Group(Objects=O)
bbox = BoundingBox(Content=group, Plane=PlaneXY(0, 0, 0))  # -> Box, Box_2
F = ClusterInput()
volume = Volume(Geometry=bbox.Box)  # -> Volume, Centroid
L = ClusterInput()
Z = UnitZ(Factor=F)
item = ListItem(List=L, Index=0, Wrap=True)
move = Move(Geometry=volume.Centroid, Motion=Z)  # -> Geometry, Transform
pl_origin = PlaneOrigin(Base=item, Origin=move.Geometry)
pl = ClusterOutput(pl_origin)

# ==== cluster Cluster_2
O = ClusterInput()
group = Group(Objects=O)
bbox = BoundingBox(Content=group, Plane=PlaneXY(0, 0, 0))  # -> Box, Box_2
volume = Volume(Geometry=bbox.Box)  # -> Volume, Centroid
F = ClusterInput()
Z = UnitZ(Factor=F)
B = ClusterInput()
move = Move(Geometry=volume.Centroid, Motion=Z)  # -> Geometry, Transform
pl_origin = PlaneOrigin(Base=B, Origin=move.Geometry)
pl = ClusterOutput(pl_origin)

# ==== cluster CreateTouchUpPlane: Creates a plane from a list of strings containing three touch up points
izoffset = ClusterInput()
ipts = ClusterInput()
iflip = ClusterInput()
izoffset_2 = Number(izoffset)
ipts_2 = Text(ipts)
iflip_2 = Boolean(iflip)
text_split = TextSplit(Text=ipts_2, Separators=",")  # -> simplify(Result)
list_item = ListItem(List=text_split, Index=0, Wrap=True)  # -> Item, Item1, Item2
construct_point = ConstructPoint(XCoordinate=list_item.Item, YCoordinate=list_item.Item1, ZCoordinate=list_item.Item2)
explode_tree = ExplodeTree(Data=construct_point)  # -> Branch0, Branch1, Branch2
plane_3pt = Plane3Pt(PointA=explode_tree.Branch0, PointB=explode_tree.Branch1, PointC=explode_tree.Branch2)
deconstruct_plane = DeconstructPlane(Plane=plane_3pt)  # -> Origin, XAxis, YAxis, ZAxis
reverse = Reverse(Vector=deconstruct_plane.YAxis)
construct_plane = ConstructPlane(Origin=deconstruct_plane.Origin, XAxis=deconstruct_plane.XAxis, YAxis=reverse)
stream_filter = StreamFilter(Gate=iflip_2, Stream0=plane_3pt, Stream1=construct_plane)
deconstruct_plane_2 = DeconstructPlane(Plane=stream_filter)  # -> Origin, XAxis, YAxis, ZAxis
amplitude = Amplitude(Vector=deconstruct_plane_2.ZAxis, Amplitude=izoffset_2)
move = Move(Geometry=stream_filter, Motion=amplitude)  # -> Geometry, Transform
oplane = Plane(move.Geometry)
oplane_2 = ClusterOutput(oplane)

# ==== cluster MovePlane
iplane = ClusterInput()
ioffset = ClusterInput()
iplane_2 = Plane(iplane)
ioffset_2 = Number(ioffset)
deconstruct_plane = DeconstructPlane(Plane=iplane_2)  # -> Origin, XAxis, YAxis, ZAxis
amplitude = Amplitude(Vector=deconstruct_plane.XAxis, Amplitude=ioffset_2)
move = Move(Geometry=iplane_2, Motion=amplitude)  # -> Geometry, Transform
oplane = Plane(move.Geometry)
oplane_2 = ClusterOutput(oplane)
