# Grasshopper definition FabFramework_Beams.gh (Grasshopper 1.0.8)
# plug-ins: RhinoCodePluginGH, Pufferfish, Fab.Grasshopper, VirtualRobot.Grasshopper

# ---- group: FabCollection displays all generated Elements and Tasks
reset = ResetFabCollection(Reset=Button())
allids = AllCollectionIDs(Refresh=Button(), FabCollection=reset)  # -> DesignElementNames, DesignPlateNames, DesignBeamNames, DesignComponentNames, FabElementNames, FabPlateNames, FabBeamNames, FabComponentNames, FabTaskNames, FabTaskSequenceSchema
panel = Panel(allids.DesignElementNames)
panel_2 = Panel(allids.FabTaskNames)

# ---- group: SETUP ACTOR / BeamGripper Actions
panel_3 = Panel("Place")
# Define your FabEnvironment
panel_4 = Panel("10")
panel_5 = Panel("Dip")
action = DefineAction(ActionID=panel_4, Name="Pick_Beam", Type="Pick")
action_2 = DefineAction(ActionID="11", Name="Place_Beam", Type=panel_3)
action_3 = DefineAction(ActionID="12", Name="Dip_Beam", Type=panel_5)
merge = Merge(Data1=action, Data2=action_2, Data3=action_3)

# ---- group: SETUP ACTOR / Robot Actions
action_4 = DefineAction(ActionID="3", Name="Change_Tool", Type="Travel")
action_5 = DefineAction(ActionID="2", Name="travel_LIN", Type="Travel")
action_6 = DefineAction(ActionID="1", Name="travel_PTP", Type="Travel")
merge_2 = Merge(Data1=action_6, Data2=action_5, Data3=action_4)

# ---- group: SETUP ACTOR / PaperGripper Actions
action_7 = DefineAction(ActionID="20", Name="Pick_Paper", Type=panel_3)
action_8 = DefineAction(ActionID="21", Name="Place_Paper", Type="Place_Paper")
action_9 = DefineAction(ActionID="22", Name="Dip_Paper", Type=panel_5)
merge_3 = Merge(Data1=action_7, Data2=action_8, Data3=action_9)

# ---- group: Beam Magazine
pt = Point(Point(1650.261971, -684.125008, 203.0261259))
xy = XYPlane(Origin=pt)
series = Series(Start=0, Step=Slider(70, range=0..100), Count="5")
prot = RotatePlane(Plane=xy, Angle=degrees("-90"))
X = UnitX(Factor=series)
number_slider = Slider(400, range=0..1000)
brep = Brep([<brep referenced from the Rhino model> x34])
move = Move(Geometry=prot, Motion=X)  # -> Geometry, Transform
cluster = Cluster(L=move.Geometry, O=brep, F=number_slider)
staticenv = DefineStaticEnv(
    Index=0,
    Name="BeamTableA_460mm",
    ReferencePlane=move.Geometry,
    AlignPlane=move.Geometry,
    SafePosition=cluster,
    Width=0,
    Length="460",
    Height=0,
    Geometry=brep)

pt_2 = Point(Point(1650.261971, -284.8942387, 203.0261259))
xy_2 = XYPlane(Origin=pt_2)
series_2 = Series(Start=0, Step=Slider(70, range=0..100), Count="5")
prot_2 = RotatePlane(Plane=xy_2, Angle=degrees("-90"))
X_2 = UnitX(Factor=series_2)
brep_2 = Brep([<brep referenced from the Rhino model> x34])
move_2 = Move(Geometry=prot_2, Motion=X_2)  # -> Geometry, Transform
cluster_2 = Cluster(L=move_2.Geometry, O=brep_2, F=number_slider)
staticenv_2 = DefineStaticEnv(
    Index=0,
    Name="BeamTableA_300mm",
    ReferencePlane=move_2.Geometry,
    AlignPlane=move_2.Geometry,
    SafePosition=cluster_2,
    Width=0,
    Length="300",
    Height=0,
    Geometry=brep_2)

pt_3 = Point(Point(1650.261971, 23.56729973, 203.0261259))
xy_3 = XYPlane(Origin=pt_3)
series_3 = Series(Start=0, Step=Slider(70, range=0..100), Count="5")
prot_3 = RotatePlane(Plane=xy_3, Angle=degrees("-90"))
X_3 = UnitX(Factor=series_3)
brep_3 = Brep([<brep referenced from the Rhino model> x34])
move_3 = Move(Geometry=prot_3, Motion=X_3)  # -> Geometry, Transform
cluster_3 = Cluster(L=move_3.Geometry, O=brep_3, F=number_slider)
staticenv_3 = DefineStaticEnv(
    Index=0,
    Name="BeamTableA_220mm",
    ReferencePlane=move_3.Geometry,
    AlignPlane=move_3.Geometry,
    SafePosition=cluster_3,
    Width=0,
    Length="220",
    Height=0,
    Geometry=brep_3)

pt_4 = Point(Point(1652.11998, 237.399766, 203.0261259))
xy_4 = XYPlane(Origin=pt_4)
series_4 = Series(Start=0, Step=Slider(70, range=0..100), Count="5")
prot_4 = RotatePlane(Plane=xy_4, Angle=degrees("-90"))
X_4 = UnitX(Factor=series_4)
brep_4 = Brep([<brep referenced from the Rhino model> x34])
move_4 = Move(Geometry=prot_4, Motion=X_4)  # -> Geometry, Transform
cluster_4 = Cluster(L=move_4.Geometry, O=brep_4, F=number_slider)
staticenv_4 = DefineStaticEnv(
    Index=0,
    Name="BeamTableA_140mm",
    ReferencePlane=move_4.Geometry,
    AlignPlane=move_4.Geometry,
    SafePosition=cluster_4,
    Width=0,
    Length="140",
    Height=0,
    Geometry=brep_4)

# ----
pt_5 = Point(Point(1247.761971, -1175.625008, 175.5261259))
xy_5 = XYPlane(Origin=pt_5)
prot_5 = RotatePlane(Plane=xy_5, Angle=degrees("-90"))
series_5 = Series(Start=0, Step=Slider(50, range=0..100), Count="11")
Y = UnitY(Factor=series_5)
move_5 = Move(Geometry=prot_5, Motion=Y)  # -> Geometry, Transform
brep_5 = Brep([<brep referenced from the Rhino model> x9])
cluster_5 = Cluster(L=move_5.Geometry, O=brep_5, F=Slider(300, range=0..1000))
staticenv_5 = DefineStaticEnv(
    Index=0,
    Name="PaperTable",
    ReferencePlane=move_5.Geometry,
    AlignPlane=move_5.Geometry,
    SafePosition=cluster_5,
    Width=0,
    Length=0,
    Height=0,
    Geometry=brep_5)

brep_6 = Brep(<brep referenced from the Rhino model>)
pt_6 = Point(Point(1748.334371, 2155.939188, 273.0261259))
xy_6 = XYPlane(Origin=pt_6)
prot_6 = RotatePlane(Plane=xy_6, Angle=degrees("-90"))
number_slider_2 = Slider(400, range=0..1000)
Z = UnitZ(Factor="0")
series_6 = Series(Start=number_slider_2, Step=number_slider_2, Count=Slider(4, range=0..10))
move_6 = Move(Geometry=prot_6, Motion=Z)  # -> Geometry, Transform
Z_2 = UnitZ(Factor=series_6)
move_7 = Move(Geometry=move_6.Geometry, Motion=Z_2)  # -> Geometry, Transform
staticenv_6 = DefineStaticEnv(
    Index="1",
    Name="WorkTable",
    ReferencePlane=move_6.Geometry,
    AlignPlane=move_6.Geometry,
    SafePosition=move_7.Geometry,
    Width=0,
    Length=0,
    Height=0,
    Geometry=brep_6)

pt_7 = Point(Point(1300.261971, -280.125008, 253.0261259))
xy_7 = XYPlane(Origin=pt_7)
prot_7 = RotatePlane(Plane=xy_7, Angle=degrees("-90"))
brep_7 = Brep(<brep referenced from the Rhino model>)
cluster_6 = Cluster_2(O=brep_7, B=prot_7, F=Slider(300, range=0..1000))
staticenv_7 = DefineStaticEnv(
    Index=0,
    Name="WaterStation",
    ReferencePlane=prot_7,
    AlignPlane=prot_7,
    SafePosition=cluster_6,
    Width=0,
    Length=0,
    Height=0,
    Geometry=brep_7)

brep_8 = Brep([<brep referenced from the Rhino model> x17])

# ---- group: SETUP ACTOR
brep_9 = Brep([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])
plane = Plane(Plane(origin=(0, -5.918536772e-10, 0), x=(0, 1, 0), y=(1, 0, 0)))

pln = Plane(Plane(origin=(3.552713679e-10, 81.31727984, -94.74873734), x=(1, 0, 0), y=(0, 0.7071067812, 0.7071067812)))
prot_8 = RotatePlane(Plane=pln, Angle=degrees("180"))
endeffector = DefineEndeffector(ToolNum="1", ToolName="BeamGripper", Geometry=brep_9, TCPFrame=prot_8, MountingFrame=plane, Actions=merge, ZOffset=0)

pln_2 = Plane(Plane(origin=(0, -93.63961031, -103.6396103), x=(1, 0, 0), y=(0, 0.7071067812, -0.7071067812)))
prot_9 = RotatePlane(Plane=pln_2, Angle=degrees("0"))
endeffector_2 = DefineEndeffector(ToolNum="2", ToolName="PaperGripper", Geometry=brep_9, TCPFrame=prot_9, MountingFrame=plane, Actions=merge_3, ZOffset=0)

# ----
designbeam = DesignBeam(Name="BaseBeams", Geometry=brep_8, Index=-1)

# ---- group: Beam Magazine
merge_4 = Merge(Data1=staticenv, Data2=staticenv_2, Data3=staticenv_3, Data4=staticenv_4)

# ---- group: SETUP ACTOR
merge_5 = Merge(Data1=endeffector, Data2=endeffector_2)  # -> flatten(Result)

# ---- group: Beam Magazine
pt_8 = Point(Point(2070.261971, -684.125008, 203.0261259))
xy_8 = XYPlane(Origin=pt_8)
series_7 = Series(Start=0, Step=Slider(70, range=0..100), Count="5")
prot_10 = RotatePlane(Plane=xy_8, Angle=degrees("-90"))
X_5 = UnitX(Factor=series_7)
number_slider_3 = Slider(400, range=0..1000)
brep_10 = Brep([<brep referenced from the Rhino model> x34])
move_8 = Move(Geometry=prot_10, Motion=X_5)  # -> Geometry, Transform
cluster_7 = Cluster(L=move_8.Geometry, O=brep_10, F=number_slider_3)
staticenv_8 = DefineStaticEnv(
    Index=0,
    Name="BeamTableB_460mm",
    ReferencePlane=move_8.Geometry,
    AlignPlane=move_8.Geometry,
    SafePosition=cluster_7,
    Width=0,
    Length="460",
    Height=0,
    Geometry=brep_10)

pt_9 = Point(Point(2070.261971, -284.8942387, 203.0261259))
xy_9 = XYPlane(Origin=pt_9)
series_8 = Series(Start=0, Step=Slider(70, range=0..100), Count="5")
prot_11 = RotatePlane(Plane=xy_9, Angle=degrees("-90"))
X_6 = UnitX(Factor=series_8)
brep_11 = Brep([<brep referenced from the Rhino model> x34])
move_9 = Move(Geometry=prot_11, Motion=X_6)  # -> Geometry, Transform
cluster_8 = Cluster(L=move_9.Geometry, O=brep_11, F=number_slider_3)
staticenv_9 = DefineStaticEnv(
    Index=0,
    Name="BeamTableB_300mm",
    ReferencePlane=move_9.Geometry,
    AlignPlane=move_9.Geometry,
    SafePosition=cluster_8,
    Width=0,
    Length="300",
    Height=0,
    Geometry=brep_11)

pt_10 = Point(Point(2070.261971, 23.56729973, 203.0261259))
xy_10 = XYPlane(Origin=pt_10)
series_9 = Series(Start=0, Step=Slider(70, range=0..100), Count="5")
prot_12 = RotatePlane(Plane=xy_10, Angle=degrees("-90"))
X_7 = UnitX(Factor=series_9)
brep_12 = Brep([<brep referenced from the Rhino model> x34])
move_10 = Move(Geometry=prot_12, Motion=X_7)  # -> Geometry, Transform
cluster_9 = Cluster(L=move_10.Geometry, O=brep_12, F=number_slider_3)
staticenv_10 = DefineStaticEnv(
    Index=0,
    Name="BeamTableB_220mm",
    ReferencePlane=move_10.Geometry,
    AlignPlane=move_10.Geometry,
    SafePosition=cluster_9,
    Width=0,
    Length="220",
    Height=0,
    Geometry=brep_12)

pt_11 = Point(Point(2072.041867, 240.946874, 203.0261259))
xy_11 = XYPlane(Origin=pt_11)
series_10 = Series(Start=0, Step=Slider(70, range=0..100), Count="5")
prot_13 = RotatePlane(Plane=xy_11, Angle=degrees("-90"))
X_8 = UnitX(Factor=series_10)
brep_13 = Brep([<brep referenced from the Rhino model> x34])
move_11 = Move(Geometry=prot_13, Motion=X_8)  # -> Geometry, Transform
cluster_10 = Cluster(L=move_11.Geometry, O=brep_13, F=number_slider_3)
staticenv_11 = DefineStaticEnv(
    Index=0,
    Name="BeamTableB_140mm",
    ReferencePlane=move_11.Geometry,
    AlignPlane=move_11.Geometry,
    SafePosition=cluster_10,
    Width=0,
    Length="140",
    Height=0,
    Geometry=brep_13)

# ----
designcomponent = DesignComponent(Name="StackedTable", DesignBeams=designbeam, Index=-1)

# ---- group: SETUP ACTOR
xy_12 = XYPlane(Origin=Point(0, 0, 0))
line = Line(Line((0, -600, 0), (0, 4700, 0)))
actor = DefineActor(Name="Robot", RefPln=xy_12, Tools=merge_5, Actions=merge_2, LinearAxis=line, MaxWeight=-1)

# ----
define_fabcomponent = DefineFabComponent(DesignComponent=designcomponent, StaticEnvFab=staticenv_6, StaticEnvBeam=staticenv)

# ---- group: Beam Magazine
merge_6 = Merge(Data1=staticenv_8, Data2=staticenv_9, Data3=staticenv_10, Data4=staticenv_11)

# ----
sort_by_z_height = SortByZHeight(FabComponent=define_fabcomponent)
c_script = CSharpScript(iFabComponent=sort_by_z_height)  # -> out, oFabComponent
#   port iFabComponent: Casts source data to Fab.Core.FabElement.FabComponent
# ---------- c_script: C# ----------
// Grasshopper Script Instance
#region Usings
using System;
#r "C:\Users\opgenorth\OneDrive - bwstaff\ICD_Projects\DigitalFutures\07_Handout\GHA_Plugins\Fab.Core.dll"
using System.Linq;
using System.Collections;
using System.Collections.Generic;
using System.Drawing;

using Rhino;
using Rhino.Geometry;

using Fab.Core;
using Fab.Core.FabElement;
using Grasshopper;
using Grasshopper.Kernel;
using Grasshopper.Kernel.Data;
using Grasshopper.Kernel.Types;
#endregion

public class Script_Instance : GH_ScriptInstance
{
    #region Notes
    /* 
      Members:
        RhinoDoc RhinoDocument
        GH_Document GrasshopperDocument
        IGH_Component Component
        int Iteration

      Methods (Virtual & overridable):
        Print(string text)
        Print(string format, params object[] args)
        Reflect(object obj)
        Reflect(object obj, string method_name)
    */
    #endregion

    private void RunScript(FabComponent iFabComponent, ref object oFabComponent)
    {

        // Write your logic here
        oFabComponent = null;
    }
}
# ---------- end c_script ----------
panel_6 = Panel("BaseBeams")
pick_place = PickPlace(
    FabComponent=sort_by_z_height,
    FabElementName=panel_6,
    Actor=actor,
    Endeffector=endeffector,
    PickAction=action,
    PlaceAction=action_2,
    OffsetPick=[0, 0, 200],
    OffsetPlace=[0, 0, 200],
    Rotation=0)  # -> FabComponent, PickPlaceTask
deconstruct_fabelement = DeconstructFabElement(FabElements=pick_place.FabComponent, PreviewScale=1)  # -> Name, Index, RefPln_Situ, RefPln_SituBox, RefPln_Mag, RefPln_Fab, RefPln_FabOut, GeometryBoxSitu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
travelgenerator = TravelGenerator(
    FabComponent=pick_place.FabComponent,
    FabTasks=pick_place.PickPlaceTask,
    TravelAction=action_6,
    PickOptimalZ=False,
    OptimalZ=300)  # -> FabComponent, SequencedFabTasks
deconstruct_fabelement_2 = DeconstructFabElement(FabElements=deconstruct_fabelement.FabBeams, PreviewScale="0.5")  # -> Name, Index, RefPln_Situ, RefPln_SituBox, RefPln_Mag, RefPln_Fab, RefPln_FabOut, GeometryBoxSitu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
deconstruct_designelement = DeconstructDesignElement(DesignElements=deconstruct_fabelement_2.DesignElements, PreviewScale="0.3")  # -> Name, Geometry, FrameBase, FrameLower, FrameUpper, DesignLine, BrepBox, DesignRegion

# ----
# Simulate FabTask
number_slider_4 = Slider(0, range=0..24)
trigger = Trigger(Interval=200, TimerInterval=200, Target=simfabtask)  # disabled
pln_3 = Plane(PlaneXY(1700, 360, 1020))
# VirtualRobot Simulation
simfabtask = SimulateFabTaskVirtualRobot(
    FabTasks=travelgenerator.SequencedFabTasks,
    Actor=actor,
    ActorDefaultPlane=pln_3,
    TaskIndex=Slider(0, range=0..1000),
    TaskSubIndex=number_slider_4,
    Reset=Button())  # -> TaskIndex, TaskSubIndex, Name, ToolNumber, Geometry, TCP, E1Value, E2Value, E3Value
panel_7 = Panel([simfabtask.E1Value, simfabtask.E2Value, simfabtask.E3Value])
geo = Geometry(simfabtask.Geometry)
pln_4 = Plane(simfabtask.TCP)
panel_8 = Panel([simfabtask.TaskIndex, simfabtask.TaskSubIndex])
panel_9 = Panel(simfabtask.Name)
panel_10 = Panel(simfabtask.ToolNumber)

# ---- group: Recording Tool for Animations
data = Data(Tree({0;0;0;0}: ["1", "2", "3", "4", "5", "6", "7", "8", "9", "10"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], {0;0;0;1}: ["0", "0", "0", "0", "0", "0", "0", "0", "0", "0"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]))  # disabled
number_slider_5 = Slider(150, range=0..150)  # disabled
panel_11 = Panel("151")  # disabled
split = SplitList(List=data, Index=panel_11)  # -> ListA, ListB; disabled
item = ListItem(List=split.ListA, Index=number_slider_5, Wrap=True)  # -> simplify(Item); disabled
bang = ExplodeTree(Data=item)  # -> Branch0, Branch1; disabled

# ---- group: Recording Tool for Animations / Plug into I/SI for recording
graft = GraftTree(IncludeEmptyLists=True, IncludeNullItems=True)  # disabled
rec = DataRecorder(graft, DataLimit=-10, RecordData=False)  # disabled

# ----
end = EndPoints(Curve=line)  # -> Start, End
xy_13 = XYPlane(Origin=end.Start)
Y_2 = UnitY(Factor=simfabtask.E1Value)
move_12 = Move(Geometry=xy_13, Motion=Y_2)  # -> Geometry, Transform

# ----
# VirtualRobot Setup
python = GhPythonScript(iFabTools=merge_5)  # -> oVR_Tools; inputs iFabTools: list
# ---------- python: Python ----------
import Rhino.Geometry as rg
import ghpythonlib.components as ghc


tool_dict = {}
tool_List = []
toolsData = []
toolsNum = []
for i in range(len(iFabTools)):
    toolName = iFabTools[i].Name
    toolNum = iFabTools[i].ToolNum
    toolGeo = iFabTools[i].Geometry
    toolTcpPln= iFabTools[i].TcpPln
    toolMountPln = iFabTools[i].MountPln
    endeffector = ghc.VirtualRobot.DefineEndEffector(toolGeo, toolTcpPln, toolMountPln)
    tool_dict[toolNum] = endeffector

tool_List.append(tool_dict) # only 'way' to output dictionary

# Output the dictionary
oVR_Tools = tool_List
# ---------- end python ----------
python_2 = GhPythonScript(iToolNum=simfabtask.ToolNumber, iVR_Tools=python)  # -> oVR_Tool; inputs iToolNum: Int32
# ---------- python_2: Python ----------
oVR_Tool = iVR_Tools.get(iToolNum)
# ---------- end python_2 ----------
kuka_kr_120 = PredefinedKUKAKR120Robot(RobRootFrame=move_12.Geometry, EndEffectorOptional=python_2, variant="R2700")
data_2 = Data(kuka_kr_120)
robot_ik = RobotInverseKinematics(Robot=data_2, TargetTCPFrame=pln_4, AxisToggles=[False, False, False], useColorPreview=True)  # -> PoseGeometry, AxisValues, AxisFrames
item_2 = ListItem(List=robot_ik.AxisFrames, Index=0, Wrap=True)
item_3 = ListItem(List=robot_ik.AxisFrames, Index=5, Wrap=True)
swatch = ColourSwatch(SwatchColor=RGB(255, 0, 255))
roundd = RoundToDecimalPlace(NumberX=simfabtask.E2Value, DecimalPlace=2, RoundType=0)  # -> Rounded, Difference
roundd_2 = RoundToDecimalPlace(NumberX=simfabtask.E1Value, DecimalPlace=2, RoundType=0)  # -> Rounded, Difference
swatch_2 = ColourSwatch(SwatchColor=RGB(99, 99, 99))
preview = CustomPreview(Geometry=geo, Material=swatch)
tag = TextTag(Text=roundd.Rounded, Colour=swatch)
tag_2 = TextTag(Location=item_3, Text=simfabtask.Name, Colour=ColourSwatch(SwatchColor=RGB(255, 255, 0)))
tag_3 = TextTag(Location=item_2, Text=roundd_2.Rounded, Colour=swatch)

# ---- group: GhostSolver Check all Frames from Task
simfabtaskall = SimulateFabTaskVirtualRobot(Actor=actor)  # -> TaskIndex, TaskSubIndex, Name, ToolNumber, Geometry, TCP, E1Value, E2Value, E3Value; disabled
kuka_kr_120_2 = PredefinedKUKAKR120Robot(RobRootFrame=xy_13, EndEffectorOptional=python_2, variant="R2700")  # disabled
python_3 = GhPythonScript(
    iIndex=simfabtaskall.TaskIndex,
    iSubIndex=simfabtaskall.TaskSubIndex,
    iTaskName=simfabtaskall.Name,
    iToolNum=simfabtaskall.ToolNumber,
    iGeometry=simfabtaskall.Geometry,
    iTCP=simfabtaskall.TCP,
    iE1=simfabtaskall.E1Value,
    iE2=simfabtaskall.E2Value,
    iRobotPlatform=kuka_kr_120_2,
    iVR_Tools=python,
    iLinAxisStartPlane=xy_13)  # -> out, failedIndex, failedSubIndex, failedTaskName, failedTCP; inputs iIndex: tree of Int32, iSubIndex: tree of Int32, iTaskName: tree, iToolNum: tree of Int32, iGeometry: tree of Mesh, iTCP: tree of Plane, iE1: tree, iE2: tree, iLinAxisStartPlane: Plane; disabled
# ---------- python_3: Python ----------
import ghpythonlib.components as ghc
import math
import Grasshopper.Kernel as gh
from Grasshopper.Kernel import GH_RuntimeMessageLevel as RML
import Rhino.Geometry as rg

import clr
clr.AddReference("VirtualRobot.Core.dll")
import ICD.VirtualRobot.Core as VR

failedIndex = []
failedSubIndex = []
failedTaskName = []
failedTCP = []

def CheckAxisLimits(aV):
    for i in range(len(aV)):
        if math.isnan(aV[i]):
            errorMessage = "TCP can't be reached."
            return False, errorMessage
    if aV[0] < (-185) or aV[0] > 185:
        errorMessage = "A1 limit reached: " + str(aV[0])
        return False, errorMessage
    if aV[1] < (-130) or aV[1] > 20:
        errorMessage = "A2 limit reached: " + str(aV[1])
        return False, errorMessage
    if aV[2] < (-100) or aV[2] > 144:
        errorMessage = "A3 limit reached: " + str(aV[2])
        return False, errorMessage
    if aV[3] < (-350) or aV[3] > 350:
        errorMessage = "A4 limit reached: " + str(aV[3])
        return False, errorMessage
    if aV[4] < (-120) or aV[4] > 120:
        errorMessage = "A5 limit reached: " + str(aV[4])
        return False, errorMessage
    if aV[5] < (-350) or aV[5] > 350:
        errorMessage = "A6 limit reached: " + str(aV[5])
        return False, errorMessage
    return True, "No Axis limit reached."


for i in range(iTCP.BranchCount):
    tcpBranch = iTCP.Branch(i)
    for j in range(len(tcpBranch)):
        index = iIndex.Branch(i)[j]
        subIndex = iSubIndex.Branch(i)[j]
        taskName = iTaskName.Branch(i)[j]
        taskNameID = "I:" + str(index) + " SI:" + str(subIndex) + " - " + str(taskName)
        
        iRobotPlatform.EndEffector = iVR_Tools.get(iToolNum.Branch(i)[j])
        robot = iRobotPlatform
        tcp = iTCP.Branch(i)[j]
        axisToggles = [False, False, False]
        linAxisValue = -iE1.Branch(i)[j]
        #if j == 1:
        a = robot
        b = tcp
        c = linAxisValue
        
        #update linear axis value
        robRootFrame = iLinAxisStartPlane.Clone()
        linAxis_vector = rg.Vector3d(0, -linAxisValue, 0)
        robRootFrame.Translate(linAxis_vector)
        robot.RobRootFrame = robRootFrame
        
        poseGeo, axisValues, axisFrames = ghc.VirtualRobot.RobotInverseKinematics(robot, tcp, axisToggles)
        noAxisLimit, errorMessage_Axis =  CheckAxisLimits(axisValues)
        if noAxisLimit == False:
            warning_message = str(taskNameID) + " | " + str(errorMessage_Axis)
            ghenv.Component.AddRuntimeMessage(RML.Warning, warning_message)
            print warning_message
            failedIndex.append(index)
            failedSubIndex.append(subIndex)
            failedTaskName.append(taskName)
            failedTCP.append(tcp)
# ---------- end python_3 ----------
pln_5 = Plane(python_3.failedTCP)  # disabled
panel_12 = Panel(python_3.out)

# ----
swatch_3 = ColourSwatch(SwatchColor=RGBA(105, 105, 105, 56))
preview_2 = CustomPreview(Geometry=robot_ik.PoseGeometry, Material=swatch_3)
brep_14 = Brep([<brep referenced from the Rhino model> x140])
brep_15 = Brep([<brep referenced from the Rhino model> x7])
mesh = Mesh(<mesh referenced from the Rhino model>)
custom_preview = CustomPreview(Geometry=[brep_14, brep_15], Material=ColourSwatch(SwatchColor=RGB(54, 54, 54)))
preview_3 = CustomPreview(Geometry=mesh, Material=swatch_3)

# ==== cluster Cluster
O = ClusterInput()
group = Group(Objects=O)
bbox = BoundingBox(Content=group, Plane=PlaneXY(0, 0, 0))  # -> Box, Box_2
F = ClusterInput()
volume = Volume(Geometry=bbox.Box)  # -> Volume, Centroid
L = ClusterInput()
Z = UnitZ(Factor=F)
item = ListItem(List=L, Index=0, Wrap=True)
move = Move(Geometry=volume.Centroid, Motion=Z)  # -> Geometry, Transform
pl_origin = PlaneOrigin(Base=item, Origin=move.Geometry)
pl = ClusterOutput(pl_origin)

# ==== cluster Cluster_2
O = ClusterInput()
group = Group(Objects=O)
bbox = BoundingBox(Content=group, Plane=PlaneXY(0, 0, 0))  # -> Box, Box_2
volume = Volume(Geometry=bbox.Box)  # -> Volume, Centroid
F = ClusterInput()
Z = UnitZ(Factor=F)
B = ClusterInput()
move = Move(Geometry=volume.Centroid, Motion=Z)  # -> Geometry, Transform
pl_origin = PlaneOrigin(Base=B, Origin=move.Geometry)
pl = ClusterOutput(pl_origin)
