# Grasshopper definition VirtualRobot_ExampleFile.gh (Grasshopper 1.0.7)
# plug-ins: VirtualRobot.Grasshopper

# ---- group: TCP
C = Slider(0, range=-180..180)
point = Point(Point(2019.615301, -3826.410481, 850.1994))
A = Slider(0, range=-180..180)
B = Slider(0, range=-180..180)
cluster = Cluster(plane=point, angle_3=A, angle=B, angle_2=C)

# ----
plane = Plane(PlaneXY(0, -4000, 0))
predefined_spindle_end_effector = PredefinedSpindleEndEffector()
xy_plane = XYPlane(Origin=plane)
predefined_kuka_kr_420_r3080 = PredefinedKUKAKR420R3080(RobRootFrame=xy_plane, EndEffectorOptional=predefined_spindle_end_effector)
robot_inverse_kinematics = RobotInverseKinematics(Robot=predefined_kuka_kr_420_r3080, TargetTCPFrame=cluster, AxisToggles=[False, False, False], useColorPreview=True)  # -> PoseGeometry, AxisValues, AxisFrames

# ---- group: TCP
point_2 = Point(Point(2489.137458, -840.8803026, 850.1994))
A_2 = Slider(89, range=-180..180)
B_2 = Slider(0, range=-180..180)
C_2 = Slider(0, range=-180..180)
cluster_2 = Cluster_2(plane=point_2, angle_3=A_2, angle=B_2, angle_2=C_2)

# ---- group: Linear Axis
e1 = Slider(-1000, range=-1000..5000)
unit_y = UnitY(Factor=e1)
xy_plane_2 = XYPlane(Origin=Point(0, 0, 0))
move = Move(Geometry=xy_plane_2, Motion=unit_y)  # -> Geometry, Transform

# ---- group: Tool
brep = Brep([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])
plane_2 = Plane(Plane(origin=(0, -5.918536772e-10, 0), x=(0, 1, 0), y=(1, 0, 0)))

plane_3 = Plane(Plane(origin=(3.552713679e-10, 81.31727984, -94.74873734), x=(1, 0, 0), y=(0, 0.7071067812, 0.7071067812)))
plane_4 = Plane(Plane(origin=(0, -93.63961031, -103.6396103), x=(1, 0, 0), y=(0, 0.7071067812, -0.7071067812)))
tool = Slider(0, range=0..1)
define_end_effector = DefineEndEffector(Geometry=brep, TCPFrame=plane_4, MountingFrame=plane_2)
define_end_effector_2 = DefineEndEffector(Geometry=brep, TCPFrame=plane_3, MountingFrame=plane_2)
stream_filter = StreamFilter(Gate=tool, Stream0=define_end_effector_2, Stream1=define_end_effector)

# ----
predefined_kuka_kr_210_robot = PredefinedKUKAKR210Robot(RobRootFrame=move.Geometry, EndEffectorOptional=stream_filter, variant="R2700")
robot_inverse_kinematics_2 = RobotInverseKinematics(Robot=predefined_kuka_kr_210_robot, TargetTCPFrame=cluster_2, AxisToggles=[False, False, False], useColorPreview=True)  # -> PoseGeometry, AxisValues, AxisFrames
mesh = Mesh(<mesh referenced from the Rhino model>)
preview = CustomPreview(Geometry=mesh, Material=ColourSwatch(SwatchColor=RGB(115, 115, 115)))

# ==== cluster Cluster
plane = ClusterInput()
angle = ClusterInput()
angle_2 = ClusterInput()
angle_3 = ClusterInput()
rotate_plane = RotatePlane(Plane=plane, Angle=degrees(angle))
yz_plane = YZPlane(Origin=rotate_plane)
rotate = Rotate(Geometry=rotate_plane, Angle=degrees(angle_2), Plane=yz_plane)  # -> Geometry, Transform
xz_plane = XZPlane(Origin=rotate.Geometry)
rotate_2 = Rotate(Geometry=rotate.Geometry, Angle=degrees(angle_3), Plane=xz_plane)  # -> Geometry, Transform
geometry = ClusterOutput(rotate_2.Geometry)

# ==== cluster Cluster_2
plane = ClusterInput()
angle = ClusterInput()
rotate_plane = RotatePlane(Plane=plane, Angle=degrees(angle))
yz_plane = YZPlane(Origin=rotate_plane)
angle_2 = ClusterInput()
rotate = Rotate(Geometry=rotate_plane, Angle=degrees(angle_2), Plane=yz_plane)  # -> Geometry, Transform
xz_plane = XZPlane(Origin=rotate.Geometry)
angle_3 = ClusterInput()
rotate_2 = Rotate(Geometry=rotate.Geometry, Angle=degrees(angle_3), Plane=xz_plane)  # -> Geometry, Transform
geometry = ClusterOutput(rotate_2.Geometry)
